# Grasshopper definition 200404_RotatingRectangle_MalletStevens.gh (Grasshopper 1.0.7)
# plug-ins: Bifocals

width = Slider(18, range=2..20)
xz_plane = XZPlane(Origin=Point(0, 0, 0))
distanceframe = Slider(7, range=0..100)
framecount = Slider(88, range=0..100)
negative = Negative(Value=width)
angleframes = Slider(7, range=0..100)
construct_domain = ConstructDomain(DomainStart=width, DomainEnd=negative)
series = Series(Start=0, Step=distanceframe, Count=framecount)
unit_y = UnitY(Factor=series)
multiplication = Multiplication(A=framecount, B=distanceframe)
negative_2 = Negative(Value=multiplication)
rectangle = Rectangle(Plane=xz_plane, XSize=construct_domain, YSize=construct_domain, Radius=0)  # -> Rectangle, Length
series_2 = Series(Start=0, Step=angleframes, Count=framecount)
construct_domain_2 = ConstructDomain(DomainStart=multiplication, DomainEnd=negative_2)
move = Move(Geometry=xz_plane, Motion=unit_y)  # -> Geometry, Transform
move_2 = Move(Geometry=rectangle.Rectangle, Motion=unit_y)  # -> Geometry, Transform
rotate = Rotate(Geometry=move_2.Geometry, Angle=degrees(series_2), Plane=move.Geometry)  # -> Geometry, Transform
rectangle_2 = Rectangle(Plane=PlaneXY(0, 0, 0), XSize=construct_domain_2, YSize=construct_domain_2, Radius=0)  # -> Rectangle, Length
boundary_surfaces = BoundarySurfaces(Edges=rectangle_2.Rectangle)
surface_curve = SurfaceCurve(Surface=boundary_surfaces, Curve=rotate.Geometry)  # -> Curves, Points, UVPoints, Normals, Parameters, Tangents
multiplication_2 = Multiplication(A=width, B="2")
shatter = Shatter(Curve=graft(rotate.Geometry), Parameters=surface_curve.Parameters)
unit_z = UnitZ(Factor="0.1")
box_rectangle = BoxRectangle(Rectangle=rectangle_2.Rectangle, Height=multiplication_2)
move_3 = Move(Geometry=box_rectangle, Motion=unit_z)  # -> Geometry, Transform
panel = Panel("1")
shape_in_brep = ShapeInBrep(Brep=move_3.Geometry, Shape=shatter)
subtraction = Subtraction(A=shape_in_brep, B="1")
size_wood_structure = Slider(0.4, range=0..1)  # disabled
dispatch = Dispatch(List=shatter, DispatchPattern=subtraction)  # -> ListA, ListB
geometry = Geometry(dispatch.ListB)
end_points = EndPoints(Curve=geometry)  # -> Start, End; disabled
end_points_2 = EndPoints(Curve=geometry)  # -> Start, End; disabled
curve_closest_point = CurveClosestPoint(Point=end_points.End, Curve=geometry)  # -> Point, Parameter, Distance; disabled
curve_closest_point_2 = CurveClosestPoint(Point=end_points_2.Start, Curve=geometry)  # -> Point, Parameter, Distance; disabled
perp_frame = PerpFrame(Curve=geometry, Parameter=curve_closest_point.Parameter)  # disabled
negative_3 = Negative(Value=size_wood_structure)  # disabled
construct_domain_3 = ConstructDomain(DomainStart=size_wood_structure, DomainEnd=negative_3)  # disabled
geometry_2 = Geometry(dispatch.ListB)
end_points_3 = EndPoints(Curve=geometry_2)  # -> Start, End
rectangle_3 = Rectangle(Plane=perp_frame, XSize=construct_domain_3, YSize=construct_domain_3, Radius=0)  # -> Rectangle, Length; disabled
bottom_fixures = Slider(-2, range=-2..0)  # disabled
perp_frame_2 = PerpFrame(Curve=geometry, Parameter=curve_closest_point_2.Parameter)  # disabled
panel_2 = Panel("100")  # disabled
sweep1 = Sweep1(Rail=geometry, Sections=rectangle_3.Rectangle, Miter=1)  # disabled
curve_closest_point_3 = CurveClosestPoint(Point=end_points_3.End, Curve=geometry_2)  # -> Point, Parameter, Distance
curve_closest_point_4 = CurveClosestPoint(Point=end_points_3.Start, Curve=geometry_2)  # -> Point, Parameter, Distance
unit_z_2 = UnitZ(Factor=bottom_fixures)  # disabled
number_slider = Slider(0.05, range=0..1)
move_4 = Move(Geometry=boundary_surfaces, Motion=unit_z_2)  # -> Geometry, Transform; disabled
number_slider_2 = Slider(0.56, range=0..1)
extend_curve = ExtendCurve(Curve=geometry, Type=0, Start=panel_2, End=panel_2)  # disabled
perp_frame_3 = PerpFrame(Curve=geometry_2, Parameter=curve_closest_point_3.Parameter)
perp_frame_4 = PerpFrame(Curve=geometry_2, Parameter=curve_closest_point_4.Parameter)
negative_4 = Negative(Value=number_slider)
negative_5 = Negative(Value=number_slider_2)
construct_domain_4 = ConstructDomain(DomainStart=number_slider, DomainEnd=negative_4)
construct_domain_5 = ConstructDomain(DomainStart=number_slider_2, DomainEnd=negative_5)
surface_curve_2 = SurfaceCurve(Surface=move_4.Geometry, Curve=extend_curve)  # -> Curves, Points, UVPoints, Normals, Parameters, Tangents; disabled
thickness_structure_bottom = Slider(0.05, range=0..0.05)  # disabled
rectangle_4 = Rectangle(Plane=perp_frame_3, XSize=construct_domain_5, YSize=construct_domain_5, Radius=0)  # -> Rectangle, Length
panel_3 = Panel("1")  # disabled
negative_6 = Negative(Value=thickness_structure_bottom)  # disabled
rectangle_5 = Rectangle(Plane=perp_frame_4, XSize=construct_domain_4, YSize=construct_domain_5, Radius=0)  # -> Rectangle, Length
rectangle_6 = Rectangle(Plane=perp_frame_3, XSize=construct_domain_4, YSize=construct_domain_5, Radius=0)  # -> Rectangle, Length
construct_domain_6 = ConstructDomain(DomainStart=thickness_structure_bottom, DomainEnd=negative_6)  # disabled
negative_7 = Negative(Value="100")
point = Point(surface_curve_2.Points)  # disabled
end_points_4 = EndPoints(Curve=geometry)  # -> Start, End; disabled
dispatch_2 = Dispatch(List=point, DispatchPattern=[True, False])  # -> flatten(ListA), ListB; disabled
box_rectangle_2 = BoxRectangle(Rectangle=rectangle_5.Rectangle, Height=negative_7)
panel_4 = Panel("1000")  # disabled
rectangle_7 = Rectangle(Plane=perp_frame, XSize=construct_domain_6, YSize=construct_domain_3, Radius=0)  # -> Rectangle, Length; disabled
unit_z_3 = UnitZ(Factor=Slider(-4.12, range=-10..0))
box_rectangle_3 = BoxRectangle(Rectangle=rectangle_6.Rectangle, Height="100")
deconstruct_plane = DeconstructPlane(Plane=perp_frame_4)  # -> Origin, XAxis, YAxis, ZAxis
rectangle_8 = Rectangle(Plane=perp_frame_2, XSize=construct_domain_6, YSize=construct_domain_3, Radius=0)  # -> Rectangle, Length; disabled
deconstruct_plane_2 = DeconstructPlane(Plane=perp_frame_3)  # -> Origin, XAxis, YAxis, ZAxis
negative_8 = Negative(Value=panel_4)  # disabled
move_5 = Move(Geometry=boundary_surfaces, Motion=unit_z_3)  # -> Geometry, Transform
box_rectangle_4 = BoxRectangle(Rectangle=rectangle_7.Rectangle, Height=panel_4)  # disabled
line_sdl = LineSDL(Start=deconstruct_plane.Origin, Direction=deconstruct_plane.ZAxis, Length=negative_7)
line_sdl_2 = LineSDL(Start=deconstruct_plane_2.Origin, Direction=deconstruct_plane_2.ZAxis, Length="100")
split_brep = SplitBrep(Brep=box_rectangle_4, Cutter=move_4.Geometry)  # disabled
box_rectangle_5 = BoxRectangle(Rectangle=rectangle_8.Rectangle, Height=negative_8)  # disabled
split_brep_2 = SplitBrep(Brep=box_rectangle_3, Cutter=move_5.Geometry)
split_brep_3 = SplitBrep(Brep=box_rectangle_2, Cutter=move_5.Geometry)
interpolate = Interpolate(Vertices=dispatch_2.ListA, Degree=3, Periodic=False, KnotStyle=1)  # -> Curve, Length, Domain; disabled
interpolate_2 = Interpolate(Vertices=flatten(dispatch_2.ListB), Degree=3, Periodic=False, KnotStyle=1)  # -> Curve, Length, Domain; disabled
bottom_offset = Slider(0.5, range=0..2)  # disabled
split_brep_4 = SplitBrep(Brep=box_rectangle_5, Cutter=move_4.Geometry)  # disabled
rectangle_9 = Rectangle(Plane=PlaneXY(0, 0, 0), XSize=construct_domain, YSize=multiplication, Radius=0)  # -> Rectangle, Length; disabled
surface_curve_3 = SurfaceCurve(Surface=move_5.Geometry, Curve=line_sdl_2)  # -> Curves, flatten(Points), UVPoints, Normals, Parameters, Tangents
surface_curve_4 = SurfaceCurve(Surface=move_5.Geometry, Curve=line_sdl)  # -> Curves, flatten(Points), UVPoints, Normals, Parameters, Tangents
panel_5 = Panel("0")  # disabled
list_item = ListItem(List=split_brep, Index=panel_5, Wrap=True)  # disabled
negative_9 = Negative(Value=bottom_offset)  # disabled
move_6 = Move(Geometry=rectangle_9.Rectangle, Motion=unit_z_2)  # -> Geometry, Transform; disabled
list_item_2 = ListItem(List=split_brep_4, Index=panel_5, Wrap=True)  # disabled
interpolate_3 = Interpolate(Vertices=surface_curve_4.Points, Degree=3, Periodic=False, KnotStyle=1)  # -> Curve, Length, Domain
interpolate_4 = Interpolate(Vertices=surface_curve_3.Points, Degree=3, Periodic=False, KnotStyle=1)  # -> Curve, Length, Domain
number_slider_3 = Slider(2, range=0..10)
offset_curve_loose = OffsetCurveLoose(Curve=interpolate.Curve, Distance=[bottom_offset, negative_9])  # disabled
offset_curve_loose_2 = OffsetCurveLoose(Curve=interpolate_2.Curve, Distance=[bottom_offset, negative_9])  # disabled
negative_10 = Negative(Value=number_slider_3)
offset_curve_loose_3 = OffsetCurveLoose(Curve=interpolate_4.Curve, Distance=[negative_10, number_slider_3])
offset_curve_loose_4 = OffsetCurveLoose(Curve=interpolate_3.Curve, Distance=[negative_10, number_slider_3])
end_points_5 = EndPoints(Curve=offset_curve_loose)  # -> Start, End; disabled
end_points_6 = EndPoints(Curve=offset_curve_loose_2)  # -> Start, End; disabled
polyline = PolyLine(Vertices=end_points_5.End, Closed=False)  # disabled
polyline_2 = PolyLine(Vertices=end_points_5.Start, Closed=False)  # disabled
polyline_3 = PolyLine(Vertices=end_points_6.Start, Closed=False)  # disabled
polyline_4 = PolyLine(Vertices=end_points_6.End, Closed=False)  # disabled
end_points_7 = EndPoints(Curve=offset_curve_loose_4)  # -> Start, End
end_points_8 = EndPoints(Curve=offset_curve_loose_3)  # -> Start, End
polyline_5 = PolyLine(Vertices=end_points_8.Start, Closed=False)
polyline_6 = PolyLine(Vertices=end_points_8.End, Closed=False)
polyline_7 = PolyLine(Vertices=end_points_7.Start, Closed=False)
polyline_8 = PolyLine(Vertices=end_points_7.End, Closed=False)
join_curves = JoinCurves(Curves=[polyline_3, offset_curve_loose_2, polyline_4], Preserve=False)  # disabled
join_curves_2 = JoinCurves(Curves=[polyline, polyline_2, offset_curve_loose], Preserve=False)  # disabled
boundary_surfaces_2 = BoundarySurfaces(Edges=join_curves)  # disabled
join_curves_3 = JoinCurves(Curves=[polyline_5, polyline_6, offset_curve_loose_3], Preserve=False)
boundary_surfaces_3 = BoundarySurfaces(Edges=join_curves_2)  # disabled
join_curves_4 = JoinCurves(Curves=[polyline_7, polyline_8, offset_curve_loose_4], Preserve=False)
boundary_surfaces_4 = BoundarySurfaces(Edges=join_curves_3)
boundary_surfaces_5 = BoundarySurfaces(Edges=join_curves_4)
list_item_3 = ListItem(List=split_brep_2, Index=0, Wrap=True)
list_item_4 = ListItem(List=split_brep_3, Index=0, Wrap=True)
sweep1_2 = Sweep1(Rail=geometry_2, Sections=rectangle_4.Rectangle, Miter=1)
