# Grasshopper definition 200418_CeilingRectangular.gh (Grasshopper 1.0.7)
# plug-ins: Bifocals

geometry = Geometry(<brep referenced from the Rhino model>)
geometry_2 = Geometry(<curve referenced from the Rhino model>)
boundary_surfaces = BoundarySurfaces(Edges=geometry_2)
bounding_box = BoundingBox(Content=boundary_surfaces, Plane=PlaneXY(0, 0, 0))  # -> Box, Box_2
deconstruct_box = DeconstructBox(Box=bounding_box.Box)  # -> Plane, X, Y, Z
deconstruct_domain = DeconstructDomain(Domain=deconstruct_box.X)  # -> Start, End
deconstruct_domain_2 = DeconstructDomain(Domain=deconstruct_box.Y)  # -> Start, End
number_slider = Slider(0.42, range=0..10)
subtraction = Subtraction(A=deconstruct_domain.End, B=deconstruct_domain.Start)
subtraction_2 = Subtraction(A=deconstruct_domain_2.End, B=deconstruct_domain_2.Start)
panel = Panel(subtraction_2)
multiplication = Multiplication(A=subtraction_2, B=number_slider)
multiplication_2 = Multiplication(A=subtraction, B=number_slider)
divide_surface = DivideSurface(Surface=boundary_surfaces, UCount=multiplication_2, VCount=multiplication)  # -> Points, Normals, Parameters
unit_z = UnitZ(Factor=Slider(72, range=0..100))
unit_z_2 = UnitZ(Factor=1)
move = Move(Geometry=divide_surface.Points, Motion=unit_z)  # -> Geometry, Transform
number_slider_2 = Slider(0.64, range=0..1)
project_point = ProjectPoint(Point=divide_surface.Points, Direction=unit_z_2, Geometry=geometry)  # -> Point, Index
negative = Negative(Value=number_slider_2)
construct_domain = ConstructDomain(DomainStart=number_slider_2, DomainEnd=negative)
distance = Distance(PointA=project_point.Point, PointB=move.Geometry)
rectangle = Rectangle(Plane=project_point.Point, XSize=construct_domain, YSize=construct_domain, Radius=0)  # -> Rectangle, Length
move_2 = Move(Geometry=boundary_surfaces, Motion=unit_z)  # -> Geometry, Transform
box_rectangle = BoxRectangle(Rectangle=rectangle.Rectangle, Height=distance)
