# Grasshopper definition 200503_ParametricTower.gh (Grasshopper 1.0.7)

amount_of_floors = Slider(15, range=0..42)
height_floor = Slider(5, range=0..10)
overall_size = Slider(10, range=0..10)
rotation = Slider(14, range=0..60)
series = Series(Start=0, Step=height_floor, Count=amount_of_floors)
polygon = Polygon(Plane=PlaneXY(0, 0, 0), Radius=overall_size, Segments=6, FilletRadius=0)  # -> Polygon, Length
unit_z = UnitZ(Factor=series)
series_2 = Series(Start=0, Step=rotation, Count=amount_of_floors)
construct_point = ConstructPoint(XCoordinate=0, YCoordinate=0, ZCoordinate=0)
move = Move(Geometry=polygon.Polygon, Motion=unit_z)  # -> Geometry, Transform
bounds = Bounds(Numbers=series_2)
move_2 = Move(Geometry=construct_point, Motion=unit_z)  # -> Geometry, Transform
remap_numbers = RemapNumbers(Value=series_2, Source=bounds, Target=Domain(0, 1))  # -> Mapped, Clipped
rotate = Rotate(Geometry=move.Geometry, Angle=degrees(series_2), Plane=PlaneXY(0, 0, 0))  # -> Geometry, Transform
graph_mapper = GraphMapper(
    remap_numbers.Mapped,
    x0=0,
    x1=1,
    y0=0,
    y1=1,
    container_name="Sine",
    Equation_px=[0.2259852737, 0.5497100353],
    Equation_py=[0.9029394984, 0.6092272997])
scale = Scale(Geometry=rotate.Geometry, Center=move_2.Geometry, Factor=graph_mapper)  # -> Geometry, Transform
explode = Explode(Curve=scale.Geometry, Recursive=True)  # -> Segments, Vertices
flip_matrix = FlipMatrix(Data=explode.Vertices)
point_on_curve = PointOnCurve(explode.Segments, parameter=0.5)
flip_matrix_2 = FlipMatrix(Data=point_on_curve)
number_slider = Slider(0.1, range=0..1)
polyline = PolyLine(Vertices=flip_matrix_2, Closed=False)
polyline_2 = PolyLine(Vertices=flip_matrix, Closed=False)
data_dam = DataDam(DataA=[polyline_2, polyline], BufferDelay=10000000, BufferMode=0)
loft = Loft(Curves=scale.Geometry, Options={Adjust=False, Closed=False, LoftEnds=0, LoftSimp=0, LoftType=0, Rebuild=10, Refit=0.01})
boundary_surfaces = BoundarySurfaces(Edges=scale.Geometry)
pipe = Pipe(Curve=data_dam, Radius=number_slider, Caps=0)
unit_z_2 = UnitZ(Factor=number_slider)
inner_core = Slider(7.79, range=0..10)
extrude = Extrude(Base=scale.Geometry, Direction=unit_z_2)
offset_surface = OffsetSurface(Surface=boundary_surfaces, Distance=number_slider, Retrim=True)
negative = Negative(Value=inner_core)
merge = Merge(Data1=boundary_surfaces, Data2=offset_surface, Data3=extrude)
offset_curve = OffsetCurve(Curve=move.Geometry, Distance=negative, Plane=PlaneXY(0, 0, 0), Corners=1)  # -> flatten(Curve)
loft_2 = Loft(Curves=offset_curve, Options={Adjust=False, Closed=False, LoftEnds=0, LoftSimp=0, LoftType=0, Rebuild=10, Refit=0.01})
merge_2 = Merge(Data1=merge, Data2=extrude, Data3=pipe, Data4=loft_2, Data5=loft)
