# Grasshopper definition 200507_WeirdRoofShapes with doors Pipeline.gh (Grasshopper 1.0.7)

geometry_pipeline = GeometryPipeline(
    GroupByLayer=False,
    GroupByType=False,
    IncludeHidden=True,
    IncludeLocked=True,
    LayerFilter="Walls",
    NameFilter="*",
    SublayerFiltering=True,
    TypeFilter=4)
geometry_pipeline_2 = GeometryPipeline(
    GroupByLayer=False,
    GroupByType=False,
    IncludeHidden=True,
    IncludeLocked=True,
    LayerFilter="Doors",
    NameFilter="*",
    SublayerFiltering=True,
    TypeFilter=1)
doorsize = Slider(7.39, range=0..100)
thickness = Slider(1.34, range=0..10)
closed = Closed(Curve=geometry_pipeline)  # -> Closed, Periodic
circle = Circle(Plane=geometry_pipeline_2, Radius=doorsize)
division = Division(A=thickness, B="2")
dispatch = Dispatch(List=geometry_pipeline, DispatchPattern=closed.Closed)  # -> ListA, ListB
negative = Negative(Value=division)
trim_with_regions = TrimWithRegions(Curve=geometry_pipeline, Regions=circle)  # -> Inside, Outside
end_points = EndPoints(Curve=dispatch.ListB)  # -> Start, End
line = Line(StartPoint=end_points.Start, EndPoint=end_points.End)
offset_curve = OffsetCurve(Curve=trim_with_regions.Outside, Distance=division, Plane=PlaneXY(0, 0, 0), Corners=1)
offset_curve_2 = OffsetCurve(Curve=trim_with_regions.Outside, Distance=negative, Plane=PlaneXY(0, 0, 0), Corners=1)
geometry = Geometry(trim_with_regions.Inside)
join_curves = JoinCurves(Curves=[dispatch.ListB, line], Preserve=False)
merge = Merge(Data1=offset_curve, Data2=offset_curve_2)
end_points_2 = EndPoints(Curve=geometry)  # -> Start, End
closed_2 = Closed(Curve=join_curves)  # -> Closed, Periodic
line_2 = Line(StartPoint=end_points_2.Start, EndPoint=end_points_2.End)
closed_3 = Closed(Curve=merge)  # -> Closed, Periodic
dispatch_2 = Dispatch(List=join_curves, DispatchPattern=closed_2.Closed)  # -> ListA, ListB
overhang = Slider(-1, range=-1..1)
dispatch_3 = Dispatch(List=merge, DispatchPattern=closed_3.Closed)  # -> ListA, ListB
region_union = RegionUnion(Curves=flatten([dispatch.ListA, dispatch_2.ListA]))
addition = Addition(A=negative, B=overhang)
cluster = Cluster(geometry=dispatch_3.ListB)
offset_curve_3 = OffsetCurve(Curve=region_union, Distance=division, Plane=PlaneXY(0, 0, 0), Corners=1)
offset_curve_4 = OffsetCurve(Curve=region_union, Distance=addition, Plane=PlaneXY(0, 0, 0), Corners=1)
height = Slider(10, range=0..10)
geometry_2 = Geometry(cluster)
number_slider = Slider(-2.91, range=-10..10)
merge_2 = Merge(Data1=dispatch_3.ListA, Data2=geometry_2)
unit_z = UnitZ(Factor=height)
extrude = Extrude(Base=line_2, Direction=unit_z)
move = Move(Geometry=offset_curve_4, Motion=unit_z)  # -> Geometry, Transform
boundary_surfaces = BoundarySurfaces(Edges=move.Geometry)
negative_2 = Negative(Value=number_slider)
unit_z_2 = UnitZ(Factor=negative_2)
extrude_2 = Extrude(Base=move.Geometry, Direction=unit_z_2)
extrude_3 = Extrude(Base=merge_2, Direction=unit_z)
offset_surface = OffsetSurface(Surface=boundary_surfaces, Distance=number_slider, Retrim=True)
boundary_surfaces_2 = BoundarySurfaces(Edges=offset_curve_3)
merge_3 = Merge(Data1=extrude_2, Data2=offset_surface, Data3=boundary_surfaces)

# ==== cluster Cluster
geometry = ClusterInput()
geometry_2 = Geometry(geometry)
end_points = EndPoints(Curve=geometry_2)  # -> Start, End
polyline = PolyLine(Vertices=end_points.Start, Closed=False)
polyline_2 = PolyLine(Vertices=end_points.End, Closed=False)
merge = Merge(Data1=geometry_2, Data2=polyline, Data3=polyline_2)
join_curves = JoinCurves(Curves=merge, Preserve=False)
curves = ClusterOutput(join_curves)
