# Grasshopper definition 200522_Gabriel Kozlowski Gringo Cardia.gh (Grasshopper 1.0.7)
# plug-ins: Bifocals

general_size = Slider(100, range=0..100)
general_height = Slider(14, range=0..100)
pipe_density = Slider(0.1, range=0..1)
rectangle = Rectangle(Plane=PlaneXY(0, 0, 0), XSize=general_size, YSize=general_size, Radius=0)  # -> Rectangle, Length
unit_z = UnitZ(Factor=general_height)
move = Move(Geometry=rectangle.Rectangle, Motion=unit_z)  # -> Geometry, Transform
point = Point([Point(78.32813722, 21.23648433, -7.507790494), Point(16.95115669, 18.43457723, 0), Point(15.02657126, 65.92351893, -13.46294187), Point(47.15887173, 62.9553023, -13.35316763), Point(76.39238895, 88.9332611, 0)])
patch = Patch(Curves=move.Geometry, Points=point, Spans=Slider(8, range=0..10), Flexibility=Slider(100000, range=0..100000), Trim=True)
desntiy = Slider(101, range=0..1000)
populate_2d = Populate2D(Region=move.Geometry, Count=desntiy, Seed=1)
surface_closest_point = SurfaceClosestPoint(Point=populate_2d, Surface=patch)  # -> Point, UVPoint, Distance
randmoness_factor = Slider(0.59, range=0..1)
height_top = Slider(10, range=0..10)
iso_curve = IsoCurve(Surface=patch, UVPoint=surface_closest_point.UVPoint)  # -> UIsocurve, VIsocurve
end_points = EndPoints(Curve=iso_curve.UIsocurve)  # -> Start, End
end_points_2 = EndPoints(Curve=iso_curve.VIsocurve)  # -> Start, End
cluster = Cluster_2(geometry_2=end_points.End, jitter=randmoness_factor, geometry=move.Geometry, index="3", factor=height_top)
cluster_2 = Cluster(geometry_2=end_points_2.Start, jitter=randmoness_factor, geometry=move.Geometry, index="0", factor=height_top)
cluster_3 = Cluster_2(geometry_2=end_points_2.End, jitter=randmoness_factor, geometry=move.Geometry, index="2", factor=height_top)
cluster_4 = Cluster_2(geometry_2=end_points.Start, jitter=randmoness_factor, geometry=move.Geometry, index="1", factor=height_top)
merge = Merge(Data1=cluster, Data2=cluster_3, Data3=cluster_4, Data4=cluster_2, Data5=iso_curve.VIsocurve, Data6=iso_curve.UIsocurve)  # -> flatten(Result)
data_dam = DataDam(DataA=merge, BufferDelay=10000000, BufferMode=0)
pipe = Pipe(Curve=data_dam, Radius=pipe_density, Caps=0)

# ==== cluster Cluster
geometry = ClusterInput()
factor = ClusterInput()
index = ClusterInput()
jitter = ClusterInput()
geometry_2 = ClusterInput()
unit_z = UnitZ(Factor=factor)
move = Move(Geometry=geometry, Motion=unit_z)  # -> Geometry, Transform
geometry_3 = Geometry(geometry_2)
explode = Explode(Curve=move.Geometry, Recursive=True)  # -> Segments, Vertices
jitter_2 = Jitter(List=flatten(geometry_3), Jitter=jitter, Seed=2)  # -> Values, Indices
list_item = ListItem(List=explode.Segments, Index=index, Wrap=True)
curve_closest_point = CurveClosestPoint(Point=flatten(geometry_3), Curve=list_item)  # -> Point, Parameter, Distance
line = Line(StartPoint=jitter_2.Values, EndPoint=curve_closest_point.Point)
line_2 = ClusterOutput(line)

# ==== cluster Cluster_2
factor = ClusterInput()
unit_z = UnitZ(Factor=factor)
geometry = ClusterInput()
move = Move(Geometry=geometry, Motion=unit_z)  # -> Geometry, Transform
geometry_2 = ClusterInput()
geometry_3 = Geometry(geometry_2)
explode = Explode(Curve=move.Geometry, Recursive=True)  # -> Segments, Vertices
jitter = ClusterInput()
jitter_2 = Jitter(List=flatten(geometry_3), Jitter=jitter, Seed=2)  # -> Values, Indices
index = ClusterInput()
list_item = ListItem(List=explode.Segments, Index=index, Wrap=True)
curve_closest_point = CurveClosestPoint(Point=flatten(geometry_3), Curve=list_item)  # -> Point, Parameter, Distance
line = Line(StartPoint=jitter_2.Values, EndPoint=curve_closest_point.Point)
line_2 = ClusterOutput(line)
