# Grasshopper definition 200603_HODL_logo.gh (Grasshopper 1.0.7)
# plug-ins: Bifocals

geometry = Geometry(<curve referenced from the Rhino model>)
geometry_2 = Geometry(<curve referenced from the Rhino model>)
bounding_box = BoundingBox(Content=geometry_2, Plane=PlaneXY(0, 0, 0))  # -> Box, Box_2
panel = Panel("""0
1""")
deconstruct_brep = DeconstructBrep(Brep=bounding_box.Box)  # -> Faces, Edges, Vertices
panel_2 = Panel("""3
2""")
list_item = ListItem(List=deconstruct_brep.Vertices, Index=panel, Wrap=True)
list_item_2 = ListItem(List=deconstruct_brep.Vertices, Index=panel_2, Wrap=True)
polyline = PolyLine(Vertices=list_item_2, Closed=False)
polyline_2 = PolyLine(Vertices=list_item, Closed=False)
amount_of_lines = Slider(84, range=0..100)
divide_curve = DivideCurve(Curve=polyline, Count=amount_of_lines, Kinks=False)  # -> Points, Tangents, Parameters
divide_curve_2 = DivideCurve(Curve=polyline_2, Count=amount_of_lines, Kinks=False)  # -> Points, Tangents, Parameters
line = Line(StartPoint=divide_curve.Points, EndPoint=divide_curve_2.Points)
curve_curve = CurveCurve(CurveA=line, CurveB=geometry_2)  # -> Points, ParamsA, ParamsB
shatter = Shatter(Curve=graft(line), Parameters=curve_curve.ParamsA)
dispatch = Dispatch(List=shatter, DispatchPattern=[True, False])  # -> ListA, ListB
geometry_3 = Geometry(dispatch.ListB)
number_slider = Slider(0.056, range=0..0.1)
end_points = EndPoints(Curve=geometry_3)  # -> Start, End
dispatch_2 = Dispatch(List=curve_curve.ParamsA, DispatchPattern=[True, False])  # -> ListA, ListB
deconstruct = Deconstruct(Point=end_points.End)  # -> XComponent, YComponent, ZComponent
deconstruct_2 = Deconstruct(Point=end_points.Start)  # -> XComponent, YComponent, ZComponent
series = Series(Start=0, Step=1, Count=amount_of_lines)
subtraction = Subtraction(A=dispatch_2.ListB, B=number_slider)
addition = Addition(A=number_slider, B=dispatch_2.ListA)
jitter = Jitter(List=series, Jitter=Slider(1, range=0..1), Seed=2)  # -> Values, Indices
construct_domain = ConstructDomain(DomainStart=addition, DomainEnd=subtraction)
subtraction_2 = Subtraction()
bounds = Bounds(Numbers=jitter.Values)
panel_3 = Panel(construct_domain)
remap_numbers = RemapNumbers(Source=Domain(0, 1), Target=Domain(0, 1))  # -> Mapped, Clipped
remap_numbers_2 = RemapNumbers(Value=graft(jitter.Values), Source=bounds, Target=construct_domain)  # -> Mapped, Clipped
evaluate_curve = EvaluateCurve(Curve=geometry_3, Parameter=remap_numbers_2.Mapped)  # -> flatten(Point), Tangent, Angle
evaluate_curve_2 = EvaluateCurve(Curve=geometry_3, Parameter=remap_numbers_2.Mapped)  # -> flatten(Point), Tangent, Angle
panel_4 = Panel("""0
-1""")
cull_index = CullIndex(List=flatten(geometry_3), Indices=panel_4, Wrap=True)
cull_index_2 = CullIndex(List=evaluate_curve.Point, Indices=panel_4, Wrap=True)
deconstruct_3 = Deconstruct(Point=cull_index_2)  # -> XComponent, YComponent, ZComponent
number_slider_2 = Slider(0.48, range=0..1)
shift_list = ShiftList(List=deconstruct_3.YComponent, Shift=1, Wrap=True)
negative = Negative(Value=number_slider_2)
subtraction_3 = Subtraction(A=shift_list, B=deconstruct_3.YComponent)
construct_domain_2 = ConstructDomain(DomainStart=number_slider_2, DomainEnd=negative)
smaller_than = SmallerThan(FirstNumber=subtraction_3, SecondNumber="0")  # -> SmallerThan, OrEqualTo
rectangle = Rectangle(Plane=cull_index_2, XSize=construct_domain_2, YSize=subtraction_3, Radius=0)  # -> Rectangle, Length
dispatch_3 = Dispatch(List=rectangle.Rectangle, DispatchPattern=smaller_than.SmallerThan)  # -> ListA, ListB
colour_picker = ColourPicker(PickedColour=RGB(255, 15, 15))
colour_picker_2 = ColourPicker(PickedColour=RGB(15, 255, 51))
geometry_4 = Geometry(dispatch_3.ListB)
custom_preview = CustomPreview(Geometry=dispatch_3.ListA, Material=colour_picker)
custom_preview_2 = CustomPreview(Geometry=dispatch_3.ListB, Material=colour_picker_2)
join_curves = JoinCurves(Curves=dispatch_3.ListA, Preserve=False)
join_curves_2 = JoinCurves(Curves=dispatch_3.ListB, Preserve=False)
geometry_5 = Geometry(dispatch.ListB)
