# Grasshopper definition 200607_FlowAlongSurface.gh (Grasshopper 1.0.7)

height = Slider(10.53, range=0..20)
amount_y = Slider(28, range=0..100)
amount_x = Slider(32, range=0..100)
input_surface = Geometry(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)

# ---- group: Input Geometry
geometry = Geometry([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])

# ----
mesh_brep = MeshBrep(
    Brep=geometry,
    Settings={GridMaxCount=0, GridMinCount=16, JaggedSeams=False, MaxEdgeLength=0, MinEdgeLength=0.0001, MinTolerance=0, Refine=True, RefineAngle=0, RelativeTolerance=0.65, SimplePlanes=True, Tolerance=0})
bounding_box = BoundingBox(Content=geometry, Plane=PlaneXY(0, 0, 0), UnionBox=True)  # -> Box, Box_2
mesh_join = MeshJoin(Meshes=mesh_brep)

# ---- group: option 2
deconstruct_box = DeconstructBox(Box=bounding_box.Box)  # -> Plane, X, Y, Z
deconstruct_domain = DeconstructDomain(Domain=deconstruct_box.X)  # -> Start, End
deconstruct_domain_2 = DeconstructDomain(Domain=deconstruct_box.Y)  # -> Start, End
absolute = Absolute(Value=deconstruct_domain.Start)
absolute_2 = Absolute(Value=deconstruct_domain.End)
absolute_3 = Absolute(Value=deconstruct_domain_2.Start)
absolute_4 = Absolute(Value=deconstruct_domain_2.End)
addition = Addition(A=absolute, B=absolute_2)
addition_2 = Addition(A=absolute_3, B=absolute_4)
series = Series(Start=0, Step=addition, Count=amount_y)
series_2 = Series(Start=0, Step=addition_2, Count=amount_x)
vector_xyz = VectorXYZ(XComponent=series, YComponent=graft(series_2), ZComponent=0)  # -> Vector, Length
move = Move(Geometry=mesh_join, Motion=vector_xyz.Vector)  # -> Geometry, Transform
number_slider = Slider(1, range=0..1)
bounding_box_2 = BoundingBox(Content=flatten(move.Geometry), Plane=PlaneXY(0, 0, 0), UnionBox=True)  # -> Box, Box_2
surface_morph = SurfaceMorph(
    Geometry=move.Geometry,
    Reference=bounding_box_2.Box,
    Surface=reparameterize(input_surface),
    UDomain=number_slider,
    VDomain=number_slider,
    WDomain=height)

# ---- group: Option 1
range = Range(Domain=Domain(0, 1), Steps=amount_y)
range_2 = Range(Domain=Domain(0, 1), Steps=amount_x)
shift_list = ShiftList(List=range, Shift=1, Wrap=False)
cull_index = CullIndex(List=range, Indices="0", Wrap=True)
shift_list_2 = ShiftList(List=range_2, Shift=1, Wrap=False)
construct_domain = ConstructDomain(DomainStart=range, DomainEnd=shift_list)
construct_domain_2 = ConstructDomain(DomainStart=range_2, DomainEnd=shift_list_2)

# ----
surface_morph_2 = SurfaceMorph(
    Geometry=mesh_join,
    Reference=bounding_box.Box,
    Surface=reparameterize(input_surface),
    UDomain=construct_domain,
    VDomain=graft(construct_domain_2),
    WDomain=height)
colour_picker = ColourPicker(PickedColour=RGB(255, 255, 255))
custom_preview = CustomPreview(Geometry=flatten(surface_morph), Material=colour_picker)
