# Grasshopper definition 200617_Statoil Regional and International Offices_a lab.gh (Grasshopper 1.0.7)

# ---- group: initial inputs
geometry = Geometry(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)
geometry_2 = Geometry(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)
geometry_3 = Geometry(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)
geometry_4 = Geometry(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)

# ----
amount_of_blocks = Slider(17, range=0..100)
randomnnes = Slider(24, range=0..100)
populate_2d = Populate2D(Region=[geometry_2, geometry_3], Count=amount_of_blocks, Seed=randomnnes)
populate_2d_2 = Populate2D(Region=[geometry_4, geometry], Count=amount_of_blocks, Seed=randomnnes)
flip_matrix = FlipMatrix(Data=populate_2d)
flip_matrix_2 = FlipMatrix(Data=populate_2d_2)
partition_size = Slider(2, range=0..10)
polyline = PolyLine(Vertices=flip_matrix, Closed=False)  # -> flatten(Polyline)
polyline_2 = PolyLine(Vertices=flip_matrix_2, Closed=False)  # -> flatten(Polyline)
height_of_each = Slider(9.642, range=0..10)
partition_list = PartitionList(List=polyline, Size=partition_size)
division = Division(A=amount_of_blocks, B=partition_size)
partition_list_2 = PartitionList(List=polyline_2, Size=partition_size)
expression = Expression(x=height_of_each, Expression="0-(x/2)")
series = Series(Start=0, Step=height_of_each, Count=division)
series_2 = Series(Start=expression, Step=height_of_each, Count=division)
width = Slider(6.53, range=0..10)
cluster = Cluster(geometry=partition_list, distance=width, factor=series)
cluster_2 = Cluster(geometry=partition_list_2, distance=width, factor=series_2)
unit_z = UnitZ(Factor=expression)
cluster_3 = Cluster_2(geometry=cluster)
cluster_4 = Cluster_2(geometry=cluster_2)
boundary_surfaces = BoundarySurfaces(Edges=cluster_3)
boundary_surfaces_2 = BoundarySurfaces(Edges=cluster_4)
extrude = Extrude(Base=cluster_3, Direction=unit_z)
extrude_2 = Extrude(Base=cluster_4, Direction=unit_z)
move = Move(Geometry=boundary_surfaces_2, Motion=unit_z)  # -> Geometry, Transform
move_2 = Move(Geometry=boundary_surfaces, Motion=unit_z)  # -> Geometry, Transform

# ==== cluster Cluster
factor = ClusterInput()
unit_z = UnitZ(Factor=factor)
geometry = ClusterInput()
move = Move(Geometry=geometry, Motion=graft(unit_z))  # -> Geometry, Transform
distance = ClusterInput()
offset_curve_loose = OffsetCurveLoose(Curve=move.Geometry, Distance=distance)
end_points = EndPoints(Curve=offset_curve_loose)  # -> Start, End
end_points_2 = EndPoints(Curve=move.Geometry)  # -> Start, End
line = Line(StartPoint=end_points_2.Start, EndPoint=end_points.Start)
line_2 = Line(StartPoint=end_points_2.End, EndPoint=end_points.End)
join_curves = JoinCurves(Curves=[line, line_2, offset_curve_loose, move.Geometry], Preserve=False)
curves = ClusterOutput(join_curves)

# ==== cluster Cluster_2
geometry = ClusterInput()
geometry_2 = Geometry(geometry)
multiple_curves = MultipleCurves(Curves=geometry_2)  # -> Points, IndexA, IndexB, ParamA, ParamB
list_length = ListLength(List=multiple_curves.IndexA)
larger_than = LargerThan(FirstNumber=list_length, SecondNumber="0")  # -> LargerThan, OrEqualTo
panel = Panel(list_length)
merge = Merge(Data1=larger_than.LargerThan, Data2=larger_than.LargerThan)
dispatch = Dispatch(List=geometry_2, DispatchPattern=merge)  # -> ListA, ListB
panel_2 = Panel(merge)
dispatch_2 = Dispatch(List=dispatch.ListA, DispatchPattern=[True, False])  # -> ListA, ListB
geometry_3 = Geometry(dispatch.ListB)
geometry_4 = Geometry(dispatch_2.ListA)
merge_2 = Merge(Data1=geometry_4, Data2=geometry_3)
result = ClusterOutput(merge_2)
