# Grasshopper definition 200629_UmbrellaSimple.gh (Grasshopper 1.0.7)

basic_size = Slider(100, range=0..100)
amount_of_wires = Slider(12, range=0..100)
size_umbrella = Slider(100, range=0..100)
curveness = Slider(0.85, range=0..1)
opennenss = Slider(91, range=-90..100)
length_steel_support = Slider(56, range=0..100)
flatness = Slider(-1, range=-1..1)

construct_point = ConstructPoint(XCoordinate=0, YCoordinate=0, ZCoordinate=basic_size)
xz_plane = XZPlane(Origin=construct_point)
construct_point_2 = ConstructPoint(XCoordinate=0, YCoordinate=0, ZCoordinate=0)
polar_array = PolarArray(Geometry=xz_plane, Plane=PlaneXY(0, 0, 0), Count=amount_of_wires, Angle=6.283185307)  # -> Geometry, Transform
line = Line(StartPoint=construct_point, EndPoint=construct_point_2)
deconstruct_plane = DeconstructPlane(Plane=polar_array.Geometry)  # -> Origin, XAxis, YAxis, ZAxis
line_sdl = LineSDL(Start=polar_array.Geometry, Direction=deconstruct_plane.XAxis, Length=size_umbrella)
evaluate_curve = EvaluateCurve(Curve=line_sdl, Parameter=curveness)  # -> Point, Tangent, Angle
vector_2pt = Vector2Pt(PointA=polar_array.Geometry, PointB=evaluate_curve.Point, Unitize=False)  # -> Vector, Length
shatter = Shatter(Curve=line_sdl, Parameters=curveness)
list_item = ListItem(List=shatter, Index=Slider(1, range=0..1), Wrap=True)
panel = Panel("-90")
subtraction = Subtraction(A=opennenss, B="90")
division = Division(A=opennenss, B="90")
multiplication = Multiplication(A=flatness, B=division)
list_item_2 = ListItem(List=shatter, Index=Slider(0, range=0..1), Wrap=True)
move = Move(Geometry=polar_array.Geometry, Motion=vector_2pt.Vector)  # -> Geometry, Transform
rotate = Rotate(Geometry=list_item, Angle=multiplication, Plane=graft(move.Geometry))  # -> Geometry, Transform
join_curves = JoinCurves(Curves=[rotate.Geometry, list_item_2], Preserve=False)
explode = Explode(Curve=join_curves, Recursive=True)  # -> Segments, Vertices
list_item_3 = ListItem(List=explode.Vertices, Index=0, Wrap=True)
list_item_4 = ListItem(List=explode.Vertices, Index=2, Wrap=True)
list_item_5 = ListItem(List=explode.Vertices, Index=1, Wrap=True)
arc_3pt = Arc3Pt(PointA=list_item_3, PointB=list_item_5, PointC=list_item_4)  # -> Arc, Plane, Radius
rotate_2 = Rotate(Geometry=arc_3pt.Arc, Angle=degrees(subtraction), Plane=graft(polar_array.Geometry))  # -> Geometry, Transform
loft_options = LoftOptions(Closed=True, Adjust=False, Rebuild=0, Refit=0, Type=0)
divide_curve = DivideCurve(Curve=line, Count="1000", Kinks=False)  # -> Points, Tangents, Parameters
point_on_curve = PointOnCurve(rotate_2.Geometry, parameter=0.5)
loft = Loft(Curves=flatten(rotate_2.Geometry), Options=loft_options)
distance = Distance(PointA=divide_curve.Points, PointB=point_on_curve)
larger_than = LargerThan(FirstNumber=distance, SecondNumber=length_steel_support)  # -> LargerThan, OrEqualTo
dispatch = Dispatch(List=divide_curve.Points, DispatchPattern=larger_than.LargerThan)  # -> ListA, ListB
geometry = Geometry(dispatch.ListB)
list_item_6 = ListItem(List=reverse(geometry), Index=0, Wrap=True)
line_2 = Line(StartPoint=list_item_6, EndPoint=point_on_curve)
pipe_size_02 = Slider(0.16, range=0..1)
pipe_size_01 = Slider(0.16, range=0..1)
pipe_size_03 = Slider(0.78, range=0..1)
pipe = Pipe(Curve=line_2, Radius=pipe_size_02, Caps=0)
pipe_2 = Pipe(Curve=line, Radius=pipe_size_03, Caps=0)
pipe_3 = Pipe(Curve=rotate_2.Geometry, Radius=pipe_size_01, Caps=0)
panel_2 = Panel(larger_than.LargerThan)
