# Grasshopper definition 200710_King Power MahaNakhon.gh (Grasshopper 1.0.7)
# plug-ins: Bifocals

xysize_base = Slider(10, range=0..10)
angle = Slider(9.68, range=0..10)
number_slider = Slider(71, range=0..1000)
heigh_in_between_spiral = Slider(1.22, range=0..10)
which_ones_to_remove = Slider(15.81, range=0..100)
division = Slider(8, range=0..100)
point = Point(Point(16.94785208, 17.40842006, 0))
rectangle = Rectangle(Plane=point, XSize=xysize_base, YSize=xysize_base, Radius=0)  # -> Rectangle, Length
unit_x = UnitX(Factor=Slider(11.4, range=0..100))
area = Area(Geometry=rectangle.Rectangle)  # -> Area, Centroid
divide_surface = DivideSurface(Surface=rectangle.Rectangle, UCount=division, VCount=division)  # -> Points, Normals, Parameters
move = Move(Geometry=area.Centroid, Motion=unit_x)  # -> Geometry, Transform
division_2 = Division(A=xysize_base, B=division)
series = Series(Start=0, Step=angle, Count=number_slider)
series_2 = Series(Start=0, Step=heigh_in_between_spiral, Count=number_slider)
rotate = Rotate(Geometry=move.Geometry, Angle=degrees(series), Plane=area.Centroid)  # -> Geometry, Transform
rectangle_2 = Rectangle(Plane=divide_surface.Points, XSize=division_2, YSize=division_2, Radius=0)  # -> Rectangle, Length
unit_z = UnitZ(Factor=series_2)
multiplication = Multiplication(A=number_slider, B=heigh_in_between_spiral)
move_2 = Move(Geometry=rotate.Geometry, Motion=unit_z)  # -> Geometry, Transform
division_3 = Division(A=multiplication, B=division_2)
box_rectangle = BoxRectangle(Rectangle=rectangle_2.Rectangle, Height=division_2)
series_3 = Series(Start=0, Step=division_2, Count=division_3)
unit_z_2 = UnitZ(Factor=series_3)
move_3 = Move(Geometry=graft(box_rectangle), Motion=unit_z_2)  # -> Geometry, Transform
nurbs_curve = NurbsCurve(Vertices=move_2.Geometry, Degree=3, Periodic=False)  # -> Curve, Length, Domain
move_4 = Move(Geometry=graft(divide_surface.Points), Motion=unit_z_2)  # -> Geometry, Transform
curve_closest_point = CurveClosestPoint(Point=move_4.Geometry, Curve=nurbs_curve.Curve)  # -> Point, Parameter, Distance
larger_than = LargerThan(FirstNumber=curve_closest_point.Distance, SecondNumber=which_ones_to_remove)  # -> LargerThan, OrEqualTo
dispatch = Dispatch(List=move_3.Geometry, DispatchPattern=larger_than.LargerThan)  # -> ListA, ListB
panel = Panel(larger_than.LargerThan)
geometry = Geometry(dispatch.ListA)
geometry_2 = Geometry(dispatch.ListB)
panel_2 = Panel("gray")
panel_3 = Panel("blue")
colour_picker = ColourPicker(PickedColour=RGB(94, 154, 204))
custom_preview = CustomPreview(Geometry=geometry_2, Material=colour_picker)
