# Grasshopper definition 200723_Membrane Grasshopper.gh (Grasshopper 1.0.7)
# plug-ins: Kangaroo2 Components

strings = Slider(0.91, range=0..10)
load = Slider(0.06, range=-1..1)
structure = Slider(0.1, range=0..1)
geometry = Geometry(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)
fragility = Slider(1, range=0..10)
geometry_2 = Geometry(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)
surface_split = SurfaceSplit(Surface=geometry, Curves=geometry_2)
settings_custom = SettingsCustom(
    StitchSeams=True,
    SimplePlanes=False,
    Refine=True,
    MinCount=16,
    MaxCount=400,
    AspectRatio=20,
    MaxDistance=0,
    MaxAngle=20,
    MinEdge=Slider(0.693, range=0..10),
    MaxEdge=Slider(2.5, range=0..10))
geometry_3 = Geometry(<curve referenced from the Rhino model>)
list_item = ListItem(List=surface_split, Index=Slider(1, range=0..1), Wrap=True)
length = Length(Curve=geometry_3)
mesh_brep = MeshBrep(Brep=list_item, Settings=settings_custom)
refine = Refine(Mesh=mesh_brep, Level=fragility)
unit_z = UnitZ(Factor=length)
move = Move(Geometry=refine, Motion=unit_z)  # -> Geometry, Transform
mesh_edges = MeshEdges(Mesh=move.Geometry)  # -> NakedEdges, InteriorEdges, NonManifoldEdges
panel = Panel("""1
9
16""")
geometry_4 = Geometry([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])
point = Point([Point(-214.6408346, -55.34508944, 5.1), Point(-203.9127237, -30.03364066, 24.79901377), Point(-166.6395678, -61.96408839, 5.1)])
list_item_2 = ListItem(List=panel, Index=Slider(1, range=0..10), Wrap=True)
bounding_box = BoundingBox(Content=geometry_4, Plane=PlaneXY(0, 0, 0))  # -> Box, Box_2
deconstruct_mesh = DeconstructMesh(Mesh=move.Geometry)  # -> Vertices, Faces, Colours, Normals
geometry_5 = Geometry(mesh_edges.NakedEdges)
closest_point = ClosestPoint(Point=point, Cloud=deconstruct_mesh.Vertices)  # -> ClosestPoint, CPIndex, Distance
closest_points = ClosestPoints(Point=point, Cloud=deconstruct_mesh.Vertices, Count=list_item_2)  # -> ClosestPoint, CPIndex, Distance
negative = Negative(Value=closest_points.Distance)
deconstruct_brep = DeconstructBrep(Brep=bounding_box.Box)  # -> Faces, Edges, Vertices
end_points = EndPoints(Curve=geometry_5)  # -> Start, End
edgelengths = EdgeLengths(Mesh=move.Geometry, LengthFactor=strings, Strength=1)
unit_z_2 = UnitZ(Factor=negative)
list_item_3 = ListItem(List=deconstruct_brep.Faces, Index=Slider(5, range=0..10), Wrap=True)
list_item_4 = ListItem(List=deconstruct_brep.Faces, Index=Slider(4, range=0..10), Wrap=True)
merge = Merge(Data1=end_points.Start, Data2=end_points.End)
load_2 = Load(Point=deconstruct_mesh.Vertices, ForceVector=Vector(0, 0, 1), Weighting=load)
show = Show(G=move.Geometry)
move_2 = Move(Geometry=closest_points.ClosestPoint, Motion=unit_z_2)  # -> Geometry, Transform
area = Area(Geometry=list_item_4)  # -> Area, Centroid
anchor = Anchor(Point=closest_points.ClosestPoint, Target=move_2.Geometry, Strength=10000)
area_2 = Area(Geometry=list_item_3)  # -> Area, Centroid
anchor_2 = Anchor(Point=merge, Strength=10000)
distance = Distance(PointA=area_2.Centroid, PointB=area.Centroid)
closest_points_2 = ClosestPoints(Point=area_2.Centroid, Cloud=deconstruct_mesh.Vertices, Count=list_item_2)  # -> ClosestPoint, CPIndex, Distance
unit_z_3 = UnitZ(Factor=distance)
move_3 = Move(Geometry=closest_points_2.ClosestPoint, Motion=unit_z_3)  # -> Geometry, Transform
anchor_3 = Anchor(Point=closest_points_2.ClosestPoint, Target=move_3.Geometry, Strength=10000)
solver = Solver(
    GoalObjects=flatten([load_2, show, anchor_2, edgelengths, anchor, anchor_3]),
    Reset=Button(),
    Threshold=1e-15,
    Tolerance=0.01,
    On=Toggle(True))  # -> I, V, O
mesh = Mesh(solver.O)
mesh_edges_2 = MeshEdges(Mesh=mesh)  # -> NakedEdges, InteriorEdges, NonManifoldEdges
pipe = Pipe(Curve=mesh_edges_2.InteriorEdges, Radius=structure, Caps=0)
