# Grasshopper definition 200730_RockPanelScript.gh (Grasshopper 1.0.7)
# plug-ins: Human

# ---- group: Input Curve
line = Line(Line((7.511710882, 13.88572822, 0), (30.17486931, 22.60680359, 0)))

# ----
i_want_to_have_a_tiny_tiny_offset = BooleanToggle(False)
tiny_tny_offset_surfaces = Slider(-0.014, range=-0.1..0.1)
bake_me_senpai = Button()
defining_the_outer_panels_distance = Panel("0.05 to 0.95")
panel = Panel("""0
-1""")

az = Slider(7.11, range=0..10)
bz = Slider(10, range=0..10)
amount_of_panels = Slider(23, range=0..100)
divisions = Slider(19, range=0..100)
randomness_seeed = Slider(95, range=0..100)
randomness_amount = Slider(0.65, range=0..1)
how_many_different_colors_do_you_want = Slider(3, range=0..10)
color_randomnes_factor = Slider(0.28, range=0..1)

end_points = EndPoints(Curve=line)  # -> Start, End
unit_z = UnitZ(Factor=bz)
unit_z_2 = UnitZ(Factor=az)
move = Move(Geometry=end_points.End, Motion=unit_z)  # -> Geometry, Transform
move_2 = Move(Geometry=end_points.Start, Motion=unit_z_2)  # -> Geometry, Transform
line_2 = Line(StartPoint=move_2.Geometry, EndPoint=move.Geometry)

duplicate_data = DuplicateData(Data=randomness_amount, Number=amount_of_panels, Order=True)
insert_items = InsertItems(List=duplicate_data, Item="1", Indices=panel, Wrap=True)
range = Range(Domain=Domain(0, 1), Steps=expr("x-1", how_many_different_colors_do_you_want))

gradient = Gradient(
    LowerLimit=0,
    UpperLimit=1,
    Parameter=range,
    stops=[0: RGB(0, 98, 0), 0.25: RGB(81, 175, 17), 0.5: RGB(159, 198, 146), 0.75: RGB(170, 235, 41), 0.967: RGB(221, 255, 53)])

range_2 = Range(Domain=Domain(0, 1), Steps=how_many_different_colors_do_you_want)

# ---- group: Distribution of colors
graph_mapper = GraphMapper(range_2, x0=0, x1=1, y0=0, y1=1, Cx=0.4222854376, Cy=0.6430602074, container_name="Conic")

# ----
create_modify_materials = CreateModifyMaterials(Name=gradient, Diffuse=gradient)
createattributes = CreateAttributes(MaterialName=create_modify_materials, enableFullPath=False)

# ---- group: setting up curves so they are either random or defined
divide_curve = DivideCurve(Curve=line_2, Count=divisions, Kinks=False)  # -> Points, Tangents, Parameters
divide_curve_2 = DivideCurve(Curve=line, Count=divisions, Kinks=False)  # -> Points, Tangents, Parameters
series = Series(Start=0, Step=randomness_seeed, Count=divisions)
random = Random(Range=defining_the_outer_panels_distance, Number=amount_of_panels, Seed=series)
range_3 = Range(Domain="1", Steps=expr("x-1", amount_of_panels))

# ----
line_3 = Line(StartPoint=divide_curve.Points, EndPoint=divide_curve_2.Points)

# ---- group: setting up curves so they are either random or defined (continued)
evaluate_curve = EvaluateCurve(Curve=graft(line_3), Parameter=random)  # -> Point, Tangent, Angle
evaluate_curve_2 = EvaluateCurve(Curve=graft(line_3), Parameter=range_3)  # -> Point, Tangent, Angle
sort_points = SortPoints(Points=evaluate_curve.Point)  # -> Points, Indices
sort_points_2 = SortPoints(Points=evaluate_curve_2.Point)  # -> Points, Indices

# ----
vector_2pt = Vector2Pt(PointA=sort_points.Points, PointB=sort_points_2.Points, Unitize=False)  # -> Vector, Length
multiplication = Multiplication(A=vector_2pt.Length, B=insert_items)
amplitude = Amplitude(Vector=vector_2pt.Vector, Amplitude=multiplication)
move_3 = Move(Geometry=sort_points.Points, Motion=amplitude)  # -> Geometry, Transform
flip_matrix = FlipMatrix(Data=move_3.Geometry)

polyline = PolyLine(Vertices=flip_matrix, Closed=False)

explode = Explode(Curve=polyline, Recursive=True)  # -> Segments, Vertices
flip_matrix_2 = FlipMatrix(Data=explode.Segments)
shift_list = ShiftList(List=flip_matrix_2, Shift=1, Wrap=False)
ruled_surface = RuledSurface(CurveA=flip_matrix_2, CurveB=shift_list)  # -> flatten(Surface)
stream_gate = StreamGate(Stream=ruled_surface, Gate=i_want_to_have_a_tiny_tiny_offset)  # -> Target0, Target1
offset_curve_loose = OffsetCurveLoose(Curve=stream_gate.Target1, Distance=tiny_tny_offset_surfaces)
boundary_surfaces = BoundarySurfaces(Edges=offset_curve_loose)
stream_filter = StreamFilter(Gate=i_want_to_have_a_tiny_tiny_offset, Stream0=stream_gate.Target0, Stream1=boundary_surfaces)
list_length = ListLength(List=stream_filter)
multiplication_2 = Multiplication(A=graph_mapper, B=list_length)
jitter = Jitter(List=stream_filter, Jitter=color_randomnes_factor, Seed=2)  # -> Values, Indices
shift_list_2 = ShiftList(List=multiplication_2, Shift=1, Wrap=False)
construct_domain = ConstructDomain(DomainStart=multiplication_2, DomainEnd=shift_list_2)
round = Round(Number=construct_domain)  # -> Nearest, Floor, Ceiling
cull_index = CullIndex(List=construct_domain, Indices="-1", Wrap=True)
sub_list = SubList(List=jitter.Values, Domain=cull_index, Wrap=True)  # -> List, Index

# ---- group: is nicht so schlimm
mesh_brep = MeshBrep(
    Brep=sub_list.List,
    Settings={GridMaxCount=0, GridMinCount=16, JaggedSeams=False, MaxEdgeLength=0, MinEdgeLength=0.0001, MinTolerance=0, Refine=True, RefineAngle=0, RelativeTolerance=0.65, SimplePlanes=True, Tolerance=0})

# ----
custom_preview = CustomPreview(Geometry=mesh_brep, Material=graft(gradient))
bake_geometry = BakeGeometry(
    Bake=bake_me_senpai,
    Geometry=sub_list.List,
    Attributes=graft(createattributes),
    DeleteOldBakes=False,
    PreserveTrees=False)
