# Grasshopper definition 201009_Triangle Pattern.gh (Grasshopper 1.0.7)

extent_x = Slider(56, range=0..100)
amount_of_groups = Slider(6, range=0..10)
extent_y = Slider(20, range=0..100)
triangular = Triangular(Plane=PlaneXY(0, 0, 0), Size=Slider(1.2, range=0..10), ExtentX=extent_x, ExtentY=extent_y)  # -> flatten(Cells), Points
multiplication = Multiplication(A=extent_x, B=extent_y)
panel = Panel(multiplication)
construct_domain = ConstructDomain(DomainStart=Slider(0.69, range=0..10), DomainEnd=Slider(2, range=0..10))
range = Range(Domain=construct_domain, Steps=expr("x-1", panel))
unit_z = UnitZ(Factor=range)
jitter = Jitter(List=unit_z, Jitter=Slider(1, range=0..1), Seed=2)  # -> Values, Indices
boundary_surfaces = BoundarySurfaces(Edges=triangular.Cells)
move = Move(Geometry=boundary_surfaces, Motion=jitter.Values)  # -> Geometry, Transform
extrude = Extrude(Base=triangular.Cells, Direction=jitter.Values)
merge = Merge(Data1=move.Geometry, Data2=extrude, Data3=boundary_surfaces)
entwine = Entwine(Branch00=boundary_surfaces, Branch01=move.Geometry, Branch02=extrude, FlattenInputs=True)
flip_matrix = FlipMatrix(Data=entwine)
brep_join = BrepJoin(Breps=flip_matrix)  # -> flatten(Breps), Closed
jitter_2 = Jitter(List=brep_join.Breps, Jitter=Slider(0.86, range=0..1), Seed=2)  # -> Values, Indices
division = Division(A=multiplication, B=amount_of_groups)
partition_list = PartitionList(List=jitter_2.Values, Size=division)
group = Group(Objects=partition_list)
