# Grasshopper definition 201024_Stairs.gh (Grasshopper 1.0.7)
# plug-ins: Bifocals

distance_between_stairs = Slider(0.57, range=0..10)
stairs_amount = Slider(59, range=0..100)
point = Point(Point(0.3672075572, 1.847742732, 0))
column_radius = Slider(1, range=0..1)
series = Series(Start=0, Step=distance_between_stairs, Count=stairs_amount)
circle = Circle(Plane=point, Radius=column_radius)
unit_z = UnitZ(Factor=series)
multiplication = Multiplication(A=distance_between_stairs, B=stairs_amount)
move = Move(Geometry=point, Motion=unit_z)  # -> Geometry, Transform
expression = Expression(x=distance_between_stairs, y=stairs_amount, Expression="x * (y-1) ")
list_item = ListItem(List=series, Index="-1", Wrap=True)
unit_z_2 = UnitZ(Factor=list_item)
increment_stairs = Slider(0.68, range=0..1)
circle_2 = Circle(Plane=move.Geometry, Radius=1)
series_2 = Series(Start=0, Step=increment_stairs, Count=stairs_amount)
evaluate_curve = EvaluateCurve(Curve=circle_2, Parameter=series_2)  # -> Point, Tangent, Angle
negative = Negative(Value=column_radius)
line = Line(StartPoint=evaluate_curve.Point, EndPoint=move.Geometry)
amplitude = Amplitude(Vector=line, Amplitude=negative)
move_2 = Move(Geometry=move.Geometry, Motion=amplitude)  # -> Geometry, Transform
stair_size = Slider(2.39, range=0..10)
line_sdl = LineSDL(Start=move_2.Geometry, Direction=amplitude, Length=stair_size)
unit_z_3 = UnitZ(Factor=distance_between_stairs)
list_item_2 = ListItem(List=line_sdl, Index="0", Wrap=True)
list_item_3 = ListItem(List=line_sdl, Index="1", Wrap=True)
move_3 = Move(Geometry=line_sdl, Motion=unit_z_3)  # -> Geometry, Transform
angle = Angle(VectorA=list_item_2, VectorB=list_item_3)  # -> Angle, Reflex
ruled_surface = RuledSurface(CurveA=line_sdl, CurveB=move_3.Geometry)
shift_list = ShiftList(List=line_sdl, Shift=Slider(1, range=-1..1), Wrap=False)
ruled_surface_2 = RuledSurface(CurveA=move_3.Geometry, CurveB=shift_list)
number_slider = Slider(-1, range=-1..0)
end_points = EndPoints(Curve=move_3.Geometry)  # -> Start, End
move_4 = Move(Geometry=move_2.Geometry, Motion=line_sdl)  # -> Geometry, Transform
rotate = Rotate(Geometry=end_points.End, Angle=expr("x/2", angle.Angle), Plane=point)  # -> Geometry, Transform
shift_list_2 = ShiftList(Shift=1, Wrap=True)
slabthickness = Slider(-1.36, range=-5..10)
shift_list_3 = ShiftList(List=move_4.Geometry, Shift=1, Wrap=True)
arc_3pt = Arc3Pt(PointA=end_points.End, PointB=rotate.Geometry, PointC=shift_list_3)  # -> Arc, Plane, Radius
unit_z_4 = UnitZ(Factor=slabthickness)
move_5 = Move(Geometry=end_points.End, Motion=unit_z_4)  # -> Geometry, Transform
cull_index = CullIndex(List=arc_3pt.Arc, Indices="-1", Wrap=True)
interpolate = Interpolate(Vertices=move_5.Geometry, Degree=3, Periodic=False, KnotStyle=1)  # -> Curve, Length, Domain
curve_closest_point = CurveClosestPoint(Point=move_5.Geometry, Curve=interpolate.Curve)  # -> Point, Parameter, Distance
shatter = Shatter(Curve=interpolate.Curve, Parameters=curve_closest_point.Parameter)
line_2 = Line(StartPoint=end_points.End, EndPoint=shift_list_3)
ruled_surface_3 = RuledSurface(CurveA=line_2, CurveB=cull_index)
offset_curve_loose = OffsetCurveLoose(Curve=interpolate.Curve, Distance=expr("-x", stair_size), Plane=point)
cull_index_2 = CullIndex(List=ruled_surface_3, Indices="-1", Wrap=True)
cull_index_3 = CullIndex(List=ruled_surface_2, Indices=number_slider, Wrap=True)
cull_index_4 = CullIndex(List=ruled_surface, Indices=number_slider, Wrap=True)
ruled_surface_4 = RuledSurface(CurveA=interpolate.Curve, CurveB=offset_curve_loose)
ruled_surface_5 = RuledSurface(CurveA=shatter, CurveB=cull_index)
extrude = Extrude(Base=circle, Direction=unit_z_2)
merge = Merge(Data1=ruled_surface_4, Data2=ruled_surface_5, Data3=cull_index_2, Data4=cull_index_4, Data5=cull_index_3, Data6=extrude)
