# Grasshopper definition 201101_Script.gh (Grasshopper 1.0.7)

# ---- group: Represenation Tool
height_of_analysis_text = Slider(5.42, range=0..10)
textsize = Slider(10, range=0..10)
subdividers = Slider(4, range=0..10)
analysis_depth_map = Slider(65.5, range=0..100)

# ----
geometry = Geometry([<brep referenced from the Rhino model> x7])

# ---- group: Analysis Tool
size_of_analysis = Slider(2, range=0..10)
amount_of_rectangle_analysis = Slider(40, range=0..100)
analysis_precision = Slider(34, range=0..100)
radius_to_test = Slider(100, range=0..100)

# ----
construct_point = ConstructPoint(XCoordinate=0, YCoordinate=0, ZCoordinate=0)
square = Square(
    Plane=PlaneXY(0, 0, 0),
    Size=size_of_analysis,
    ExtentX=amount_of_rectangle_analysis,
    ExtentY=amount_of_rectangle_analysis)  # -> flatten(Cells), Points
area = Area(Geometry=square.Cells)  # -> Area, Centroid
multiplication = Multiplication(A=size_of_analysis, B=amount_of_rectangle_analysis)
addition = Addition(A=multiplication, B=height_of_analysis_text)
unit_x = UnitX(Factor=addition)
mesh_shadow = MeshShadow(Mesh=geometry, Light=Vector(0, 0, -1), Plane=PlaneXY(0, 0, 0))
move = Move(Geometry=construct_point, Motion=unit_x)  # -> Geometry, Transform
range = Range(Domain=multiplication, Steps=subdividers)
unit_y = UnitY(Factor=range)
isovist = IsoVist(Plane=area.Centroid, Count=analysis_precision, Radius=radius_to_test, Obstacles=flatten(mesh_shadow))  # -> Points, Distance, Index
unit_x_2 = UnitX(Factor=height_of_analysis_text)
mass_addition = MassAddition(Input=isovist.Distance)  # -> Result, PartialResults
move_2 = Move(Geometry=move.Geometry, Motion=unit_y)  # -> Geometry, Transform
range_2 = Range(Domain=Domain(0, 1), Steps=subdividers)
division = Division(A=mass_addition.Result, B=analysis_precision)
polyline = PolyLine(Vertices=isovist.Points, Closed=True)
move_3 = Move(Geometry=move_2.Geometry, Motion=unit_x_2)  # -> Geometry, Transform
percent = Slider(100, range=0..100)
rectangle = Rectangle(Plane=move_2.Geometry, XSize=height_of_analysis_text, YSize=height_of_analysis_text, Radius=0)  # -> Rectangle, Length
remap_numbers = RemapNumbers(Value=division, Source=radius_to_test, Target=Domain(0, 1))  # -> Mapped, Clipped
multiplication_2 = Multiplication(A=remap_numbers.Mapped, B=analysis_depth_map)
multiplication_3 = Multiplication(A=range_2, B=percent)
box_rectangle = BoxRectangle(Rectangle=square.Cells, Height=flatten(multiplication_2))
gradient = Gradient(
    LowerLimit=0,
    UpperLimit=1,
    Parameter=range_2,
    stops=[0: RGB(234, 38, 0), 0.25: RGB(234, 126, 0), 0.5: RGB(254, 244, 84), 0.75: RGB(173, 203, 249), 1: RGB(75, 107, 169)])
box_rectangle_2 = BoxRectangle(Rectangle=rectangle.Rectangle, Height=analysis_depth_map)
gradient_2 = Gradient(
    LowerLimit=0,
    UpperLimit=1,
    Parameter=remap_numbers.Mapped,
    stops=[0: RGB(234, 38, 0), 0.25: RGB(234, 126, 0), 0.5: RGB(254, 244, 84), 0.75: RGB(173, 203, 249), 1: RGB(75, 107, 169)])
concatenate = Concatenate(FragmentA=multiplication_3, FragmentB="%")
custom_preview = CustomPreview(Geometry=box_rectangle, Material=flatten(gradient_2))
text_tag_3d = TextTag3D(Location=move_3.Geometry, Text=concatenate, Size=textsize, Colour=gradient, Justification=7)
custom_preview_2 = CustomPreview(Geometry=box_rectangle_2, Material=gradient)
