# Grasshopper definition 201114_Galapagos.gh (Grasshopper 1.0.7)

obstacle_rectangle = Slider(72.3, range=0..100)

# ---- group: The magic / start point
point = Point(Point(36.25698941, 74.76581773, 0))

# ---- group: The magic / end point
point_2 = Point(Point(34.41332493, 2.419673241, 0))

# ----
obstacle_size = Slider(2.57, range=0..10)
rectangle = Rectangle(Plane=PlaneXY(0, 0, 0), XSize=obstacle_rectangle, YSize=obstacle_rectangle, Radius=0)  # -> Rectangle, Length
populate_2d = Populate2D(Region=rectangle.Rectangle, Count=100, Seed=1)
rectangle_2 = Rectangle(Plane=populate_2d, XSize=obstacle_size, YSize=obstacle_size, Radius=0)  # -> Rectangle, Length
box_rectangle = BoxRectangle(Rectangle=rectangle_2.Rectangle, Height=obstacle_size)
line = Line(StartPoint=point, EndPoint=point_2)
how_much_to_weigh_intersections_amount = Slider(0.28, range=0..1)

# ---- group: The magic
gene_pool = GenePool(Decimals=2, Maximum=50, Minimum=-50, Value=[-0.3, 9.9, -5.15, -0.43, 4.39, 5.85, 3.32, -1.94, -2.47, 2.11])
galapagos = Galapagos(fitness=number, gene=gene_pool)

# ----
list_length = ListLength(List=gene_pool)
divide_curve = DivideCurve(Curve=line, Count=expr("x+1", list_length), Kinks=False)  # -> Points, Tangents, Parameters
unit_x = UnitX(Factor=gene_pool)
cull_index = CullIndex(List=divide_curve.Points, Indices=["-1", "0"], Wrap=True)
move = Move(Geometry=cull_index, Motion=unit_x)  # -> Geometry, Transform
insert_items = InsertItems(List=move.Geometry, Item=point, Indices="0", Wrap=True)
insert_items_2 = InsertItems(List=insert_items, Item=point_2, Indices="-1", Wrap=True)
interpolate = Interpolate(Vertices=insert_items_2, Degree=3, Periodic=False, KnotStyle=1)  # -> Curve, Length, Domain
curve_curve = CurveCurve(CurveA=interpolate.Curve, CurveB=rectangle_2.Rectangle)  # -> Points, ParamsA, ParamsB
polyline = PolyLine(Vertices=curve_curve.Points, Closed=False)
list_length_2 = ListLength(List=flatten(curve_curve.Points))
length = Length(Curve=polyline)  # -> flatten(Length)
clean_tree = CleanTree(RemoveNulls=True, RemoveInvalid=True, RemoveEmpty=False, Tree=length)
multiplication = Multiplication(A=list_length_2, B=how_much_to_weigh_intersections_amount)
mass_addition = MassAddition(Input=clean_tree)  # -> Result, PartialResults
addition = Addition(A=multiplication, B=mass_addition.Result)

# ---- group: The magic (continued)
number = Number(addition)
