# Grasshopper definition 201128_Pavillion Number 2.gh (Grasshopper 1.0.7)
# plug-ins: Human, Bifocals

distance_between_rolls = Slider(1.37, range=0..10)
extension_x = Slider(16, range=0..100)
extension_y = Slider(23, range=0..100)
total_size_x = Slider(33.53, range=0..100)
totalsize_y = Slider(23, range=0..100)
series = Series(Start=0, Step=distance_between_rolls, Count=expr("x+1", extension_y))
series_2 = Series(Start=0, Step=distance_between_rolls, Count=expr("x+1", extension_x))
multiplication = Multiplication(A=extension_y, B=distance_between_rolls)
multiplication_2 = Multiplication(A=extension_x, B=distance_between_rolls)
rectangle = Rectangle(Plane=PlaneXY(0, 0, 0), XSize=multiplication_2, YSize=multiplication, Radius=0)  # -> Rectangle, Length
construct_point = ConstructPoint(XCoordinate=graft(series_2), YCoordinate=series, ZCoordinate=0)  # -> flatten(Point)
explode = Explode(Curve=rectangle.Rectangle, Recursive=True)  # -> Segments, Vertices
point = Point([Point(23.91583276, 24.24429404, 0), Point(7.003478324, 3.135696374, 0.267046868), Point(3.943809738, 18.42752855, 0)])
dispatch = Dispatch(List=explode.Segments, DispatchPattern=[True, False])  # -> ListA, ListB
point_charge = PointCharge(Point=point, Charge=Slider(8.43, range=-10..10), Decay=Slider(0.19, range=-5..10))
merge_fields = MergeFields(Fields=point_charge)
direction_display = DirectionDisplay(Field=merge_fields, Section=rectangle.Rectangle, Samples=1000)
maximum_height = Slider(5.82, range=0..10)
evaluate_field = EvaluateField(Field=merge_fields, Point=construct_point)  # -> Tensor, Strength
tensor_display = TensorDisplay(Field=merge_fields, Section=rectangle.Rectangle, Samples=Slider(954, range=0..10000))
bounds = Bounds(Numbers=evaluate_field.Strength)
construct_domain = ConstructDomain(DomainStart="0", DomainEnd=maximum_height)
remap_numbers = RemapNumbers(Value=evaluate_field.Strength, Source=bounds, Target=construct_domain)  # -> Mapped, Clipped
unit_z = UnitZ(Factor=maximum_height)
geometry = Geometry(construct_point)
height_ceiling = Slider(3.05, range=0..10)
thickness_ceiliing = Slider(0.18, range=0..1)
negative = Negative(Value=remap_numbers.Mapped)
move = Move(Geometry=geometry, Motion=unit_z)  # -> Geometry, Transform
list_item = ListItem(List=geometry, Index=0, Wrap=True)
unit_z_2 = UnitZ(Factor=negative)
circle = Circle(Plane=list_item, Radius=thickness_ceiliing)
unit_z_3 = UnitZ(Factor=height_ceiling)
addition = Addition(A=unit_z_2, B=unit_z_3)
addition_2 = Addition(A=unit_z, B=unit_z_2)
move_2 = Move(Geometry=move.Geometry, Motion=addition)  # -> Geometry, Transform
number = Number(expr("x+1", extension_y))
vector_2pt = Vector2Pt(PointA=list_item, PointB=geometry, Unitize=False)  # -> Vector, Length
extrude = Extrude(Base=circle, Direction=unit_z_3)
move_3 = Move(Geometry=move.Geometry, Motion=unit_z_3)  # -> Geometry, Transform
thicknessbeams = Slider(0.26, range=0..1)
partition_list = PartitionList(List=move_3.Geometry, Size=number)
boundary_surfaces = BoundarySurfaces(Edges=circle)
addition_3 = Addition(A=vector_2pt.Vector, B=addition_2)
underconstruction_extension = Slider(0.54, range=0..1)
polyline = PolyLine(Vertices=partition_list, Closed=False)  # -> flatten(Polyline)
unit_x = UnitX(Factor=thicknessbeams)
line_thickness = Slider(0.007, range=0..0.1)
move_4 = Move(Geometry=extrude, Motion=addition_3)  # -> Geometry, Transform
move_5 = Move(Geometry=boundary_surfaces, Motion=addition_3)  # -> Geometry, Transform
extend_curve = ExtendCurve(Curve=polyline, Type=0, Start=underconstruction_extension, End=underconstruction_extension)
negative_2 = Negative(Value=unit_x)
move_6 = Move(Geometry=move_5.Geometry, Motion=unit_z_3)  # -> Geometry, Transform
list_item_2 = ListItem(List=reverse(extend_curve), Index="0", Wrap=True)
list_item_3 = ListItem(List=extend_curve, Index="0", Wrap=True)
colour_picker = ColourPicker(PickedColour=RGB(148, 72, 25))
end_points = EndPoints(Curve=list_item_2)  # -> Start, End
end_points_2 = EndPoints(Curve=list_item_3)  # -> Start, End
merge = Merge(Data1=move_5.Geometry, Data2=move_6.Geometry, Data3=move_4.Geometry)
unit_z_4 = UnitZ(Factor=Slider(0.48, range=0..10))
line = Line(StartPoint=end_points_2.Start, EndPoint=end_points.Start)
line_2 = Line(StartPoint=end_points_2.End, EndPoint=end_points.End)
custom_preview = CustomPreview(Geometry=merge, Material=colour_picker)
join_curves = JoinCurves(Curves=[line, line_2, list_item_3, list_item_2], Preserve=False)
offset_curve = OffsetCurve(Curve=join_curves, Distance=expr("x/2", thicknessbeams), Plane=PlaneXY(0, 0, 0), Corners=1)
offset_curve_2 = OffsetCurve(Curve=offset_curve, Distance=expr("-x", thicknessbeams), Plane=PlaneXY(0, 0, 0), Corners=1)
boundary_surfaces_2 = BoundarySurfaces(Edges=flatten([offset_curve_2, offset_curve]))
unit_z_5 = UnitZ(Factor=expr("-abs(x)", Slider(1.34, range=0..10)))
subtraction = Subtraction(A=unit_z_3, B=unit_z_5)
move_7 = Move(Geometry=move.Geometry, Motion=subtraction)  # -> Geometry, Transform
line_3 = Line(StartPoint=move_2.Geometry, EndPoint=move_7.Geometry)
pipe = Pipe(Curve=line_3, Radius=line_thickness, Caps=0)
subtraction_2 = Subtraction(A=negative_2, B=unit_z_5)
move_8 = Move(Geometry=extend_curve, Motion=subtraction_2)  # -> Geometry, Transform
extrude_2 = Extrude(Base=move_8.Geometry, Direction=unit_x)
extrude_3 = Extrude(Base=extrude_2, Direction=unit_z_4)
custom_preview_2 = CustomPreview(Geometry=pipe, Material="white")
custom_preview_materials = CustomPreviewMaterials(Geometry=extrude_3, DiffuseColor=RGB(255, 255, 255))
extrude_4 = Extrude(Base=boundary_surfaces_2, Direction=unit_z_5)
move_9 = Move(Geometry=extrude_4, Motion=expr("-x", unit_z_5))  # -> Geometry, Transform
custom_preview_materials_2 = CustomPreviewMaterials(Geometry=move_9.Geometry, DiffuseColor=RGB(255, 255, 255))
