# Grasshopper definition 201205_ParametricCampExample.gh (Grasshopper 1.0.7)

polygon = Polygon(Plane=PlaneXY(0, 0, 0), Radius=Slider(9.58, range=0..10), Segments=Slider(3, range=0..10), FilletRadius=0)  # -> Polygon, Length
geometry = Geometry(polygon.Polygon)
curve = Curve(geometry)
explode = Explode(Curve=geometry, Recursive=True)  # -> Segments, Vertices
c_script = CSharpScript(poly=curve, levels=Slider(2, range=0..10))  # -> out, Koch; inputs poly: Polyline
# ---------- c_script: C# ----------
    Koch = KochStar(levels);
# ---------- c_script: C# additional code ----------
  Polyline KochStar(Polyline pol, int levels)
  {
    Polyline star = pol;
    for (int i = 0; i < levels; i++){
      star = KochSubdivision(star);
      
    }
    return star;
  }
  
  
  
  
  Polyline KochSubdivision(Polyline pol)
  {
    int PointCount = pol.Count;

    // Create new empty poly
    Polyline sub = new Polyline();
    sub.Add(pol.First);
    //iterate through every point of the Polyline
    for (int i = 1;i < pointCount;i++)
    {
      Point3d start = pol[i - 1];
      Point3d end = pol[i];
      Point3d p13 = PointAlongLineRelative(start, end, 1 / 3.0);
      double a = Distance(start, end);
      double a3 = a / 3.0;
      double h = a3 * Math.Sqrt(3) / 2.0;
      perp *= h;
      Point3d mid = PPointAlongLineRelative(start, end, 0.5){
        Point3d mid += perp;
        sub.Add(mid);
      }

      return sub;
    }




    Point3d PointAlongLineRelative(Point3d a, Point3d b, double t) {
      // Find relative distances between points
      double dx = b.X - a.X;
      double dy = b.Y - a.Y;
      double dz = b.Z - a.Z;

      // Compute relative distances for c
      double nx = t * dx;
      double ny = t * dy;
      double nz = t * dz;

      // Compute world coordinates for c
      double cx = a.X + nx;
      double cy = a.Y + ny;
      double cz = a.Z + nz;

      // Compute c point
      Point3d c = new Point3d(cx, cy, cz);

      // // Doing it the 'vector algebra' way ;)
      //    Vector3d AB = b - a;
      //    Vector3d AC = t * AB;
      //    Point3d c = a + AC;

      return c;
    }

  }
# ---------- end c_script ----------
center_box = CenterBox(Base=PlaneXY(0, 0, 0), X=1, Y=1, Z=1)

length = Length(Curve=explode.Segments)
divide_curve = DivideCurve(Curve=explode.Segments, Count="3", Kinks=False)  # -> Points, Tangents, Parameters
evaluate_curve = EvaluateCurve(Curve=reparameterize(explode.Segments), Parameter="0.5")  # -> Point, Tangent, Angle
end_points = EndPoints(Curve=explode.Segments)  # -> Start, End
plane_fit = PlaneFit(Points=evaluate_curve.Tangent)  # -> Plane, Deviation
expression = Expression(x=length, Expression="(x/ 3.0) * (Sqrt(3)/2.0)")
vector_2pt = Vector2Pt(PointA=end_points.Start, PointB=end_points.End, Unitize=False)  # -> Vector, Length
deconstruct_plane = DeconstructPlane(Plane=plane_fit.Plane)  # -> Origin, XAxis, YAxis, ZAxis
unit_vector = UnitVector(Vector=vector_2pt.Vector)
negative = Negative(Value=deconstruct_plane.ZAxis)
cross_product = CrossProduct(VectorA=unit_vector, VectorB=negative, Unitize=False)  # -> Vector, Length
multiplication = Multiplication(A=cross_product.Vector, B=expression)
move = Move(Geometry=evaluate_curve.Point, Motion=multiplication)  # -> Geometry, Transform
insert_items = InsertItems(List=divide_curve.Points, Item=graft(move.Geometry), Indices="2", Wrap=True)
vector_display = VectorDisplay(Anchor=evaluate_curve.Point, Vector=multiplication)
polyline = PolyLine(Vertices=insert_items, Closed=False)

geometry_2 = Geometry(c_script.Koch)
geometry_3 = Geometry(polyline)
