# Grasshopper definition 201206_KitchenCabinets.gh (Grasshopper 1.0.7)
# plug-ins: Bifocals

offset_of_the_kitchen_width = Slider(-0.6, range=-1..1)
drawer_width_subtraction = Slider(-0.15, range=-1..1)
geometry = Geometry(<curve referenced from the Rhino model>)
cabinet_drawers = Slider(0.06, range=0..1)
kitchen_height = Slider(2.85, range=0..10)
drawer_amount = Slider(3, range=0..10)
drawer_height = Slider(0.15, range=0..1)
gene_pool = GenePool(Decimals=2, Maximum=1, Minimum=0, Value=[0.02, 0.11, 0.66, 0.39])
offset_curve = OffsetCurve(Curve=geometry, Distance=offset_of_the_kitchen_width, Plane=PlaneXY(0, 0, 0), Corners=1)
divide_curve = DivideCurve(Curve=reparameterize(geometry), Count=10, Kinks=False)  # -> Points, Tangents, Parameters
evaluate_curve = EvaluateCurve(Curve=reparameterize(geometry), Parameter=gene_pool)  # -> Point, Tangent, Angle
merge = Merge(Data1=divide_curve.Parameters, Data2=gene_pool)
merge_2 = Merge(Data1=flatten(divide_curve.Points), Data2=flatten(evaluate_curve.Point))
merge_3 = Merge(Data1=flatten(divide_curve.Tangents), Data2=flatten(evaluate_curve.Tangent))
line_sdl = LineSDL(Start=merge_2, Direction=Vector(0, 0, 1), Length=1)
shatter = Shatter(Curve=reparameterize(geometry), Parameters=flatten(merge))
rotate = Rotate(Vector=merge_3, Axis=line_sdl, Angle=degrees("90"))
loft = Loft(
    Curves=flatten([offset_curve, geometry]),
    Options={Adjust=False, Closed=False, LoftEnds=0, LoftSimp=0, LoftType=0, Rebuild=10, Refit=0.01})
extend_curve = ExtendCurve(Curve=shatter, Type=0, Start=drawer_width_subtraction, End=drawer_width_subtraction)
offset_curve_2 = OffsetCurve(Curve=extend_curve, Distance=cabinet_drawers, Plane=PlaneXY(0, 0, 0), Corners=1)
line_sdl_2 = LineSDL(Start=merge_2, Direction=rotate, Length=expr("-x", offset_of_the_kitchen_width))
trim_tree = TrimTree(Tree=offset_curve_2, Depth=1)
surface_split = SurfaceSplit(Surface=loft, Curves=line_sdl_2)
end_points = EndPoints(Curve=extend_curve)  # -> Start, End
unit_z = UnitZ(Factor=kitchen_height)
end_points_2 = EndPoints(Curve=trim_tree)  # -> Start, End
extrude = Extrude(Base=surface_split, Direction=unit_z)
line = Line(StartPoint=end_points.End, EndPoint=end_points_2.End)
line_2 = Line(StartPoint=end_points.Start, EndPoint=end_points_2.Start)
range = Range(Domain=kitchen_height, Steps=drawer_amount)
division = Division(A=kitchen_height, B=drawer_amount)
merge_4 = Merge(Data1=extend_curve, Data2=trim_tree, Data3=line_2, Data4=line)
panel = Panel(range)
subtraction = Subtraction(A=division, B=drawer_height)
unit_z_2 = UnitZ(Factor=subtraction)
join_curves = JoinCurves(Curves=merge_4, Preserve=False)
unit_z_3 = UnitZ(Factor=range)
extrude_2 = Extrude(Base=join_curves, Direction=unit_z_2)
cull_index = CullIndex(List=unit_z_3, Indices="-1", Wrap=True)
move = Move(Geometry=graft(extrude_2), Motion=cull_index)  # -> Geometry, Transform
merge_5 = Merge(Data1=flatten(extrude), Data2=flatten(move.Geometry))
