# Grasshopper definition 201213_KengoKuma.gh (Grasshopper 1.0.7)

amount_of_waves = Slider(21, range=0..100)
amount_of_things = Slider(212, range=0..1000)
density = Slider(3, range=0..10)
thicknes_of_waves = Slider(0.26, range=0..10)
amount_of_waves_higher_less = Slider(8, range=0..10)
curve = Curve([<curve referenced from the Rhino model> x3])
loft = Loft(Curves=curve, Options={Adjust=False, Closed=False, LoftEnds=0, LoftSimp=0, LoftType=0, Rebuild=10, Refit=0.01})
series = Series(Start="1", Step=thicknes_of_waves, Count=amount_of_waves_higher_less)
colour_picker = ColourPicker(PickedColour=RGBA(255, 255, 255, 242))
divide_surface = DivideSurface(Surface=loft, UCount=amount_of_waves, VCount=amount_of_things)  # -> Points, Normals, Parameters
custom_preview = CustomPreview(Geometry=loft, Material=colour_picker)  # disabled
cull_index = CullIndex(List=reverse(series), Indices="0", Wrap=True)
flip_matrix = FlipMatrix(Data=divide_surface.Points)
flip_matrix_2 = FlipMatrix(Data=divide_surface.Normals)
flip_matrix_3 = FlipMatrix(Data=divide_surface.Parameters)
cull_index_2 = CullIndex(List=series, Indices="0", Wrap=True)
unit_z = UnitZ(Factor=1)
merge = Merge(Data1=flatten(cull_index_2), Data2=flatten(cull_index))  # -> flatten(Result)
evaluate_surface = EvaluateSurface(Surface=loft, Point=divide_surface.Parameters)  # -> Point, Normal, UDirection, VDirection, Frame
contour = Contour(Shape=loft, Point=Point(0, 0, 0), Direction=unit_z, Distance=Slider(6, range=0..10))
shift_list = ShiftList(List=merge, Shift=expr("x-1", amount_of_waves_higher_less), Wrap=True)  # -> flatten(List)
closed = Closed(Curve=contour)  # -> Closed, Periodic
repeat_data = RepeatData(Data=merge, Length=expr("x+1", amount_of_waves))
repeat_data_2 = RepeatData(Data=shift_list, Length=expr("x+1", amount_of_waves))
dispatch = Dispatch(List=contour, DispatchPattern=closed.Closed)  # -> ListA, ListB
data = Data(repeat_data)
data_2 = Data(repeat_data_2)
geometry = Geometry(dispatch.ListA)
entwine = Entwine(Branch00=data, Branch01=data_2, FlattenInputs=True)
boundary_surfaces = BoundarySurfaces(Edges=geometry)  # disabled
tree_statistics = TreeStatistics(Tree=entwine)  # -> Paths, Length, Count
repeat_data_3 = RepeatData(Data=tree_statistics.Paths, Length=expr("x+1", amount_of_things))
branch = TreeBranch(Tree=entwine, Path=repeat_data_3, MaintainPaths=False)
amplitude = Amplitude(Vector=flip_matrix_2, Amplitude=expr("-x", branch))
move = Move(Geometry=flip_matrix, Motion=amplitude)  # -> Geometry, Transform
polyline = PolyLine(Vertices=move.Geometry, Closed=False)
repeat_data_4 = RepeatData(Data="true", Length=density)  # -> flatten(Data)
repeat_data_5 = RepeatData(Data="false", Length="3")  # -> flatten(Data)
merge_2 = Merge(Data1=repeat_data_4, Data2=repeat_data_5)
dispatch_2 = Dispatch(List=flatten(polyline), DispatchPattern=merge_2)  # -> ListA, ListB
geometry_2 = Geometry(dispatch_2.ListB)
partition_list = PartitionList(List=geometry_2, Size="3")
list_item = ListItem(List=partition_list, Index="0", Wrap=True)
list_item_2 = ListItem(List=partition_list, Index="2", Wrap=True)
list_item_3 = ListItem(List=partition_list, Index="1", Wrap=True)
panel = Panel("gray")
ruled_surface = RuledSurface(CurveA=list_item, CurveB=list_item_3)
ruled_surface_2 = RuledSurface(CurveA=list_item_3, CurveB=list_item_2)
