# Grasshopper definition 201231_newYears.gh (Grasshopper 1.0.7)

square_size = Slider(100, range=0..100)
total_amount = Slider(399, range=0..1000)
bottom_height = Slider(11, range=0..100)
top_height = Slider(38, range=0..100)
firework_intensity = Slider(10, range=0..30)
fireworks_going = Slider(0.2031, range=0..1)
firework_lag = Slider(8, range=0..10)
construct_domain = ConstructDomain(DomainStart=bottom_height, DomainEnd=top_height)
rectangle = Rectangle(Plane=PlaneXY(0, 0, 0), XSize=square_size, YSize=square_size, Radius=0)  # -> Rectangle, Length
number_slider = Slider(6.84, range=0..10)
range = Range(Domain=construct_domain, Steps=expr("x-1", total_amount))
unit_z = UnitZ(Factor=range)
multiplication = Multiplication(A=range, B=Slider(1, range=0..1))
sine = Sine(Value=range)
sine_2 = Sine(Value=multiplication)
populate_2d = Populate2D(Region=rectangle.Rectangle, Count=total_amount, Seed=1)
multiplication_2 = Multiplication(A=sine, B=number_slider)
multiplication_3 = Multiplication(A=sine_2, B=number_slider)
vector_xyz = VectorXYZ(XComponent=multiplication_2, YComponent=multiplication_3, ZComponent=range)  # -> Vector, Length
move = Move(Geometry=populate_2d, Motion=vector_xyz.Vector)  # -> Geometry, Transform
line = Line(StartPoint=move.Geometry, EndPoint=populate_2d)
multiplication_4 = Multiplication(A=total_amount, B=fireworks_going)
round = Round(Number=multiplication_4)  # -> Nearest, Floor, Ceiling
ghpython_script = GhPythonScript(currentState=round.Ceiling, totalRange=total_amount, Lag=firework_lag)  # -> out, newList; inputs currentState: Int32, totalRange: Int32
# ---------- ghpython_script: Python ----------
__author__ = "Batelka"
__version__ = "2020.12.31"

import rhinoscriptsyntax as rs

newList = []
counter = 0


for i in range (totalRange+1):
    if i < currentState:
        newList.append(0)
    elif (i > currentState + Lag):
        newList.append(1)
    elif (i > currentState):
        counter+=1
        newList.append(counter/Lag)
# ---------- end ghpython_script ----------
end_points = EndPoints(Curve=line)  # -> Start, End
evaluate_curve = EvaluateCurve(Curve=line, Parameter=ghpython_script.newList)  # -> Point, Tangent, Angle
mesh_sphere = MeshSphere(Base=end_points.Start, Radius=10, UCount=firework_intensity, VCount=firework_intensity)
series = Series(Start=0, Step=1, Count=round.Ceiling)
deconstruct_mesh = DeconstructMesh(Mesh=mesh_sphere)  # -> Vertices, Faces, Colours, Normals
tree_branch = TreeBranch(Tree=simplify(deconstruct_mesh.Vertices), Path=series, MaintainPaths=True)
line_2 = Line(StartPoint=evaluate_curve.Point, EndPoint=populate_2d)
list_item = ListItem(List=end_points.Start, Index=series, Wrap=True)
custom_preview = CustomPreview(Geometry=line_2, Material="white")
gradient = Gradient(
    LowerLimit=0,
    UpperLimit=round.Ceiling,
    Parameter=series,
    stops=[0: RGB(243, 57, 0), 0.1: RGB(236, 27, 60), 0.2: RGB(210, 0, 118), 0.3: RGB(103, 0, 120), 0.4: RGB(39, 72, 161), 0.5: RGB(1, 192, 229), 0.6: RGB(18, 178, 90), 0.7: RGB(79, 186, 8), 0.8: RGB(220, 237, 32), 0.9: RGB(247, 159, 20), 1: RGB(243, 57, 0)])
line_3 = Line(StartPoint=graft(list_item), EndPoint=tree_branch)
custom_preview_2 = CustomPreview(Geometry=line_3, Material=graft(gradient))
