# Grasshopper definition 210109_WoodConstruction.gh (Grasshopper 1.0.7)

amount = Slider(12, range=0..100)
overlap = Slider(1.58, range=-10..10)
thickness = Slider(1, range=0..1)
distanceinbetween = Slider(4.7, range=0..10)

curve = Curve(<curve referenced from the Rhino model>)
curve_2 = Curve(<curve referenced from the Rhino model>)
end_points = EndPoints(Curve=curve_2)  # -> Start, End
sum_surface = SumSurface(CurveA=curve_2, CurveB=curve)
unit_y = UnitY(Factor=1)
contour = Contour(Shape=sum_surface, Point=end_points.End, Direction=unit_y, Distance=distanceinbetween)
range = Range(Domain=Domain(0, 1), Steps=amount)
evaluate_curve = EvaluateCurve(Curve=reparameterize(contour), Parameter=range)  # -> Point, Tangent, Angle
shift_list = ShiftList(List=evaluate_curve.Point, Shift=Slider(1, range=0..1), Wrap=False)
tree_statistics = TreeStatistics(Tree=contour)  # -> Paths, Length, Count
line = Line(StartPoint=evaluate_curve.Point, EndPoint=shift_list)
panel = Panel("""True
False
False
True""")
boolean = Boolean(panel)
repeat_data = RepeatData(Data=boolean, Length=expr("x*2", tree_statistics.Count))
list_length = ListLength(List=panel)
partition_list = PartitionList(List=repeat_data, Size=expr("x/2", list_length))
boolean_2 = Boolean(partition_list)
dispatch = Dispatch(List=line, DispatchPattern=boolean_2)  # -> ListA, ListB
geometry = Geometry(dispatch.ListA)
extend_curve = ExtendCurve(Curve=geometry, Type=0, Start=overlap, End=overlap)
unit_y_2 = UnitY(Factor=distanceinbetween)
end_points_2 = EndPoints(Curve=extend_curve)  # -> Start, End
move = Move(Geometry=end_points_2.End, Motion=unit_y_2)  # -> Geometry, Transform
rectangle_3pt = Rectangle3Pt(PointA=end_points_2.Start, PointB=end_points_2.End, PointC=move.Geometry)  # -> Rectangle, Length
box_rectangle = BoxRectangle(Rectangle=rectangle_3pt.Rectangle, Height=thickness)
colour_picker = ColourPicker(PickedColour=RGB(140, 109, 62))
panel_2 = Panel("wood")
custom_preview = CustomPreview(Geometry=box_rectangle, Material=colour_picker)
