# Grasshopper definition 210124_Pixelization.gh (Grasshopper 1.0.7)

geometry = Geometry([<curve referenced from the Rhino model> x2])
bounding_box = BoundingBox(Content=geometry, Plane=PlaneXY(0, 0, 0), UnionBox=True)  # -> Box, Box_2
deconstruct_box = DeconstructBox(Box=bounding_box.Box)  # -> Plane, X, Y, Z
closest_point_factor = Slider(2.13, range=0..5)
divisionx = Slider(34, range=0..100)
number_slider = Slider(38, range=0..100)
deconstruct_domain = DeconstructDomain(Domain=deconstruct_box.X)  # -> Start, End
deconstruct_domain_2 = DeconstructDomain(Domain=deconstruct_box.Y)  # -> Start, End
bounds = Bounds(Numbers=deconstruct_box.X)
bounds_2 = Bounds(Numbers=deconstruct_box.Y)
absolute = Absolute(Value=deconstruct_domain.Start)
absolute_2 = Absolute(Value=deconstruct_domain.End)
absolute_3 = Absolute(Value=deconstruct_domain_2.Start)
absolute_4 = Absolute(Value=deconstruct_domain_2.End)
range = Range(Domain=deconstruct_box.Y, Steps=number_slider)
range_2 = Range(Domain=deconstruct_box.X, Steps=divisionx)
addition = Addition(A=absolute, B=absolute_2)
division = Division(A=addition, B=divisionx)
addition_2 = Addition(A=absolute_3, B=absolute_4)
division_2 = Division(A=addition_2, B=number_slider)
construct_point = ConstructPoint(XCoordinate=0, YCoordinate=0, ZCoordinate=0)
vector_xyz = VectorXYZ(XComponent=range_2, YComponent=graft(range), ZComponent=0)  # -> Vector, Length
move = Move(Geometry=construct_point, Motion=vector_xyz.Vector)  # -> Geometry, Transform
expression = Expression(x=division, y=division_2, z=closest_point_factor, Expression="(x+y)/z")
construct_domain = ConstructDomain(DomainStart=expr("-x/2", division), DomainEnd=expr("x/2", division))
construct_domain_2 = ConstructDomain(DomainStart=expr("-x/2", division_2), DomainEnd=expr("x/2", division_2))
pull_point = PullPoint(Point=move.Geometry, Geometry=geometry, ClosestOnly=True)  # -> ClosestPoint, Distance
smaller_than = SmallerThan(FirstNumber=pull_point.Distance, SecondNumber=expression)  # -> SmallerThan, OrEqualTo
cull_pattern = CullPattern(List=move.Geometry, CullPattern=smaller_than.SmallerThan)
rectangle = Rectangle(Plane=cull_pattern, XSize=construct_domain, YSize=construct_domain_2, Radius=0)  # -> Rectangle, Length
data_dam = DataDam(DataDataA=rectangle.Rectangle, BufferDelay=10000000, BufferMode=0)
box_rectangle = BoxRectangle(Rectangle=rectangle.Rectangle, Height=construct_domain)
region_union = RegionUnion(Curves=flatten(data_dam))  # disabled
