# Grasshopper definition 210214_ZahaHadidSoho.gh (Grasshopper 1.0.7)
# plug-ins: Bifocals

columnamount = Slider(32, range=0..100)
topscalecomparison = Slider(0.35, range=0..1)
offsetstructure = Slider(0.92, range=0..1)
column_spacing = Slider(20, range=0..50)
curve = Curve(graft([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]))
gene_pool = GenePool(Decimals=0, Maximum=100, Minimum=0, Value=[22, 28, 88, 50, 50, 50, 50, 50, 50, 50])
unit_y = UnitY(Factor=1)
expression = Expression(x=column_spacing, y=columnamount, Expression="-(x*y)/2")
data = Data(flatten(curve))
series = Series(Start=expression, Step=column_spacing, Count=expr("x+1", columnamount))
area = Area(Geometry=curve)  # -> Area, Centroid
list_length = ListLength(List=data)
area_2 = Area(Geometry=data)  # -> Area, Centroid
unit_x = UnitX(Factor=series)
series_2 = Series(Start=0, Step=1, Count=list_length)
scale = Scale(Geometry=curve, Center=area.Centroid, Factor=topscalecomparison)  # -> Geometry, Transform
move = Move(Geometry=graft(area_2.Centroid), Motion=unit_x)  # -> Geometry, Transform
unit_y_2 = UnitY(Factor=series)
list_item = ListItem(List=gene_pool, Index=series_2, Wrap=True)
range = Range(Domain=Domain(0, 1), Steps=expr("x-1", list_item))
rebuild_curve = RebuildCurve(Curve=scale.Geometry, Degree=Slider(6, range=0..10), Count=Slider(0, range=0..10), Tangents=False)
move_2 = Move(Geometry=graft(move.Geometry), Motion=unit_y_2)  # -> Geometry, Transform
graph_mapper = GraphMapper(range, x0=0, x1=1, y0=0, y1=1, Cx=0.3804285824, Cy=0.8334164619, container_name="Conic")
trim_tree = TrimTree(Tree=move_2.Geometry, Depth=1)
floor_height = Slider(3.1, range=0..10)
scale_2 = Scale(Geometry=data, Center=area_2.Centroid, Factor=offsetstructure)  # -> Geometry, Transform
point_in_curve = PointInCurve(Point=trim_tree, Curve=graft(scale_2.Geometry))  # -> Relationship, Point
tween_curve = TweenCurve(CurveA=rebuild_curve, CurveB=curve, Factor=graph_mapper, BlendType=0)
equality = Equality(FirstNumber=point_in_curve.Relationship, SecondNumber="2")  # -> Equality, Inequality
series_3 = Series(Start=0, Step=floor_height, Count=list_item)  # -> reverse(Series)
unit_z = UnitZ(Factor=series_3)
move_3 = Move(Geometry=tween_curve, Motion=unit_z)  # -> Geometry, Transform
sort_list = SortList(Keys=list_item, ValuesA=list_item)  # -> Keys, ValuesA
cull_pattern = CullPattern(List=trim_tree, CullPattern=equality.Equality)
area_3 = Area(Geometry=move_3.Geometry)  # -> Area, Centroid
list_item_2 = ListItem(List=sort_list.Keys, Index="-1", Wrap=True)
scale_3 = Scale(Geometry=move_3.Geometry, Center=area_3.Centroid, Factor=offsetstructure)  # -> Geometry, Transform
divide_curve = DivideCurve(Curve=scale_3.Geometry, Count=Slider(12, range=0..12), Kinks=False)  # -> Points, Tangents, Parameters
path_mapper = PathMapper(divide_curve.Points, source="{A;B;C;D}(i)", target="{A;B;C;i}(D)")
multiplication = Multiplication(A=floor_height, B=list_item_2)
unit_z_2 = UnitZ(Factor=1)
line_sdl = LineSDL(Start=cull_pattern, Direction=unit_z_2, Length=multiplication)
polyline = PolyLine(Vertices=path_mapper, Closed=False)
boundary_surfaces = BoundarySurfaces(Edges=scale_3.Geometry)
simplify_curve = SimplifyCurve(Curve=polyline)  # -> Curve, Simplified
trim_with_brep = TrimWithBrep()  # -> Inside, Outside
surface_curve = SurfaceCurve(Surface=flatten(boundary_surfaces), Curve=graft(line_sdl))  # -> Curves, Points, UVPoints, Normals, Parameters, Tangents
trim_tree_2 = TrimTree(Tree=surface_curve.Points, Depth=1)
polyline_2 = PolyLine(Vertices=trim_tree_2, Closed=False)
merge = Merge(Data1=simplify_curve.Curve, Data2=polyline_2)
data_dam = DataDam(DataA=merge, BufferDelay=10000000, BufferMode=0)
column_thickness = Slider(0.526, range=0..1)
floorthickness = Slider(0.269, range=0..1)
pipe = Pipe(Curve=data_dam, Radius=column_thickness, Caps=0)
unit_z_3 = UnitZ(Factor=floorthickness)
boundary_surfaces_2 = BoundarySurfaces(Edges=move_3.Geometry)
extrude = Extrude(Base=boundary_surfaces_2, Direction=unit_z_3)
