# Grasshopper definition 210219_690FolsomVar_01.gh (Grasshopper 1.0.7)

total_width_meters = Slider(51, range=0..100)  # disabled
unit_x = UnitX(Factor=1)  # disabled
panel = Panel("0,0,0")  # disabled
total_facade_height = Slider(20, range=0..100)  # disabled

# ---- group: window positions
gene_pool = GenePool(Decimals=2, Maximum=1, Minimum=0, Value=[0.5, 0.5, 0.5, 0.5, 0.5, 0.5, 0.5, 0.5, 0.5, 0.5])  # disabled

# ----
line_sdl = LineSDL(Start=panel, Direction=unit_x, Length=total_width_meters)  # disabled
unit_z = UnitZ(Factor=total_facade_height)  # disabled
curve = Curve(reparameterize(line_sdl))  # disabled
number_slider = Slider(122, range=0..1000)  # disabled
random_seed = Slider(2, range=0..10)  # disabled
move = Move(Geometry=curve, Motion=unit_z)  # -> Geometry, Transform; disabled
end_points = EndPoints(Curve=curve)  # -> Start, End; disabled
end_points_2 = EndPoints(Curve=move.Geometry)  # -> Start, End; disabled
range = Range(Domain=Domain(0, 1), Steps=number_slider)  # disabled
random = Random(Range=Domain(0, 1), Number=number_slider, Seed=random_seed)  # disabled
panel_2 = Panel("0")  # disabled
line = Line(StartPoint=end_points.Start, EndPoint=end_points_2.Start)  # disabled
cull_index = CullIndex(List=range, Indices=panel_2, Wrap=True)  # disabled
line_2 = Line(StartPoint=end_points.End, EndPoint=end_points_2.End)  # disabled
height_m = Slider(23, range=0..100)
width = Slider(31, range=0..100)
join_curves = JoinCurves(Curves=[line, line_2, move.Geometry, curve], Preserve=False)  # disabled
evaluate_curve = EvaluateCurve(Curve=reparameterize(join_curves), Parameter=cull_index)  # -> Point, Tangent, Angle; disabled
evaluate_curve_2 = EvaluateCurve(Curve=reparameterize(join_curves), Parameter=random)  # -> Point, Tangent, Angle; disabled
rectangle = Rectangle(Plane=PlaneXY(0, 0, 0), XSize=width, YSize=height_m, Radius=0)  # -> Rectangle, Length
jitter = Jitter(List=evaluate_curve.Point, Jitter=1, Seed=2)  # -> Values, Indices; disabled
closest_point = ClosestPoint(Point=evaluate_curve_2.Point, Cloud=evaluate_curve.Point)  # -> ClosestPoint, CPIndex, Distance; disabled
number_slider_2 = Slider(0, range=0..1)  # disabled
populate_2d = Populate2D(Region=rectangle.Rectangle, Count=Slider(80, range=0..500), Seed=Slider(100, range=0..100))
vector_2pt = Vector2Pt(PointA=evaluate_curve_2.Point, PointB=closest_point.ClosestPoint, Unitize=False)  # -> Vector, Length; disabled
polyline = PolyLine(Vertices=jitter.Values, Closed=False)  # disabled
line_3 = Line(StartPoint=closest_point.ClosestPoint, EndPoint=evaluate_curve_2.Point)  # disabled
partition_list = PartitionList(List=populate_2d, Size=Slider(2, range=0..10))
multiplication = Multiplication(A=vector_2pt.Length, B=number_slider_2)  # disabled
amplitude = Amplitude(Vector=vector_2pt.Vector, Amplitude=multiplication)  # disabled
move_2 = Move(Geometry=evaluate_curve_2.Point, Motion=amplitude)  # -> Geometry, Transform; disabled
polyline_2 = PolyLine(Vertices=partition_list, Closed=False)  # -> flatten(Polyline)
multiple_curves = MultipleCurves(Curves=polyline_2)  # -> Points, IndexA, IndexB, ParamA, ParamB
polyline_3 = PolyLine(Vertices=move_2.Geometry, Closed=False)  # disabled
curve_closest_point = CurveClosestPoint(Point=multiple_curves.Points, Curve=graft(polyline_2))  # -> Point, Parameter, Distance
smaller_than = SmallerThan(FirstNumber=curve_closest_point.Distance, SecondNumber=Slider(0.001, range=0..0.001))  # -> SmallerThan, OrEqualTo
intersection_remover = Slider(21, range=0..100)
mass_addition = MassAddition(Input=smaller_than.SmallerThan)  # -> Result, PartialResults
smaller_than_2 = SmallerThan(FirstNumber=flatten(mass_addition.Result), SecondNumber=intersection_remover)  # -> SmallerThan, OrEqualTo
number_slider_3 = Slider(71, range=0..100)
dispatch = Dispatch(List=polyline_2, DispatchPattern=smaller_than_2.SmallerThan)  # -> ListA, ListB
number_slider_4 = Slider(0.16, range=0..1)
extend_curve = ExtendCurve(Curve=dispatch.ListA, Type=0, Start=number_slider_3, End=number_slider_3)
panel_3 = Panel(dispatch.ListB)
offset_curve = OffsetCurve(Curve=rectangle.Rectangle, Distance=expr("-x*2", number_slider_4), Plane=PlaneXY(0, 0, 0), Corners=1)
cluster = Cluster(data_2=extend_curve, data=number_slider_4)
geometry = Geometry(cluster)
region_intersection = RegionIntersection(CurvesA=geometry, CurvesB=flatten(rectangle.Rectangle))
region_union = RegionUnion(Curves=flatten(region_intersection))
trim_with_region = TrimWithRegion(Curve=region_union, Region=offset_curve)  # -> flatten(Inside), Outside
explode = Explode(Curve=rectangle.Rectangle, Recursive=True)  # -> Segments, Vertices
divider = Slider(7, range=0..100)
list_item = ListItem(List=explode.Segments, Index=0, Wrap=True)
cluster_2 = Cluster_2(data=trim_with_region.Inside)  # -> line_2, data_3
division = Division(A=width, B=divider)
divide_curve = DivideCurve(Curve=list_item, Count=divider, Kinks=False)  # -> Points, Tangents, Parameters
unit_y = UnitY(Factor=1)
cull_index_2 = CullIndex(List=divide_curve.Points, Indices="-1", Wrap=True)
sort_list = SortList(Keys=divide_curve.Points, ValuesA=divide_curve.Points)  # -> Keys, ValuesA
line_sdl_2 = LineSDL(Start=divide_curve.Points, Direction=unit_y, Length=height_m)
merge = Merge(Data1=cluster_2.line_2, Data2=cluster_2.data_3, Data3=rectangle.Rectangle)
rectangle_2 = Rectangle(Plane=cull_index_2, XSize=division, YSize=height_m, Radius=0)  # -> Rectangle, Length
flip_matrix = FlipMatrix(Data=sort_list.ValuesA)
boundary_surfaces = BoundarySurfaces(Edges=merge)
polyline_4 = PolyLine(Vertices=flip_matrix, Closed=False)
area = Area(Geometry=rectangle.Rectangle)  # -> Area, Centroid
number_slider_5 = Slider(3, range=0..10)
surface_split = SurfaceSplit()
scale = Scale(Geometry=merge, Center=area.Centroid, Factor=Slider(0.999, range=0..1))  # -> Geometry, Transform
trim_with_regions = TrimWithRegions(Curve=scale.Geometry, Regions=graft(rectangle_2.Rectangle))  # -> Inside, Outside
trim_tree = TrimTree(Tree=trim_with_regions.Inside, Depth=1)  # -> simplify(Tree)
list_item_2 = ListItem(List=rectangle_2.Rectangle, Index=number_slider_5, Wrap=True)
tree_branch = TreeBranch(Tree=trim_tree, Path=number_slider_5, MaintainPaths=True)
merge_2 = Merge(Data1=tree_branch, Data2=list_item_2)  # -> flatten(Result)
boundary_surfaces_2 = BoundarySurfaces(Edges=tree_branch)

# ==== cluster Cluster
data = ClusterInput()
data_2 = ClusterInput()
data_3 = Data(data)
data_4 = Data(data_2)
offset_curve = OffsetCurve(Curve=data_4, Distance=expr("-x", data_3), Plane=PlaneXY(0, 0, 0), Corners=1)
offset_curve_2 = OffsetCurve(Curve=data_4, Distance=data_3, Plane=PlaneXY(0, 0, 0), Corners=1)
end_points = EndPoints(Curve=offset_curve_2)  # -> Start, End
end_points_2 = EndPoints(Curve=offset_curve)  # -> Start, End
line = Line(StartPoint=end_points.Start, EndPoint=end_points_2.Start)
line_2 = Line(StartPoint=end_points.End, EndPoint=end_points_2.End)
merge = Merge(Data1=line, Data2=line_2, Data3=offset_curve_2, Data4=offset_curve)
join_curves = JoinCurves(Curves=merge, Preserve=False)
curves = ClusterOutput(join_curves)

# ==== cluster Cluster_2
data = ClusterInput()
data_2 = Data(data)
data_3 = ClusterOutput(data_2)
closed = Closed(Curve=data_2)  # -> Closed, Periodic
dispatch = Dispatch(List=data_2, DispatchPattern=closed.Closed)  # -> ListA, ListB
end_points = EndPoints(Curve=dispatch.ListB)  # -> Start, End
line = Line(StartPoint=end_points.Start, EndPoint=end_points.End)
line_2 = ClusterOutput(line)
