# Grasshopper definition 210219_690FolsomVar_02.gh (Grasshopper 1.0.7)
# plug-ins: Bifocals

width_meters = Slider(100, range=0..100)
height_meters = Slider(35, range=0..100)
amountofrandompoints = Slider(222, range=0..1000)
offsetdistance = Slider(0.3, range=0..1)
divisor_panels = Slider(7, range=0..100)
intersection_value = Slider(30, range=0..100)

rectangle = Rectangle(Plane=PlaneXY(0, 0, 0), XSize=width_meters, YSize=height_meters, Radius=0)  # -> Rectangle, Length
populate_2d = Populate2D(Region=rectangle.Rectangle, Count=amountofrandompoints, Seed=1)
partition_list = PartitionList(List=populate_2d, Size=Slider(2, range=0..10))
polyline = PolyLine(Vertices=partition_list, Closed=False)  # -> flatten(Polyline)
multiple_curves = MultipleCurves(Curves=polyline)  # -> Points, IndexA, IndexB, ParamA, ParamB
curve_closest_point = CurveClosestPoint(Point=multiple_curves.Points, Curve=graft(polyline))  # -> Point, Parameter, Distance
smaller_than = SmallerThan(FirstNumber=curve_closest_point.Distance, SecondNumber=Slider(0.01, range=0..0.01))  # -> SmallerThan, OrEqualTo
mass_addition = MassAddition(Input=smaller_than.SmallerThan)  # -> Result, PartialResults
smaller_than_2 = SmallerThan(FirstNumber=mass_addition.Result, SecondNumber=intersection_value)  # -> SmallerThan, OrEqualTo
dispatch = Dispatch(List=polyline, DispatchPattern=flatten(smaller_than_2.SmallerThan))  # -> ListA, ListB
number_slider = Slider(300, range=0..300)
extend_curve = ExtendCurve(Curve=dispatch.ListA, Type=0, Start=number_slider, End=number_slider)
cluster = Cluster(data_2=extend_curve, data=offsetdistance)
data = Data(cluster)
region_intersection = RegionIntersection(CurvesA=data, CurvesB=rectangle.Rectangle)  # -> flatten(Result)
region_union = RegionUnion(Curves=region_intersection)
offset_curve = OffsetCurve(Curve=rectangle.Rectangle, Distance=expr("-x", offsetdistance), Plane=PlaneXY(0, 0, 0), Corners=1)
trim_with_region = TrimWithRegion(Curve=region_union, Region=offset_curve)  # -> flatten(Inside), Outside
curve = Curve(trim_with_region.Inside)
closed = Closed(Curve=curve)  # -> Closed, Periodic
dispatch_2 = Dispatch(List=curve, DispatchPattern=closed.Closed)  # -> ListA, ListB
end_points = EndPoints(Curve=dispatch_2.ListB)  # -> Start, End
line = Line(StartPoint=end_points.Start, EndPoint=end_points.End)
merge = Merge(Data1=dispatch_2.ListB, Data2=line, Data3=dispatch_2.ListA, Data4=rectangle.Rectangle)
explode = Explode(Curve=rectangle.Rectangle, Recursive=True)  # -> Segments, Vertices
boundary_surfaces = BoundarySurfaces(Edges=merge)
list_item = ListItem(List=explode.Segments, Index=Slider(0, range=0..100), Wrap=True)
divide_curve = DivideCurve(Curve=list_item, Count=divisor_panels, Kinks=False)  # -> Points, Tangents, Parameters
unit_y = UnitY(Factor=1)
line_sdl = LineSDL(Start=divide_curve.Points, Direction=unit_y, Length=height_meters)
surface_split = SurfaceSplit(Surface=boundary_surfaces, Curves=line_sdl)
unit_z = UnitZ(Factor=Slider(0.24, range=0..10))
list_item_2 = ListItem(List=surface_split, Index=Slider(3, range=0..10), Wrap=True)
extrude = Extrude(Base=surface_split, Direction=expr("x/4", unit_z))
extrude_2 = Extrude(Base=surface_split, Direction=unit_z)
custom_preview = CustomPreview(Geometry=extrude_2, Material="white")
custom_preview_2 = CustomPreview(Geometry=extrude, Material="gray")

# ==== cluster Cluster
data = ClusterInput()
data_2 = ClusterInput()
data_3 = Data(data)
data_4 = Data(data_2)
offset_curve = OffsetCurve(Curve=data_4, Distance=data_3, Plane=PlaneXY(0, 0, 0), Corners=1)
offset_curve_2 = OffsetCurve(Curve=data_4, Distance=expr("-x", data_3), Plane=PlaneXY(0, 0, 0), Corners=1)
end_points = EndPoints(Curve=offset_curve_2)  # -> Start, End
end_points_2 = EndPoints(Curve=offset_curve)  # -> Start, End
line = Line(StartPoint=end_points_2.Start, EndPoint=end_points.Start)
line_2 = Line(StartPoint=end_points_2.End, EndPoint=end_points.End)
merge = Merge(Data1=offset_curve, Data2=line, Data3=offset_curve_2, Data4=line_2)
join_curves = JoinCurves(Curves=merge, Preserve=False)
curves = ClusterOutput(join_curves)
