# Grasshopper definition 210306_Pixelization.gh (Grasshopper 1.0.7)
# plug-ins: Bifocals

number_slider = Slider(1, range=0..10)
number_slider_2 = Slider(24, range=0..100)
number_slider_3 = Slider(38, range=0..100)
range = Range(Domain=number_slider, Steps=number_slider_3)
range_2 = Range(Domain=number_slider, Steps=number_slider_2)
division = Division(A=number_slider, B=number_slider_2)
division_2 = Division(A=number_slider, B=number_slider_3)
construct_point = ConstructPoint(XCoordinate=graft(range), YCoordinate=range_2, ZCoordinate=0)
rectangle = Rectangle(Plane=construct_point, XSize=division_2, YSize=division, Radius=0)  # -> Rectangle, Length
image_sampler = ImageSampler(
    construct_point,
    FilePath="D:\Desktop\starry-night-the-famous-painting-2.jpeg",
    Filter="Colour",
    Interpolate=False,
    Umax=1,
    Umin=0,
    Vmax=1,
    Vmin=0,
    Wrap=1)
multiplier = Slider(0.0004, range=0..0.001)
text_split = TextSplit(Text=image_sampler, Separators=",")
mass_addition = MassAddition(Input=text_split)  # -> Result, PartialResults
multiplication = Multiplication(A=mass_addition.Result, B=multiplier)
number_slider_4 = Slider(1, range=0..10)
trim_tree = TrimTree(Tree=multiplication, Depth=1)
box_rectangle = BoxRectangle(Rectangle=rectangle.Rectangle, Height=trim_tree)
mesh_box = MeshBox(Base=box_rectangle, XCount=number_slider_4, YCount=number_slider_4, ZCount=number_slider_4)  # -> flatten(Mesh)
colour = Colour(flatten(image_sampler))
colour_2 = Colour(graft(colour))
mesh_colours = MeshColours(Mesh=graft(mesh_box), Colours=graft(colour_2))
