# Grasshopper definition 210314_GalleriaDepartmentStoreSoul.gh (Grasshopper 1.0.7)
# plug-ins: Pufferfish, Bifocals

number_slider = Slider(10, range=0..10)
curve = Curve(<curve referenced from the Rhino model>)
geometry = Geometry(<curve referenced from the Rhino model>)
unit_z = UnitZ(Factor=Slider(57.75, range=0..100))
extrude = Extrude(Base=geometry, Direction=unit_z)
divide_curve = DivideCurve(Curve=curve, Count=Slider(100, range=0..100), Kinks=False)  # -> Points, Tangents, Parameters
number_slider_2 = Slider(2, range=0..10)
mesh = Mesh()
brep_closest_point = BrepClosestPoint(Point=divide_curve.Points, Brep=extrude)  # -> Point, Normal, Distance
larger_than = LargerThan(FirstNumber=brep_closest_point.Distance, SecondNumber=Slider(179.22, range=0..300))  # -> LargerThan, OrEqualTo
circle_cnr = CircleCNR(Normal=Vector(0, 0, 1), Radius=1)
dispatch = Dispatch(List=brep_closest_point.Point, DispatchPattern=larger_than.LargerThan)  # -> ListA, ListB
circle_3pt = Circle3Pt()  # -> Circle, Plane, Radius
list_length = ListLength(List=dispatch.ListB)
point = Point(dispatch.ListB)
range = Range(Domain=Domain(0, 1), Steps=expr("x-1", list_length))
point_groups = PointGroups(Points=point, Distance=Slider(7.62, range=0..10))  # -> Groups, Indices
graph_mapper = GraphMapper(
    range,
    x0=0,
    x1=1,
    y0=0,
    y1=1,
    amplitude=0.5,
    container_name="Perlin",
    decay=0.2145774961,
    frequency=0.1,
    x_offset=0.5,
    y_offset=0.5)
point_2 = Point(point)
dispatch_2 = Dispatch(List=divide_curve.Points, DispatchPattern=larger_than.LargerThan)  # -> ListA, ListB
unit_z_2 = UnitZ(Factor=graph_mapper)
multiplication = Multiplication(A=unit_z_2, B=Slider(12.66, range=0..23))
vector_2pt = Vector2Pt(PointA=point_2, PointB=dispatch_2.ListB, Unitize=False)  # -> Vector, Length
amplitude = Amplitude(Vector=vector_2pt.Vector, Amplitude=multiplication)
move = Move(Geometry=point_2, Motion=multiplication)  # -> Geometry, Transform
move_2 = Move(Geometry=point_2, Motion=amplitude)  # -> Geometry, Transform
move_3 = Move(Geometry=point_2, Motion=expr("-x", amplitude))  # -> Geometry, Transform
circle_3pt_2 = Circle3Pt(PointA=move.Geometry, PointB=move_2.Geometry, PointC=move_3.Geometry)  # -> Circle, Plane, Radius
list_item = ListItem(List=circle_3pt_2.Circle, Index=point_groups.Indices, Wrap=True)
loft = Loft(Curves=list_item, Options={Adjust=False, Closed=False, LoftEnds=0, LoftSimp=0, LoftType=0, Rebuild=10, Refit=0.01})
settings_custom = SettingsCustom(
    StitchSeams=True,
    SimplePlanes=True,
    Refine=True,
    MinCount=16,
    MaxCount=400,
    AspectRatio=Slider(1.528, range=0..20),
    MaxDistance=0,
    MaxAngle=20,
    MinEdge=Slider(10.5, range=2..100),
    MaxEdge=0)
mesh_brep = MeshBrep(Brep=loft, Settings=settings_custom)  # -> simplify(Mesh)
triangulate = Triangulate(Mesh=mesh_brep)  # -> Mesh, Count
deconstruct_mesh = DeconstructMesh(Mesh=triangulate.Mesh)  # -> Vertices, Faces, Colours, Normals
list_length_2 = ListLength(List=deconstruct_mesh.Faces)
multiplication_2 = Multiplication(A=list_length_2, B=Slider(0.778, range=0..1))
reduce_mesh = ReduceMesh(Mesh=mesh_brep, FaceCount=multiplication_2, Accuracy=1, FaceType=0, Distort=True, Normalize=False)  # -> Reduced, CountDifference
clean_tree = CleanTree(RemoveNulls=True, RemoveInvalid=True, RemoveEmpty=True, Tree=reduce_mesh.Reduced)
close_mesh = CloseMesh(Mesh=clean_tree, Quadrangulate=True)  # -> Closed, Amount, Openings, ResultBoolean
geometry_2 = Geometry(extrude)
cap_holes = CapHoles(Brep=geometry_2)
geometry_3 = Geometry(close_mesh.Closed)
deconstruct_mesh_2 = DeconstructMesh(Mesh=geometry_3)  # -> Vertices, Faces, Colours, Normals
list_length_3 = ListLength(List=deconstruct_mesh_2.Vertices)
random = Random(Range="-1 to 1", Number=list_length_3, Seed=Slider(4, range=0..10))
random_2 = Random(Range="-1 to 1", Number=list_length_3, Seed=2)
vector_xyz = VectorXYZ(XComponent=random_2, YComponent=random, ZComponent=0)  # -> Vector, Length
multiplication_3 = Multiplication(A=vector_xyz.Vector, B=Slider(2.063, range=0..10))
move_4 = Move(Geometry=deconstruct_mesh_2.Vertices, Motion=multiplication_3)  # -> Geometry, Transform
construct_mesh = ConstructMesh(Vertices=move_4.Geometry, Faces=deconstruct_mesh_2.Faces)
mesh_edges = MeshEdges(Mesh=construct_mesh)  # -> NakedEdges, InteriorEdges, NonManifoldEdges
pipe = Pipe(Curve=mesh_edges.InteriorEdges, Radius=Slider(0.15, range=0..1), Caps=0)
