# Grasshopper definition 210317_GrasshopperpossiblePrimitives.gh (Grasshopper 1.0.7)
# plug-ins: BitmapComponent, Bifocals

point = Point(Point(6.972817833, 11.29838436, 0))
circle = Circle({Plane=PlaneXY(9.552693776, 11.22153902, 0), Radius=2.817515174})
curve = Curve()
plane = Plane(Plane(origin=(13.09030142, 12.52044153, 0), x=(0.7071067812, 0.7071067812, 0), y=(-0.6734648454, 0.6734648454, 0.304778943)))
box = Box({Plane=PlaneXY(5.556933317, 10.15469269, 0), X=Domain(0, 5.40931017), Y=Domain(0, 4.506044209), Z=Domain(0, 3.24629019)})
mesh = Mesh()
surface = Surface()
field = Field()
group = Group()
point_2 = Point(Point(4.47741194, 4.242250293, 0))
point_3 = Point(Point(12.52018966, 17.23769864, 0))
point_4 = Point(Point(20.20437018, -0.6550079909, 0))
point_5 = Point(Point(7.319761321, -10.29761034, 0))
point_6 = Point(Point(-3.517492292, 6.06380936, 9.637148745))
point_7 = Point([Point(-9.071148799, 14.17835104, 0), Point(4.095504506, 27.34500435, 0), Point(20.97571589, 10.46479296, 0), Point(22.59008924, -6.529992271, 0)])
point_8 = Point(Point(10.10665403, 12.0309449, 0))
plane_2 = Plane(PlaneXY(12.34427258, 12.72282097, 0))
vector = Vector(Vector(2.622533241, 4.992744357, 0))
circular_arc = CircularArc({Angle=0, Angle=1.407279081, Plane=Plane(origin=(7.159357641, 10.54232571, 0), x=(0.7071067812, 0.7071067812, 0), y=(-0.7071067812, 0.7071067812, 0)), Radius=6.131321751})
rectangle = Rectangle({Plane=PlaneXY(6.724129914, 10.90065482, 0), Size=Domain2(u=-4.998418634..4.998418634, v=-2.915388611..2.915388611)})
brep = Brep()
twisted_box = TwistedBox({C=Point(7.463346147, 13.24397264, 0), C=Point(15.67789672, 13.24397264, 0), C=Point(15.67789672, 19.45280697, 0), C=Point(4.851452726, 19.45280697, 0), C=Point(7.463346147, 13.24397264, 7.475197904), C=Point(15.67789672, 13.24397264, 7.475197904), C=Point(15.67789672, 22.25392353, 7.475197904), C=Point(1.270597044, 22.25392353, 7.475197904)})
transform = Transform()
line = Line(Line((10.68309804, 9.760509164, 0), (13.9341802, 14.54164381, 0)))
mesh_face = MeshFace()
geometry = Geometry()
point_9 = Point(Point(12.52018966, 17.23769864, 0))
point_10 = Point(Point(20.20437018, -0.6550079909, 0))
point_11 = Point(Point(7.319761321, -10.29761034, 0))
point_12 = Point(Point(-3.517492292, 6.06380936, 9.637148745))
center_box = CenterBox(Base=PlaneXY(0, 0, 0), X=Slider(4, range=0..10), Y=Slider(4, range=0..10), Z=Slider(5.36, range=0..10))
_4point_surface = _4PointSurface(CornerA=point_3, CornerB=point_4, CornerC=point_5, CornerD=point_6)
mesh_sphere = MeshSphere(Base=point_2, Radius=Slider(10, range=0..10), UCount=Slider(5, range=0..10), VCount=Slider(5, range=0..10))
polyline = PolyLine(Vertices=point_7, Closed=True)
construct_point = ConstructPoint(XCoordinate=Slider(2.92, range=0..10), YCoordinate=Slider(2.94, range=0..10), ZCoordinate=Slider(2, range=0..10))
construct_plane = ConstructPlane(Origin=point_8, XAxis="0,5,0", YAxis="1,6,8")
group_2 = Group(Objects=[point_9, point_10, point_11, point_12])
circle_2 = Circle(Plane=plane_2, Radius=Slider(6, range=0..10))
construct_point_2 = ConstructPoint(XCoordinate=Slider(2, range=0..10), YCoordinate=Slider(2, range=0..10), ZCoordinate=Slider(10, range=0..10))
group_3 = Group(group_2)
mesh_2 = Mesh(mesh_sphere)
point_13 = Point(construct_point)
circle_3 = Circle(circle_2)
curve_2 = Curve(polyline)
plane_3 = Plane(construct_plane)
box_2 = Box(center_box)
surface_2 = Surface(_4point_surface)
boolean = Boolean(True)
number = Number(12.123)
colour = Colour(RGB(145, 65, 65))
culture = Culture(1031)
domain² = Domain²(Domain2(u=0.2..1.3, v=0.1..1.2))
data = Data(34)
file_path = FilePath("D:\Desktop\001.JPG")
bitmap = Bitmap(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)
matrix = Matrix()
ungroup = Ungroup(Group=group_3)
panel = Panel(plane_3)
panel_2 = Panel(curve_2)
panel_3 = Panel(box_2)
panel_4 = Panel(circle_3)
panel_5 = Panel(mesh_2)
panel_6 = Panel(point_13)
panel_7 = Panel(surface_2)
panel_8 = Panel(ungroup)
integer = Integer(5)
text = Text("Hello world")
complex = Complex({imaginary=0, real=-5})
domain = Domain(Domain(1, 6))
guid = Guid()
time = Time(637516263060000000)
data_path = DataPath("{6;6}")
shader = Shader()
point_14 = Point(construct_point_2)
construct_plane_2 = ConstructPlane(Origin=point_14, XAxis="0,5,0", YAxis="1,6,8")
point_15 = Point(Point(-4.563048933, 10.06376908, 0))
point_16 = Point(Point(8.392649842, 5.819204411, 5.635570127))
point_17 = Point(Point(14.02060645, 6.58590425, 2.213630369))
point_18 = Point(Point(-4.563048933, 10.06376908, 0))
point_19 = Point(Point(8.392649842, 5.819204411, 5.635570127))
point_20 = Point(Point(3.731572055, 10.06376908, 0))
point_21 = Point(Point(14.02060645, 6.58590425, 2.213630369))
sphere = Sphere(Base=PlaneXY(0, 0, 0), Radius=1)
plane_4 = Plane(Plane(origin=(10.10665403, 12.0309449, 0), x=(0, 1, 0), y=(0.1240347346, 0, 0.9922778767)))
point_22 = Point(Point(7.813818375, 24.01485643, 0))
point_23 = Point(Point(18.13694568, 15.18927481, 0))
point_24 = Point(Point(7.365576956, 14.27330287, 0))
point_25 = Point(Point(-0.9712891546, 16.94010538, 0))
point_26 = Point(Point(14.61314792, 22.58226444, 10.73438791))
point_27 = Point(Point(13.54598993, 15.9812282, 11.75041003))
point_28 = Point(Point(7.684078679, 13.50329437, 13.0798411))
point_29 = Point(Point(7.073907298, 18.638462, 13.1768218))
radians = Panel("1.5")
arc_3pt = Arc3Pt(PointA=point_15, PointB=point_16, PointC=point_17)  # -> Arc, Plane, Radius
plane_5 = Plane(Plane(origin=(10.10665403, 12.0309449, 0), x=(0, 1, 0), y=(0.1240347346, 0, 0.9922778767)))
box_3 = Box({Plane=PlaneXY(-0.1932996182, 7.475791977, 0), X=Domain(0, 11.34497286), Y=Domain(0, 8.471706136), Z=Domain(0, 3.40312594)})
vector_2pt = Vector2Pt(PointA=point_18, PointB=point_19, Unitize=False)  # -> Vector, Length
plane_6 = Plane(construct_plane_2)
mesh_brep = MeshBrep(
    Brep=sphere,
    Settings={GridMaxCount=0, GridMinCount=16, JaggedSeams=False, MaxEdgeLength=0, MinEdgeLength=0.0001, MinTolerance=0, Refine=True, RefineAngle=0, RelativeTolerance=0.65, SimplePlanes=True, Tolerance=0})
line_2 = Line(Line((10.72368632, 10.19292498, 0), (10.72368632, -6.908767464, 0)))
box_4 = Box({Plane=PlaneXY(26.45710561, 2.005603321, 0), X=Domain(0, 7.549110831), Y=Domain(0, 10.61659641), Z=Domain(0, 4.714329552)})
line_3 = Line(Line((11.0815543, 33.43381797, 0), (11.0815543, 14.4302306, 0)))
twisted_box_2 = TwistedBox(
    CornerA=point_22,
    CornerB=point_23,
    CornerC=point_24,
    CornerD=point_25,
    CornerE=point_26,
    CornerF=point_27,
    CornerG=point_28,
    CornerH=point_29)
line_4 = Line(StartPoint=point_20, EndPoint=point_21)
rotate = Rotate(Geometry=line_2, Angle=radians, Plane=PlaneXY(0, 0, 0))  # -> Geometry, Transform
rectangle_2 = Rectangle(Plane=plane_4, XSize=Slider(23, range=0..100), YSize=Slider(23, range=0..100), Radius=Slider(2.105, range=0..10))  # -> Rectangle, Length
deconstruct_mesh = DeconstructMesh(Mesh=mesh_brep)  # -> Vertices, Faces, Colours, Normals
center_box_2 = CenterBox(Base=plane_6, X=Slider(4, range=0..10), Y=Slider(4, range=0..10), Z=Slider(4, range=0..10))
vector_2 = Vector(vector_2pt.Vector)
circular_arc_2 = CircularArc(arc_3pt.Arc)
line_5 = Line(line_4)
rectangle_3 = Rectangle(rectangle_2.Rectangle)
brep_2 = Brep([box_3, plane_5])
mesh_face_2 = MeshFace(deconstruct_mesh.Faces)
twisted_box_3 = TwistedBox(twisted_box_2)
geometry_2 = Geometry([line_3, box_4])
transform_2 = Transform(rotate.Transform)
box_5 = Box(center_box_2)
panel_9 = Panel(vector_2)
panel_10 = Panel(circular_arc_2)
panel_11 = Panel(rectangle_3)
panel_12 = Panel(line_5)
panel_13 = Panel(twisted_box_3)
panel_14 = Panel(brep_2)
panel_15 = Panel(mesh_face_2)
geometry_3 = Geometry(box_5)
panel_16 = Panel(transform_2)
panel_17 = Panel(geometry_2)
brep_3 = Brep(geometry_3)
deconstruct_brep = DeconstructBrep(Brep=brep_3)  # -> Faces, Edges, Vertices
curve_3 = Curve(deconstruct_brep.Edges)
series = Series(Start=0, Step=1, Count=Slider(9, range=0..10))
end_points = EndPoints(Curve=curve_3)  # -> Start, End
twisted_box_4 = TwistedBox({C=Point(7.813818375, 24.01485643, 0), C=Point(18.13694568, 15.18927481, 0), C=Point(7.365576956, 14.27330287, 0), C=Point(-0.9712891546, 16.94010538, 0), C=Point(14.61314792, 22.58226444, 10.73438791), C=Point(13.54598993, 15.9812282, 11.75041003), C=Point(7.684078679, 13.50329437, 13.0798411), C=Point(7.073907298, 18.638462, 13.1768218)})
construct_matrix = ConstructMatrix(Rows=3, Columns=3, Values=series)
colour_2 = Colour(RGB(178, 100, 100))
matrix_2 = Matrix({0;0=0, 0;1=1, 0;2=2, 1;0=3, 1;1=4, 1;2=5, 2;0=6, 2;1=7, 2;2=8, columns=3, rows=3})
construct_domain² = ConstructDomain²(UMin=Slider(2, range=0..10), UMax=Slider(2, range=0..10), VMin=Slider(2.8, range=0..10), VMax=Slider(2, range=0..10))
colour_picker = ColourPicker(PickedColour=RGBA(161, 124, 124, 183))
merge = Merge(Data1=matrix_2, Data2=twisted_box_4, Data3=colour_2)  # -> flatten(Result)
point_30 = Point(end_points.End)
display_matrix = DisplayMatrix(construct_matrix)

boolean_2 = Boolean(Toggle(True))
text_2 = Text("2.5")
panel_18 = Panel(boolean_2)
panel_19 = Panel(text_2)
addition = Addition(A=boolean_2, B=Slider(0.52, range=0..1))
integer_2 = Integer(boolean_2)
number_2 = Number(text_2)
panel_20 = Panel(integer_2)
panel_21 = Panel(number_2)
number_3 = Number(integer_2)
addition_2 = Addition(A=number_3, B=Slider(0.44, range=0..1))
integer_3 = Integer(number_2)
panel_22 = Panel(addition_2)
panel_23 = Panel(integer_3)
domain_2 = Domain(addition_2)
text_3 = Text(addition_2)
boolean_3 = Boolean(integer_3)
data_2 = Data(domain_2)
panel_24 = Panel(boolean_3)
panel_25 = Panel(text_3)
panel_26 = Panel(data_2)

deconstruct = Deconstruct(Point=point_30)  # -> XComponent, YComponent, ZComponent
data_3 = Data(merge)
bitmap_2 = Bitmap(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)
number_4 = Number(Slider(7.27, range=0..10))
colour_3 = Colour(colour_picker)
culture_2 = Culture(1041)
domain²_2 = Domain²(construct_domain²)
file_path_2 = FilePath("C:\Advanced_Topics\19112_python.py")
boolean_4 = Boolean(Toggle(False))
matrix_3 = Matrix(construct_matrix)
number_5 = Number(deconstruct.XComponent)
number_6 = Number(deconstruct.ZComponent)
number_7 = Number(deconstruct.YComponent)
panel_27 = Panel(boolean_4)
panel_28 = Panel(colour_3)
panel_29 = Panel(number_4)
panel_30 = Panel(data_3)
panel_31 = Panel(matrix_3)
panel_32 = Panel(file_path_2)
panel_33 = Panel(bitmap_2)
panel_34 = Panel(domain²_2)
panel_35 = Panel(culture_2)
construct_point_3 = ConstructPoint(XCoordinate=number_5, YCoordinate=number_7, ZCoordinate=number_6)
series_2 = Series(Start=0, Step=1, Count=Slider(4, range=0..10))
list_item = ListItem(List=construct_point_3, Index=series_2, Wrap=True)
polyline_2 = PolyLine(Vertices=list_item, Closed=True)
list_item_2 = ListItem(List=construct_point_3, Index="4", Wrap=True)
list_item_3 = ListItem(List=construct_point_3, Index="3", Wrap=True)
colour_picker_2 = ColourPicker(PickedColour=RGB(112, 73, 73))
construct_domain = ConstructDomain(DomainStart=Slider(4.07, range=0..10), DomainEnd=Slider(2, range=0..10))
series_3 = Series(Start=0, Step=1, Count=Slider(1, range=0..10))  # -> graft(Series)
series_4 = Series(Start=0, Step=1, Count=Slider(5, range=0..10))  # -> graft(Series)
rectangle_4 = Rectangle(polyline_2)
construct_time = ConstructTime(Hour=Slider(100, range=0..100), Minute=Slider(19, range=0..100), Second=Slider(19, range=0..100))
vector_2pt_2 = Vector2Pt(PointA=list_item_3, PointB=list_item_2, Unitize=False)  # -> Vector, Length
multiplication = Multiplication(A=series_4, B=series_3)
param_viewer = ParamViewer(multiplication)
box_rectangle = BoxRectangle(Rectangle=rectangle_4, Height=vector_2pt_2.Length)
integer_4 = Integer(Slider(4, range=0..10))
text_4 = Text("Hello World!")
time_2 = Time(construct_time)
shader_2 = Shader(colour_picker_2)
domain_3 = Domain(construct_domain)
guid_2 = Guid("14a94467-4254-4ce6-bdb3-42723859d746")
data_path_2 = DataPath(param_viewer)
panel_36 = Panel(time_2)
panel_37 = Panel(data_path_2)
panel_38 = Panel(shader_2)
panel_39 = Panel(integer_4)
panel_40 = Panel(domain_3)
panel_41 = Panel(guid_2)
panel_42 = Panel(text_4)
