# Grasshopper definition 210327_Ethereum Logo.gh (Grasshopper 1.0.7)

number_slider = Slider(8.06, range=0..11)
point = Point([Point(-2.437595406, 67.45058265, 0), Point(55.21198989, 78.28049855, 0), Point(31.62840651, 13.48633922, 0)])
construct_plane = ConstructPlane(Origin=point, XAxis=Vector(1, 0, 0), YAxis=Vector(0, 1, 0))
construct_domain = ConstructDomain(DomainStart=number_slider, DomainEnd=expr("-x", number_slider))
number_slider_2 = Slider(3, range=0..10)
deconstruct_plane = DeconstructPlane(Plane=construct_plane)  # -> Origin, XAxis, YAxis, ZAxis
list_length = ListLength(List=deconstruct_plane.XAxis)
x_distance = Slider(5.18, range=0..10)
series = Series(Start=0, Step=Slider(0, range=0..10), Count=10)
z_distance = Slider(6.43, range=0..10)
z_distance_2 = Slider(0, range=0..10)
cluster = Cluster(point=point, vector=deconstruct_plane.XAxis, number=series, factor=z_distance)  # -> geometry, geometry_2
cluster_2 = Cluster_2(point=point, vector=deconstruct_plane.YAxis, number=x_distance, factor=z_distance_2)  # -> geometry, geometry_2
unit_z = UnitZ(Factor=Slider(-10.51, range=-30..30))
move = Move(Geometry=point, Motion=unit_z)  # -> Geometry, Transform
point_2 = Point(cluster.geometry_2)
point_3 = Point(cluster_2.geometry_2)
point_4 = Point(cluster_2.geometry)
point_5 = Point(cluster.geometry)
_4point_surface = _4PointSurface(CornerA=point_5, CornerB=point_3, CornerC=move.Geometry)
_4point_surface_2 = _4PointSurface(CornerA=point_2, CornerB=point_3, CornerC=move.Geometry)
_4point_surface_3 = _4PointSurface(CornerA=point_5, CornerB=point_4, CornerC=move.Geometry)
_4point_surface_4 = _4PointSurface(CornerA=point_2, CornerB=point_4, CornerC=move.Geometry)
_4point_surface_5 = _4PointSurface(CornerA=point_2, CornerB=point_3, CornerC=move.Geometry)
_4point_surface_6 = _4PointSurface(CornerA=point_2, CornerB=point_4, CornerC=point_3)
_4point_surface_7 = _4PointSurface(CornerA=point_5, CornerB=point_4, CornerC=point_3)
merge = Merge(
    Data1=_4point_surface_3,
    Data2=_4point_surface_4,
    Data3=_4point_surface_5,
    Data4=_4point_surface_2,
    Data5=_4point_surface,
    Data6=_4point_surface_7,
    Data7=_4point_surface_6)

# ==== cluster Cluster
factor = ClusterInput()
number = ClusterInput()
vector = ClusterInput()
point = ClusterInput()
vector_2 = Vector(vector)
number_2 = Number(number)
point_2 = Point(point)
amplitude = Amplitude(Vector=vector_2, Amplitude=number_2)
amplitude_2 = Amplitude(Vector=vector_2, Amplitude=expr("-x", number_2))
unit_z = UnitZ(Factor=factor)
addition = Addition(A=amplitude, B=unit_z)
addition_2 = Addition(A=amplitude_2, B=unit_z)
move = Move(Geometry=point_2, Motion=addition)  # -> Geometry, Transform
geometry = ClusterOutput(move.Geometry)
move_2 = Move(Geometry=point_2, Motion=addition_2)  # -> Geometry, Transform
geometry_2 = ClusterOutput(move_2.Geometry)

# ==== cluster Cluster_2
vector = ClusterInput()
number = ClusterInput()
point = ClusterInput()
vector_2 = Vector(vector)
number_2 = Number(number)
point_2 = Point(point)
factor = ClusterInput()
amplitude = Amplitude(Vector=vector_2, Amplitude=number_2)
amplitude_2 = Amplitude(Vector=vector_2, Amplitude=expr("-x", number_2))
unit_z = UnitZ(Factor=factor)
addition = Addition(A=amplitude, B=unit_z)
addition_2 = Addition(A=amplitude_2, B=unit_z)
move = Move(Geometry=point_2, Motion=addition)  # -> Geometry, Transform
move_2 = Move(Geometry=point_2, Motion=addition_2)  # -> Geometry, Transform
geometry = ClusterOutput(move.Geometry)
geometry_2 = ClusterOutput(move_2.Geometry)
