# Grasshopper definition 210327_NFT Ethereum Logo.gh (Grasshopper 1.0.7)
# plug-ins: Human, Bifocals

number_slider = Slider(541.48, range=0..11100)
number_slider_2 = Slider(3000, range=0..6000)
rectangle = Rectangle(Plane=PlaneXY(0, 0, 0), XSize=number_slider_2, YSize=number_slider_2, Radius=0)  # -> Rectangle, Length
box_rectangle = BoxRectangle(Rectangle=rectangle.Rectangle, Height=number_slider_2)
populate_3d = Populate3D(Region=box_rectangle, Count=Slider(1000, range=0..1000), Seed=1)
point = Point(Point(965.0181535, 168.9098508, 1706.770129))
construct_plane = ConstructPlane(Origin=populate_3d, XAxis=Vector(1, 0, 0), YAxis=Vector(0, 1, 0))
line = Line(StartPoint=point, EndPoint=populate_3d)
align_plane = AlignPlane(Plane=construct_plane, Direction=line)  # -> Plane, Angle
adjust_plane = AdjustPlane(Plane=align_plane.Plane, Normal=line)
deconstruct_plane = DeconstructPlane(Plane=adjust_plane)  # -> Origin, XAxis, YAxis, ZAxis
negative = Negative(Value=deconstruct_plane.ZAxis)
construct_plane_2 = ConstructPlane(Origin=deconstruct_plane.Origin, XAxis=deconstruct_plane.YAxis, YAxis=negative)  # -> graft(Plane)
construct_plane_3 = ConstructPlane(Origin=construct_plane_2, XAxis=Vector(1, 0, 0), YAxis=Vector(0, 1, 0))  # -> graft(Plane)
list_length = ListLength(List=flatten(construct_plane_2))
series = Series(Start=Slider(7, range=0..10), Step=Slider(0.749, range=0..10), Count=list_length)  # -> graft(Series)
difference_height = Slider(77.1, range=0..120)
difference_height_2 = Slider(11.12, range=0..120)
thicckness = Slider(66.54, range=0..120)
thicckness_2 = Slider(23.35, range=0..120)
range = Range(Domain=difference_height, Steps=expr("x-1", list_length))  # -> graft(Range)
range_2 = Range(Domain=difference_height_2, Steps=expr("x-1", list_length))  # -> graft(Range)
range_3 = Range(Domain=thicckness, Steps=expr("x-1", list_length))  # -> graft(Range)
range_4 = Range(Domain=thicckness_2, Steps=expr("x-1", list_length))  # -> graft(Range)
jitter = Jitter(List=range, Jitter=1, Seed=Slider(5, range=0..10))  # -> Values, Indices
should_be_at_1 = Slider(2, range=0.01..2)
should_be_2 = Slider(2, range=0..10)
buttom_size = Slider(-41.32, range=-50..30)
jitter_2 = Jitter(List=range_4, Jitter=1, Seed=Slider(2, range=0..10))  # -> Values, Indices
jitter_3 = Jitter(List=range_3, Jitter=1, Seed=Slider(4, range=0..10))  # -> Values, Indices
cluster = Cluster_2(number=jitter_3.Values, plane=construct_plane_2, factor=jitter.Values, number_2=jitter_2.Values, amplitude=buttom_size)
cluster_2 = Cluster_4(
    plane=construct_plane_2,
    number_6=jitter_3.Values,
    number_5=jitter_2.Values,
    number_3=difference_height_2,
    number=jitter.Values,
    B=should_be_2,
    value=buttom_size,
    B_2=should_be_at_1)
surface = Surface(cluster_2)
range_5 = Range(Domain=Domain(0, 1), Steps=expr("x-2", list_length))
number_slider_3 = Slider(0.9, range=0..10)
brep_join = BrepJoin(Breps=cluster)  # -> Breps, Closed
fillet = Fillet()
gradient = Gradient(
    LowerLimit=0,
    UpperLimit=1,
    Parameter=range_5,
    stops=[0: RGB(243, 57, 0), 0.1: RGB(236, 27, 60), 0.2: RGB(210, 0, 118), 0.3: RGB(103, 0, 120), 0.4: RGB(39, 72, 161), 0.5: RGB(1, 192, 229), 0.6: RGB(18, 178, 90), 0.7: RGB(79, 186, 8), 0.8: RGB(220, 237, 32), 0.9: RGB(247, 159, 20)])
brep_join_2 = BrepJoin(Breps=surface)  # -> Breps, Closed
dispatch = Dispatch(List=gradient, DispatchPattern=[True, False])  # -> ListA, ListB
create_modify_materials = CreateModifyMaterials(Name=gradient, Diffuse=gradient, Specular=dispatch.ListB, Gloss="0.5")
mesh_brep = MeshBrep(
    Brep=brep_join_2.Breps,
    Settings={GridMaxCount=0, GridMinCount=16, JaggedSeams=False, MaxEdgeLength=0, MinEdgeLength=0.0001, MinTolerance=0, Refine=True, RefineAngle=0, RelativeTolerance=0.65, SimplePlanes=True, Tolerance=0})
custom_preview = CustomPreview(Geometry=flatten(mesh_brep), Material=gradient)
mesh_brep_2 = MeshBrep(
    Brep=brep_join.Breps,
    Settings={GridMaxCount=0, GridMinCount=16, JaggedSeams=False, MaxEdgeLength=0, MinEdgeLength=0.0001, MinTolerance=0, Refine=True, RefineAngle=0, RelativeTolerance=0.65, SimplePlanes=True, Tolerance=0})
custom_preview_2 = CustomPreview(Geometry=flatten(mesh_brep_2), Material=gradient)
createattributes = CreateAttributes(Color=create_modify_materials, MaterialName=create_modify_materials, enableFullPath=False)
button = Button()
bake_geometry = BakeGeometry(Bake=button, Geometry=flatten(mesh_brep), Attributes=createattributes, DeleteOldBakes=False, PreserveTrees=False)
bake_geometry_2 = BakeGeometry(Bake=button, Geometry=flatten(mesh_brep_2), Attributes=createattributes, DeleteOldBakes=False, PreserveTrees=False)

# ==== cluster Cluster_2
plane = ClusterInput()
deconstruct_plane = DeconstructPlane(Plane=plane)  # -> Origin, XAxis, YAxis, ZAxis
number = ClusterInput()
number_2 = ClusterInput()
point = Point(plane)
factor = ClusterInput()
panel = Panel(number)
cluster = Cluster(vector=deconstruct_plane.ZAxis, point=plane, vector_2=deconstruct_plane.XAxis, number=number, amplitude=factor)  # -> geometry, geometry_2
cluster_2 = Cluster(vector=deconstruct_plane.ZAxis, point=plane, vector_2=deconstruct_plane.YAxis, number=number_2, amplitude="0")  # -> geometry, geometry_2
amplitude = ClusterInput()
amplitude_2 = Amplitude(Vector=deconstruct_plane.ZAxis, Amplitude=amplitude)
move = Move(Geometry=plane, Motion=amplitude_2)  # -> Geometry, Transform
point_2 = Point(cluster.geometry_2)
point_3 = Point(cluster_2.geometry_2)
point_4 = Point(cluster_2.geometry)
point_5 = Point(cluster.geometry)
_4point_surface = _4PointSurface(CornerA=point_5, CornerB=point_4, CornerC=move.Geometry)
_4point_surface_2 = _4PointSurface(CornerA=point_5, CornerB=point_3, CornerC=move.Geometry)
_4point_surface_3 = _4PointSurface(CornerA=point_2, CornerB=point_4, CornerC=move.Geometry)
_4point_surface_4 = _4PointSurface(CornerA=point_2, CornerB=point_3, CornerC=move.Geometry)
_4point_surface_5 = _4PointSurface(CornerA=point_2, CornerB=point_4, CornerC=point_3)
_4point_surface_6 = _4PointSurface(CornerA=point_5, CornerB=point_4, CornerC=point_3)
merge = Merge(
    Data1=_4point_surface,
    Data2=_4point_surface_3,
    Data3=_4point_surface_4,
    Data4=_4point_surface_2,
    Data5=_4point_surface_6,
    Data6=_4point_surface_5)
result = ClusterOutput(merge)

# ==== cluster Cluster_4
number = ClusterInput()
plane = ClusterInput()
number_2 = Number(number)
number_3 = ClusterInput()
B = ClusterInput()
deconstruct_plane = DeconstructPlane(Plane=plane)  # -> Origin, XAxis, YAxis, ZAxis
number_4 = Number(number_3)
multiplication = Multiplication(A=number_2, B=B)
addition = Addition(A=number_4, B=multiplication)
addition_2 = Addition(A=number_2, B=number_4)
unit_z = UnitZ(Factor=addition)
amplitude = Amplitude(Vector=deconstruct_plane.ZAxis, Amplitude=number_4)
amplitude_2 = Amplitude(Vector=deconstruct_plane.ZAxis, Amplitude=addition)
unit_z_2 = UnitZ(Factor=1)
value = ClusterInput()
absolute = Absolute(Value=value)
move = Move(Geometry=deconstruct_plane.Origin, Motion=amplitude_2)  # -> Geometry, Transform
move_2 = Move(Geometry=deconstruct_plane.Origin, Motion=amplitude)  # -> Geometry, Transform
addition_3 = Addition(A=number_2, B=absolute)
B_2 = ClusterInput()
number_5 = ClusterInput()
number_6 = ClusterInput()
point = Point(move.Geometry)
multiplication_2 = Multiplication(A=addition_3, B=B_2)
cluster = Cluster_3(vector_2=deconstruct_plane.ZAxis, point=point, vector=deconstruct_plane.YAxis, number=number_5, factor="0")  # -> geometry, geometry_2
cluster_2 = Cluster_3(
    vector_2=deconstruct_plane.ZAxis,
    point=deconstruct_plane.Origin,
    vector=deconstruct_plane.XAxis,
    number=number_6,
    factor=addition_2)  # -> geometry, geometry_2
amplitude_3 = Amplitude(Vector=deconstruct_plane.ZAxis, Amplitude=multiplication_2)
point_2 = Point(move_2.Geometry)
point_3 = Point(cluster_2.geometry)
point_4 = Point(cluster_2.geometry_2)
move_3 = Move(Geometry=point_2, Motion=amplitude_3)  # -> Geometry, Transform
point_5 = Point(cluster.geometry)
point_6 = Point(cluster.geometry_2)
_4point_surface = _4PointSurface(CornerA=point_3, CornerB=point_5, CornerC=point_2)
_4point_surface_2 = _4PointSurface(CornerA=point_4, CornerB=point_5, CornerC=point_2)
_4point_surface_3 = _4PointSurface(CornerA=point_4, CornerB=point_6, CornerC=point_2)
_4point_surface_4 = _4PointSurface(CornerA=point_3, CornerB=point_6, CornerC=point_2)
_4point_surface_5 = _4PointSurface(CornerA=point_3, CornerB=point_5, CornerC=move_3.Geometry)
_4point_surface_6 = _4PointSurface(CornerA=point_4, CornerB=point_5, CornerC=move_3.Geometry)
_4point_surface_7 = _4PointSurface(CornerA=point_4, CornerB=point_6, CornerC=move_3.Geometry)
_4point_surface_8 = _4PointSurface(CornerA=point_3, CornerB=point_6, CornerC=move_3.Geometry)
merge = Merge(
    Data1=_4point_surface,
    Data2=_4point_surface_2,
    Data3=_4point_surface_3,
    Data4=_4point_surface_4,
    Data5=_4point_surface_5,
    Data6=_4point_surface_6,
    Data7=_4point_surface_7,
    Data8=_4point_surface_8)
result = ClusterOutput(merge)

# ==== cluster Cluster
vector = ClusterInput()
vector_2 = ClusterInput()
number = ClusterInput()
point = ClusterInput()
vector_3 = Vector()
vector_4 = Vector(vector_2)
number_2 = Number(number)
point_2 = Point(point)
amplitude = ClusterInput()
deconstruct_plane = DeconstructPlane(Plane=point)  # -> Origin, XAxis, YAxis, ZAxis
amplitude_2 = Amplitude(Vector=vector_4, Amplitude=number_2)
amplitude_3 = Amplitude(Vector=vector_4, Amplitude=expr("-x", number_2))
amplitude_4 = Amplitude(Vector=vector, Amplitude=amplitude)
panel = Panel(deconstruct_plane.ZAxis)
addition = Addition(A=amplitude_2, B=amplitude_4)
addition_2 = Addition(A=amplitude_3, B=amplitude_4)
move = Move(Geometry=point_2, Motion=addition)  # -> Geometry, Transform
move_2 = Move(Geometry=point_2, Motion=addition_2)  # -> Geometry, Transform
geometry = ClusterOutput(move.Geometry)
geometry_2 = ClusterOutput(move_2.Geometry)

# ==== cluster Cluster_3
vector = ClusterInput()
number = ClusterInput()
point = ClusterInput()
vector_2 = ClusterInput()
vector_3 = Vector(vector)
number_2 = Number(number)
point_2 = Point(point)
factor = ClusterInput()
amplitude = Amplitude(Vector=vector_2, Amplitude=factor)
amplitude_2 = Amplitude(Vector=vector_3, Amplitude=number_2)
amplitude_3 = Amplitude(Vector=vector_3, Amplitude=expr("-x", number_2))
unit_z = UnitZ(Factor=factor)
addition = Addition(A=amplitude_2, B=amplitude)
addition_2 = Addition(A=amplitude_3, B=amplitude)
move = Move(Geometry=point_2, Motion=addition)  # -> Geometry, Transform
move_2 = Move(Geometry=point_2, Motion=addition_2)  # -> Geometry, Transform
geometry = ClusterOutput(move.Geometry)
geometry_2 = ClusterOutput(move_2.Geometry)
