# Grasshopper definition 210423_Copacabana.gh (Grasshopper 1.0.7)
# plug-ins: Pufferfish, Bifocals

blocksize = Slider(7, range=2..100)
amount_blocks = Slider(10, range=0..10)
count = Slider(4, range=0..10)
curve = Curve(<curve referenced from the Rhino model>)
point = Point(Point(68.58191654, 18.29611587, 0))
divide_length = DivideLength(Curve=curve, Length=blocksize)  # -> Points, Tangents, Parameters
series = Series(Start=0, Step=amount_blocks, Count=count)
cull_index = CullIndex(List=divide_length.Points, Indices="0", Wrap=True)
offset_curve_loose = OffsetCurveLoose(Curve=curve, Distance=series, Plane=point)
line = Line(StartPoint=point, EndPoint=cull_index)
shift_list = ShiftList(List=offset_curve_loose, Shift=1, Wrap=False)
extend_curve = ExtendCurve(Curve=line, Type=0, Start="0", End=Slider(1100, range=0..1100))
ruled_surface = RuledSurface(CurveA=offset_curve_loose, CurveB=shift_list)
surface_split = SurfaceSplit(Surface=ruled_surface, Curves=extend_curve)
blocksize_2 = Slider(2.39, range=0..10)
blocksize_3 = Slider(3.42, range=0..10)
randomness_blocksize = Slider(0.31, range=0..1)
curve_2 = Curve(flatten(surface_split))
clean_tree = CleanTree(RemoveNulls=True, RemoveInvalid=True, RemoveEmpty=False, Tree=curve_2)
construct_domain = ConstructDomain(DomainStart=expr("-x", blocksize_2), DomainEnd=expr("-x", blocksize_3))
list_length = ListLength(List=clean_tree)
range = Range(Domain=construct_domain, Steps=expr("x-1", list_length))
jitter = Jitter(List=range, Jitter=randomness_blocksize, Seed=2)  # -> Values, Indices
offset = Slider(1.55, range=-10..11)
offset_2 = Slider(0.53, range=-10..11)
offset_curve_loose_2 = OffsetCurveLoose(Curve=clean_tree, Distance=jitter.Values)
construct_domain_2 = ConstructDomain(DomainStart=Slider(16, range=0..100), DomainEnd=Slider(28, range=0..100))
list_length_2 = ListLength(List=offset_curve_loose_2)
addition = Addition(A=jitter.Values, B=offset)  # -> graft(Result)
addition_2 = Addition(A=jitter.Values, B=offset_2)  # -> graft(Result)
range_2 = Range(Domain=construct_domain_2, Steps=expr("x-1", list_length_2))
construct_domain_3 = ConstructDomain(DomainStart=addition, DomainEnd=addition_2)
divide_curve = DivideCurve(Curve=offset_curve_loose_2, Count=range_2, Kinks=False)  # -> Points, Tangents, Parameters
shatter = Shatter(Curve=graft(offset_curve_loose_2), Parameters=divide_curve.Parameters)
list_length_3 = ListLength(List=shatter)
range_3 = Range(Domain=construct_domain_3, Steps=expr("x-1", list_length_3))
list_item = ListItem(List=range_3, Index=0, Wrap=True)
multiplication = Multiplication(A=list_item, B=1000)
jitter_2 = Jitter(List=range_3, Jitter=Slider(1, range=0..1), Seed=multiplication)  # -> Values, Indices
offset_curve = OffsetCurve(Curve=shatter, Distance=jitter_2.Values, Plane=PlaneXY(0, 0, 0), Corners=1)
trim_tree = TrimTree(Tree=offset_curve, Depth=1)
end_points = EndPoints(Curve=shatter)  # -> Start, End
end_points_2 = EndPoints(Curve=trim_tree)  # -> Start, End
line_2 = Line(StartPoint=end_points_2.End, EndPoint=end_points.End)
line_3 = Line(StartPoint=end_points_2.Start, EndPoint=end_points.Start)
merge = Merge(
    Data1=simplify(graft(trim_tree)),
    Data2=simplify(graft(line_3)),
    Data3=simplify(graft(shatter)),
    Data4=simplify(graft(line_2)))
join_curves = JoinCurves(Curves=merge, Preserve=False)  # -> simplify(flatten(Curves))
curve_self = CurveSelf(Curve=join_curves)  # -> Points, Params
list_length_4 = ListLength(List=curve_self.Points)
larger_than = LargerThan(FirstNumber=list_length_4, SecondNumber="1")  # -> LargerThan, OrEqualTo
dispatch = Dispatch(List=join_curves, DispatchPattern=flatten(larger_than.LargerThan))  # -> ListA, ListB
geometry = Geometry(dispatch.ListB)
area = Area(Geometry=geometry)  # -> Area, Centroid
distance = Distance(PointA=area.Centroid, PointB=point)
one_over_x = OneOverX(Value=distance)
multiplication_2 = Multiplication(A=one_over_x, B=Slider(200, range=0..10000))
unit_z = UnitZ(Factor=multiplication_2)
jitter_3 = Jitter(List=unit_z, Jitter=Slider(0.2, range=0..1), Seed=2)  # -> Values, Indices
extrude = Extrude(Base=geometry, Direction=jitter_3.Values)  # disabled
offset_mesh = OffsetMesh(Mesh=geometry, Distance=jitter_3.Values, BothSides=True, CreateSolid=True)
cap_holes = CapHoles(Brep=extrude)  # disabled
mesh_join = MeshJoin(Meshes=flatten(offset_mesh))
mesh_brep = MeshBrep(
    Brep=cap_holes,
    Settings={GridMaxCount=0, GridMinCount=16, JaggedSeams=False, MaxEdgeLength=0, MinEdgeLength=0.0001, MinTolerance=0, Refine=True, RefineAngle=0, RelativeTolerance=0.65, SimplePlanes=True, Tolerance=0})  # disabled
mesh_join_2 = MeshJoin(Meshes=mesh_brep)  # disabled
custom_preview = CustomPreview(Geometry=mesh_join, Material="white")
