# Grasshopper definition 210424_Contours.gh (Grasshopper 1.0.7)

input_surface = Surface(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)
base_plane_contour = Curve(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)
contour_distance = Slider(26, range=0..50)
buildingarea = Geometry(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)

bounding_box = BoundingBox(Content=input_surface, Plane=PlaneXY(0, 0, 0))  # -> Box, Box_2
deconstruct_box = DeconstructBox(Box=bounding_box.Box_2)  # -> Plane, X, Y, Z
deconstruct_domain = DeconstructDomain(Domain=deconstruct_box.Z)  # -> Start, End
unit_z = UnitZ(Factor=1)
unit_z_2 = UnitZ(Factor=deconstruct_domain.Start)
move = Move(Geometry=input_surface, Motion=expr("-x", unit_z_2))  # -> Geometry, Transform
project = Project(Curve=base_plane_contour, Brep=move.Geometry, Direction=unit_z)
surface_split = SurfaceSplit(Surface=move.Geometry, Curves=project)
list_item = ListItem(List=surface_split, Index=Slider(1, range=0..1), Wrap=True)
brep_edges = BrepEdges(Brep=list_item)  # -> Naked, Interior, NonManifold
project_2 = Project(Geometry=brep_edges.Naked, Plane=PlaneXY(0, 0, 0))  # -> Geometry, Transform
ruled_surface = RuledSurface(CurveA=project_2.Geometry, CurveB=brep_edges.Naked)
boundary_surfaces = BoundarySurfaces(Edges=project_2.Geometry)
merge = Merge(Data1=list_item, Data2=ruled_surface, Data3=boundary_surfaces)  # -> flatten(Result)
unit_z_3 = UnitZ(Factor=1)
brep_join = BrepJoin(Breps=merge)  # -> Breps, Closed
contour = Contour(Shape=brep_join.Breps, Point=Point(0, 0, 0), Direction=unit_z_3, Distance=contour_distance)
tree_statistics = TreeStatistics(Tree=contour)  # -> Paths, Length, Count
list_length = ListLength(List=tree_statistics.Length)
series = Series(Start=0, Step=contour_distance, Count=list_length)
unit_z_4 = UnitZ(Factor=series)
move_2 = Move(Geometry=buildingarea, Motion=graft(unit_z_4))  # -> Geometry, Transform
region_intersection = RegionIntersection(CurvesA=contour, CurvesB=move_2.Geometry)
region_difference = RegionDifference(CurvesA=contour, CurvesB=move_2.Geometry)
project_3 = Project(Geometry=region_difference, Plane=PlaneXY(0, 0, 0))  # -> Geometry, Transform
bounding_box_2 = BoundingBox(Content=project_3.Geometry, Plane=PlaneXY(0, 0, 0), UnionBox=True)  # -> Box, Box_2
deconstruct_box_2 = DeconstructBox(Box=bounding_box_2.Box)  # -> Plane, X, Y, Z
deconstruct_domain_2 = DeconstructDomain(Domain=deconstruct_box_2.X)  # -> Start, End
subtraction = Subtraction(A=deconstruct_domain_2.End, B=deconstruct_domain_2.Start)
absolute = Absolute(Value=subtraction)
mass_addition = MassAddition(Input=flatten(absolute))  # -> Result, PartialResults
unit_x = UnitX(Factor=graft(mass_addition.PartialResults))
boundary_surfaces_2 = BoundarySurfaces(Edges=region_difference)
boundary_surfaces_3 = BoundarySurfaces(Edges=region_intersection)

move_3 = Move(Geometry=project_3.Geometry, Motion=unit_x)  # -> Geometry, Transform
custom_preview = CustomPreview(Geometry=boundary_surfaces_2, Material="gray")
custom_preview_2 = CustomPreview(Geometry=boundary_surfaces_3, Material="green")
