# Grasshopper definition 210730_GATES.gh (Grasshopper 1.0.7)
# plug-ins: Human

# ---- group: Input Circles
geometry = Geometry([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, <curve referenced from the Rhino model>, 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])

# ---- group: input rectangle
geometry_2 = Geometry(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)

# ----
boundary_surfaces = BoundarySurfaces(Edges=geometry)
area = Area(Geometry=boundary_surfaces)  # -> Area, Centroid
custom_preview_lineweights = CustomPreviewLineweights(Geometry=geometry_2, Shader="black", Thickness=Slider(3, range=0..10), Absolute=False)
square_root = SquareRoot(Value=area.Area)
unit_z = UnitZ(Factor=square_root)
point_in_curve = PointInCurve(Point=area.Centroid, Curve=geometry_2)  # -> Relationship, Point
larger_than = LargerThan(FirstNumber=square_root, SecondNumber=Slider(130, range=0..130))  # -> LargerThan, OrEqualTo
equality = Equality(FirstNumber=point_in_curve.Relationship, SecondNumber="2")  # -> IsInside, Inequality
extrude = Extrude(Base=boundary_surfaces, Direction=unit_z)
gate_not = GateNot(A=larger_than.LargerThan)
gate_not_2 = GateNot(A=equality.IsInside)
gate_and = GateAnd(A=larger_than.LargerThan, B=equality.IsInside)
gate_or = GateOr(A=larger_than.LargerThan, B=equality.IsInside)
gate_xor = GateXor(A=equality.IsInside, B=larger_than.LargerThan)
gate_xnor = GateXnor(A=larger_than.LargerThan, B=equality.IsInside)
gate_nand = GateNand(A=larger_than.LargerThan, B=equality.IsInside)
gate_nor = GateNor(A=equality.IsInside, B=larger_than.LargerThan)

# ----
# Logic Gates
# isInside NOT
# isBig NOT
# isInside?
# is Big?
# XNOR
# NAND
# XOR
# NOR
# AND
# OR
number_slider = Slider(1, range=0..10)

isbig = Panel("""0
0
1
1""")
isbig_2 = Data(isbig)
isinside = Panel("""0
1
0
1""")
isinside_2 = Data(isinside)
cluster = Cluster(data=isbig_2, gate=number_slider, data_2=isinside_2)
integer = Integer(cluster)
stream_filter = StreamFilter(
    Gate=number_slider,
    Stream0=larger_than.LargerThan,
    Stream1=equality.IsInside,
    Stream2=gate_not,
    Stream3=gate_not_2,
    Stream4=gate_and,
    Stream5=gate_or,
    Stream6=gate_xor,
    Stream7=gate_xnor,
    Stream8=gate_nand,
    Stream9=gate_nor)
result = Panel(integer)
dispatch = Dispatch(List=extrude, DispatchPattern=stream_filter)  # -> ListA, ListB
custom_preview = CustomPreview(Geometry=dispatch.ListA, Material=ColourSwatch(SwatchColor=RGB(53, 161, 55)))
custom_preview_2 = CustomPreview(Geometry=dispatch.ListB, Material=ColourSwatch(SwatchColor=RGB(161, 53, 53)))
gate_not_3 = GateNot(A=larger_than.LargerThan)
gate_and_2 = GateAnd(A=larger_than.LargerThan, B=equality.IsInside)
gate_or_2 = GateOr(A=larger_than.LargerThan, B=equality.IsInside)
gate_xor_2 = GateXor(A=equality.IsInside, B=larger_than.LargerThan)
gate_xnor_2 = GateXnor(A=larger_than.LargerThan, B=equality.IsInside)
gate_nand_2 = GateNand(A=larger_than.LargerThan, B=equality.IsInside)
gate_nor_2 = GateNor(A=equality.IsInside, B=larger_than.LargerThan)

# ==== cluster Cluster
gate = ClusterInput()
data = ClusterInput()
data_2 = ClusterInput()
data_3 = Data(data)
data_4 = Data(data_2)
gate_not = GateNot(A=data_3)
gate_not_2 = GateNot(A=data_4)
gate_and = GateAnd(A=data_3, B=data_4)
gate_or = GateOr(A=data_3, B=data_4)
gate_xor = GateXor(A=data_3, B=data_4)
gate_xnor = GateXnor(A=data_3, B=data_4)
gate_nand = GateNand(A=data_3, B=data_4)
gate_nor = GateNor(A=data_3, B=data_4)
stream_filter = StreamFilter(
    Gate=gate,
    Stream0=data_3,
    Stream1=data_4,
    Stream2=gate_not,
    Stream3=gate_not_2,
    Stream4=gate_and,
    Stream5=gate_or,
    Stream6=gate_xor,
    Stream7=gate_xnor,
    Stream8=gate_nand,
    Stream9=gate_nor)
s_1 = ClusterOutput(stream_filter)
