# Grasshopper definition 210804_MVRDV Couch.gh (Grasshopper 1.0.7)
# plug-ins: Bifocals

x_size_box = Slider(7.33, range=0..110)
y_size_box = Slider(9.29, range=0..110)
construct_point = ConstructPoint(XCoordinate=0, YCoordinate=0, ZCoordinate=0)
overall_couch_size_stairs = Slider(24.6, range=0..100)
unit_x = UnitX(Factor=x_size_box)
couch_start = Slider(1.7, range=0..10)
move = Move(Geometry=construct_point, Motion=unit_x)  # -> Geometry, Transform
unit_x_2 = UnitX(Factor=overall_couch_size_stairs)
rectangle = Rectangle(Plane=construct_point, XSize=x_size_box, YSize=y_size_box, Radius=0)  # -> Rectangle, Length
unit_x_3 = UnitX(Factor=couch_start)
line_sdl = LineSDL(Start=move.Geometry, Direction=unit_x_2, Length=overall_couch_size_stairs)
move_2 = Move(Geometry=move.Geometry, Motion=unit_x_2)  # -> Geometry, Transform
rectangle_2 = Rectangle(Plane=move_2.Geometry, XSize=x_size_box, YSize=y_size_box, Radius=0)  # -> Rectangle, Length
negative = Negative(Value=unit_x_3)
move_3 = Move(Geometry=move_2.Geometry, Motion=unit_x)  # -> Geometry, Transform
move_4 = Move(Geometry=move.Geometry, Motion=unit_x_3)  # -> Geometry, Transform
move_5 = Move(Geometry=move.Geometry, Motion=expr("x/2", unit_x_2))  # -> Geometry, Transform
move_6 = Move(Geometry=move_2.Geometry, Motion=negative)  # -> Geometry, Transform
number_slider = Slider(3.73, range=0..10)
box_rectangle = BoxRectangle(Rectangle=rectangle.Rectangle, Height=number_slider)
box_rectangle_2 = BoxRectangle(Rectangle=rectangle_2.Rectangle, Height=number_slider)
unit_y = UnitY(Factor=y_size_box)
merge = Merge(
    Data1=construct_point,
    Data2=move.Geometry,
    Data3=move_4.Geometry,
    Data4=move_5.Geometry,
    Data5=move_6.Geometry,
    Data6=move_2.Geometry,
    Data7=move_3.Geometry)
unit_z = UnitZ(Factor=number_slider)
move_7 = Move(Geometry=merge, Motion=unit_z)  # -> Geometry, Transform
move_8 = Move(Geometry=move_7.Geometry, Motion=unit_y)  # -> Geometry, Transform
number_slider_2 = Slider(2, range=0..10)
cluster = Cluster(data="3", data_2=move_8.Geometry, factor=Slider(2.72, range=0..10))
cluster_2 = Cluster_2(data="3", data_2=move_7.Geometry, factor=Slider(-2.81, range=-5..10))
interpolate = Interpolate(Degree=3, Periodic=False, KnotStyle=1)  # -> Curve, Length, Domain
nurbs_curve = NurbsCurve(Vertices=cluster_2, Degree=number_slider_2, Periodic=False)  # -> Curve, Length, Domain
nurbs_curve_2 = NurbsCurve(Vertices=cluster, Degree=number_slider_2, Periodic=False)  # -> Curve, Length, Domain
point_list = PointList(Points=cluster_2, Size=Slider(3, range=0..10))
ruled_surface = RuledSurface(CurveA=nurbs_curve_2.Curve, CurveB=nurbs_curve.Curve)
unit_z_2 = UnitZ(Factor=Slider(0.59, range=0..10))
number_slider_3 = Slider(0.25, range=0..1)
extrude = Extrude(Base=ruled_surface, Direction=unit_z_2)
data_dam = DataDam(DataA=extrude, BufferDelay=10000000, BufferMode=0)
unit_z_3 = UnitZ(Factor=number_slider_3)
contour = Contour(Shape=data_dam, Point=Point(0, 0, 0), Direction=Vector(0, 0, 1), Distance=number_slider_3)
boundary_surfaces = BoundarySurfaces(Edges=contour)
extrude_2 = Extrude(Base=boundary_surfaces, Direction=unit_z_3)
custom_preview = CustomPreview(Geometry=extrude_2, Material=ColourSwatch(SwatchColor=RGB(255, 255, 255)))

# ==== cluster Cluster
factor = ClusterInput()
data = ClusterInput()
data_2 = ClusterInput()
data_3 = Data(data)
data_4 = Data(data_2)
unit_z = UnitZ(Factor=factor)
list_item = ListItem(List=data_4, Index=data_3, Wrap=True)
move = Move(Geometry=list_item, Motion=unit_z)  # -> Geometry, Transform
replace_items = ReplaceItems(List=data_4, Item=move.Geometry, Indices=data_3, Wrap=False)
list = ClusterOutput(replace_items)

# ==== cluster Cluster_2
data = ClusterInput()
data_2 = ClusterInput()
data_3 = Data(data)
data_4 = Data(data_2)
factor = ClusterInput()
unit_z = UnitZ(Factor=factor)
list_item = ListItem(List=data_4, Index=data_3, Wrap=True)
move = Move(Geometry=list_item, Motion=unit_z)  # -> Geometry, Transform
replace_items = ReplaceItems(List=data_4, Item=move.Geometry, Indices=data_3, Wrap=False)
list = ClusterOutput(replace_items)
