# Grasshopper definition 230228_GeometricShapes.gh (Grasshopper 1.0.7)

line = Line([Line((4.441989892, -8.38842987, 0), (1.934316495, 9.646479401, 0)), Line((-7.906220983, 0.5897999537, 0), (1.74584308, -7.694208989, 0)), Line((-2.171558161, 7.854565368, 0), (17.85072707, -4.209696029, 0)), Line((13.81925011, 5.13779948, 0), (-6.938481109, -6.6581523, 0)), Line((-9.911912915, 0.8722291293, 0), (8.821691443, 7.022124377, 0))])
rectangle = Rectangle({Plane=PlaneXY(1.922951761, 0.7210074299, 0), Size=Domain2(u=-6.861519467..6.861519467, v=-5.013237503..5.013237503)})
curvestart = Slider(0.77, range=0..1)
divider = Slider(10, range=0..100)
extension = Slider(3, range=0..10)
streetoffset = Slider(0.29, range=0..1)
smallest_length = Slider(1.83, range=0..10)
end_points = EndPoints(Curve=line)  # -> Start, End
polyline = PolyLine(Vertices=end_points.End, Closed=True)  # -> reparameterize(Polyline)
polyline_2 = PolyLine(Vertices=end_points.Start, Closed=True)  # -> reparameterize(Polyline)
shatter = Shatter(Curve=polyline_2, Parameters=curvestart)
shatter_2 = Shatter(Curve=polyline, Parameters=curvestart)
divide_curve = DivideCurve(Curve=shatter, Count=divider, Kinks=False)  # -> Points, Tangents, Parameters
divide_curve_2 = DivideCurve(Curve=shatter_2, Count=divider, Kinks=False)  # -> Points, Tangents, Parameters
line_2 = Line(StartPoint=divide_curve.Points, EndPoint=divide_curve_2.Points)
extend_curve = ExtendCurve(Curve=line_2, Type=0, Start=extension, End=extension)
surface_split = SurfaceSplit(Surface=rectangle, Curves=extend_curve)  # -> graft(Fragments)
offset_curve = OffsetCurve(Curve=surface_split, Distance=expr("-x", streetoffset), Corners=1)
length = Length(Curve=offset_curve)
explode = Explode(Curve=offset_curve, Recursive=True)  # -> Segments, Vertices
surface_closest_point = SurfaceClosestPoint(Point=explode.Vertices, Surface=surface_split)  # -> Point, UVPoint, Distance
mass_addition = MassAddition(Input=surface_closest_point.Distance)  # -> Result, PartialResults
curve_self = CurveSelf(Curve=offset_curve)  # -> Points, Params
larger_than = LargerThan(FirstNumber=length, SecondNumber=smallest_length)  # -> LargerThan, OrEqualTo
list_length = ListLength(List=curve_self.Points)
smaller_than = SmallerThan(FirstNumber=mass_addition.Result, SecondNumber="0.0001")  # -> SmallerThan, OrEqualTo
smaller_than_2 = SmallerThan(FirstNumber=list_length, SecondNumber="1")  # -> SmallerThan, OrEqualTo
pointonsurfacebooleans = Boolean(smaller_than.SmallerThan)
smalllengthbooleans = Boolean(larger_than.LargerThan)
intersectionbooleans = Boolean(smaller_than_2.SmallerThan)
param_viewer = ParamViewer(offset_curve)
gate_and = GateAnd(A=intersectionbooleans, B=pointonsurfacebooleans, C=smalllengthbooleans)
dispatch = Dispatch(List=param_viewer, DispatchPattern=flatten(gate_and))  # -> ListA, ListB
tree_branch = TreeBranch(Tree=offset_curve, Path=dispatch.ListA, MaintainPaths=True)
data = Data(tree_branch)
boundary_surfaces = BoundarySurfaces(Edges=data)
area = Area(Geometry=boundary_surfaces)  # -> Area, Centroid
unit_z = UnitZ(Factor=expr("x/10", area.Area))
extrude = Extrude(Base=boundary_surfaces, Direction=unit_z)
custom_preview = CustomPreview(Geometry=extrude, Material=ColourSwatch(SwatchColor=RGB(214, 170, 107)))
