# Grasshopper definition 230228_GeometricShapesWithVray.gh (Grasshopper 1.0.7)
# plug-ins: V-Ray For Grasshopper 7

v_ray_timeline = VRayTimeline(FramesCount=Slider(500, range=0..1000), RangeStart=0)  # -> Timeline, CurrentFrame, CurrentFraction

# ---- group: Inputs
inputlines = Line([Line((4.441989892, -8.38842987, 0), (1.934316495, 9.646479401, 0)), Line((-7.906220983, 0.5897999537, 0), (1.74584308, -7.694208989, 0)), Line((-2.171558161, 7.854565368, 0), (17.85072707, -4.209696029, 0)), Line((13.81925011, 5.13779948, 0), (-6.938481109, -6.6581523, 0)), Line((-9.911912915, 0.8722291293, 0), (8.821691443, 7.022124377, 0))])
input_rectangle_or_planar_shape = Rectangle({Plane=PlaneXY(1.922951761, 0.7210074299, 0), Size=Domain2(u=-6.861519467..6.861519467, v=-5.013237503..5.013237503)})

divider = Slider(8, range=0..100)
extension = Slider(20, range=0..20)
streetoffset = Slider(0.21, range=0..1)
smallest_length = Slider(1.83, range=0..10)

# ----
number = Number(expr("x*180", v_ray_timeline.CurrentFraction))
end_points = EndPoints(Curve=inputlines)  # -> Start, End
sine = Sine(Value=degrees(number))
number_2 = Number(expr("x/1.5", sine))
polyline = PolyLine(Vertices=end_points.End, Closed=True)  # -> reparameterize(Polyline)
polyline_2 = PolyLine(Vertices=end_points.Start, Closed=True)  # -> reparameterize(Polyline)
absolute = Absolute(Value=number_2)
shatter = Shatter(Curve=polyline_2, Parameters=v_ray_timeline.CurrentFraction)
shatter_2 = Shatter(Curve=polyline, Parameters=v_ray_timeline.CurrentFraction)
divide_curve = DivideCurve(Curve=shatter, Count=divider, Kinks=False)  # -> Points, Tangents, Parameters
divide_curve_2 = DivideCurve(Curve=shatter_2, Count=divider, Kinks=False)  # -> Points, Tangents, Parameters
line = Line(StartPoint=divide_curve.Points, EndPoint=divide_curve_2.Points)
extend_curve = ExtendCurve(Curve=line, Type=0, Start=extension, End=extension)
surface_split = SurfaceSplit(Surface=input_rectangle_or_planar_shape, Curves=extend_curve)  # -> graft(Fragments)
offset_curve = OffsetCurve(Curve=surface_split, Distance=expr("-x", absolute), Corners=1)
length = Length(Curve=offset_curve)
explode = Explode(Curve=offset_curve, Recursive=True)  # -> Segments, Vertices
surface_closest_point = SurfaceClosestPoint(Point=explode.Vertices, Surface=surface_split)  # -> Point, UVPoint, Distance
mass_addition = MassAddition(Input=surface_closest_point.Distance)  # -> Result, PartialResults
curve_self = CurveSelf(Curve=offset_curve)  # -> Points, Params
larger_than = LargerThan(FirstNumber=length, SecondNumber=smallest_length)  # -> LargerThan, OrEqualTo
list_length = ListLength(List=curve_self.Points)
smaller_than = SmallerThan(FirstNumber=mass_addition.Result, SecondNumber="0.0001")  # -> SmallerThan, OrEqualTo
smaller_than_2 = SmallerThan(FirstNumber=list_length, SecondNumber="1")  # -> SmallerThan, OrEqualTo
pointonsurfacebooleans = Boolean(smaller_than.SmallerThan)
smalllengthbooleans = Boolean(larger_than.LargerThan)
intersectionbooleans = Boolean(smaller_than_2.SmallerThan)
param_viewer = ParamViewer(offset_curve)
gate_and = GateAnd(A=intersectionbooleans, B=pointonsurfacebooleans, C=smalllengthbooleans)
dispatch = Dispatch(List=param_viewer, DispatchPattern=flatten(gate_and))  # -> ListA, ListB
tree_branch = TreeBranch(Tree=offset_curve, Path=dispatch.ListA, MaintainPaths=True)
data = Data(tree_branch)
settings_custom = SettingsCustom(
    StitchSeams=True,
    SimplePlanes=False,
    Refine=True,
    MinCount=16,
    MaxCount=400,
    AspectRatio=20,
    MaxDistance=0,
    MaxAngle=20,
    MinEdge=0,
    MaxEdge=Slider(0.4, range=0..1))
boundary_surfaces = BoundarySurfaces(Edges=data)
area = Area(Geometry=boundary_surfaces)  # -> Area, Centroid
number_slider = Slider(0.3, range=0..1)
number_slider_2 = Slider(2.01, range=0..10)
unit_z = UnitZ(Factor=expr("x/10", area.Area))
extrude = Extrude(Base=boundary_surfaces, Direction=unit_z)  # -> flatten(Extrusion)
mesh_brep = MeshBrep(Brep=extrude, Settings=settings_custom)
divide_curve_3 = DivideCurve(Curve=extend_curve, Count=Slider(222, range=0..1000), Kinks=False)  # -> Points, Tangents, Parameters
maximum = Maximum()
bounds = Bounds(Numbers=flatten(area.Area))
shatter_3 = Shatter(Curve=graft(extend_curve), Parameters=divide_curve_3.Parameters)
brep_edges = BrepEdges(Brep=extrude)  # -> Naked, Interior, NonManifold
minimum = Minimum(A=area.Area, B="15")
deconstruct_domain = DeconstructDomain(Domain=bounds)  # -> Start, End
gradient = Gradient(
    LowerLimit=0,
    UpperLimit=deconstruct_domain.End,
    Parameter=flatten(minimum),
    stops=[0: RGB(234, 38, 0), 0.25: RGB(234, 126, 0), 0.5: RGB(254, 244, 84), 0.75: RGB(173, 203, 249), 1: RGB(75, 107, 169)])
v_ray_material_preset = VRayMaterialPreset(Preset=1, MaterialBaseColorOrTexture=gradient)
dispatch_2 = Dispatch(List=shatter_3, DispatchPattern=[True, False])  # -> ListA, ListB
minimum_2 = Minimum(A=deconstruct_domain.End, B="15")
pipe = Pipe(Curve=[dispatch_2.ListA, brep_edges.Interior], Radius=Slider(0.01, range=0..0.1), Caps=0)
v_ray_geometry = VRayGeometry(Geo=mesh_brep, Material=v_ray_material_preset, quality=0)
colour_swatch = ColourSwatch(SwatchColor=RGB(0, 0, 0))
colour_swatch_2 = ColourSwatch(SwatchColor=RGB(214, 170, 107))
v_ray_material_simple = VRayMaterialSimple(
    Diffuse={AColor2=[0.5372549295, 0.5372549295, 0.5372549295, 1], FileName="", Float=0, State=2},
    Reflection=Slider(1, range=0..1),
    Glossiness={AColor2=[0, 0, 0, 0], FileName="", Float=0.8500000238, State=4},
    IOR=1.3,
    Opacity={AColor2=[0, 0, 0, 0], FileName="", Float=1, State=4},
    Emission={AColor2=[0, 0, 0, 1], FileName="", Float=0, State=2})
custom_preview = CustomPreview(Geometry=mesh_brep, Material=gradient)
custom_preview_2 = CustomPreview(Geometry=pipe, Material=colour_swatch)
point = Point([Point(-7.141428129, 8.127010127, 9.026391309), Point(12.53668192, 1.339019998, 6.412538744), Point(-0.7002165735, -8.251080782, 5.742176473)])
v_ray_material_preset_2 = VRayMaterialPreset(Preset=3, MaterialBaseColorOrTexture=colour_swatch)
number_slider_3 = Slider(111, range=0..1000)
panel = Panel("C:\Users\Michael\Desktop\220924_TestingGrasshoperAndVray\animation_11\animation_11.jpg")
shift_list = ShiftList(List=point, Shift=1, Wrap=True)
v_ray_infinite_plane = VRayInfinitePlane(Geo=v_ray_material_simple, ShadowCatcherOn=False, ZOffset=0, PositionFromGeometry=True)
v_ray_light_rig_dome = VRayLightRigDome(
    LightOn=True,
    Visible=True,
    Texture="C:\Program Files\Chaos Group\V-Ray\V-Ray for Rhinoceros\maps\Road_A.hdr",
    Intensity=1.4,
    Rotation=0,
    BackgroundIntensity=1)
line_2 = Line(StartPoint=shift_list, EndPoint=point)
v_ray_geometry_2 = VRayGeometry(Geo=pipe, Material=v_ray_material_preset_2, quality=0)
evaluate_curve = EvaluateCurve(Curve=reparameterize(line_2), Parameter=v_ray_timeline.CurrentFraction)  # -> Point, Tangent, Angle
v_ray_light_omni = VRayLightOmni(
    On=True,
    Position=evaluate_curve.Point,
    Color=RGB(255, 255, 255),
    Intensity=Slider(76, range=0..10000),
    ShadowSoftness=Slider(0.22, range=0..10))
v_ray_element_denoiser = VRayElementDenoiser(Engine=1, Preset=0)
merge = Merge(Data1=v_ray_infinite_plane, Data2=v_ray_geometry_2, Data3=v_ray_geometry)
panel_2 = Panel("""2000
2000""")
integer = Integer(panel_2)
v_ray_render = VRayRender(
    Engine=1,
    Mode=1,
    Quality=1,
    OutputImage=panel,
    OutputResolution=integer,
    LightRig=v_ray_light_rig_dome,
    Light=flatten(v_ray_light_omni),
    VGeometry=flatten(merge),
    Timeline=v_ray_timeline.Timeline,
    RenderElements=v_ray_element_denoiser,
    UpdateEffectsFrequency="0")
