# Grasshopper definition 230305_CircleThing.gh (Grasshopper 1.0.7)
# plug-ins: V-Ray For Grasshopper 7, Human

v_ray_timeline = VRayTimeline(FramesCount="500", RangeStart="18", RangeEnd=expr("x-1", "500"))  # -> Timeline, CurrentFrame, CurrentFraction
animation = Slider(1, range=0..1)
piece_amounts = Slider(69, range=0..100)
seed = Slider(100, range=0..100)
sizeextrusion = Slider(12, range=0..100)

# ---- group: Sizes
number_slider = Slider(20, range=0..20)
number_slider_2 = Slider(10, range=0..10)
number_slider_3 = Slider(5.688, range=0..10)
number_slider_4 = Slider(2.786, range=0..10)

# ----
graph_mapper = GraphMapper(
    v_ray_timeline.CurrentFraction,
    x0=0,
    x1=1,
    y0=0,
    y1=1,
    container_name="Gaussian",
    factor=0.2962318063,
    mean=0.5,
    sdev=0.2498549223)
graph_mapper_2 = GraphMapper(
    graph_mapper,
    x0=0,
    x1=1,
    y0=0,
    y1=1,
    amplitude=0.425437808,
    container_name="Perlin",
    decay=0.2712008953,
    frequency=0.2356604934,
    x_offset=0.5,
    y_offset=0.5)
graph_mapper_3 = GraphMapper(
    graph_mapper_2,
    x0=0,
    x1=1,
    y0=0,
    y1=1,
    amplitude=0.09857243299,
    container_name="Perlin",
    decay=0.3862970471,
    frequency=0.5,
    x_offset=0.5,
    y_offset=0.5)
distance_between_pieces = Data(graph_mapper_2)
graph_mapper_4 = GraphMapper(
    graph_mapper,
    x0=0,
    x1=1,
    y0=0,
    y1=1,
    amplitude=0.425437808,
    container_name="Perlin",
    decay=0.5195652246,
    frequency=0.1132988334,
    x_offset=0.5,
    y_offset=0.5)
geometry = Geometry([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])
unit_z = UnitZ(Factor=-0.05)
construct_domain = ConstructDomain(DomainStart=number_slider_3, DomainEnd=number_slider_4)
construct_domain_2 = ConstructDomain(DomainStart=number_slider_2, DomainEnd=number_slider)
random = Random(Range=Domain(0, 1), Number=piece_amounts, Seed=seed)
move = Move(Motion=unit_z)  # -> Geometry, Transform
range = Range(Domain=Domain(0, 1), Steps=expr("x-1", piece_amounts))

relay = Relay()
multiplication = Multiplication(A=relay, B="2")
modulus = Modulus(A=multiplication, B="1")
animation_2 = Data(modulus)
graph_mapper_5 = GraphMapper(animation_2, x0=0, x1=1, y0=0, y1=1, container_name="Gaussian", factor=0.2762159109, mean=0.5, sdev=0.1704373658)
multiplication_2 = Multiplication(A=graph_mapper_5, B=Slider(1, range=0..100))
unit_z_2 = UnitZ(Factor=multiplication_2)
move_2 = Move(Geometry=geometry, Motion=unit_z_2)  # -> Geometry, Transform
bounding_box = BoundingBox(Content=move_2.Geometry, Plane=PlaneXY(0, 0, 0), UnionBox=True)  # -> Box, Box_2
volume = Volume(Geometry=bounding_box.Box)  # -> Volume, Centroid
unit_z_3 = UnitZ(Factor=Slider(50, range=0..100))
move_3 = Move(Geometry=volume.Centroid, Motion=unit_z_3)  # -> Geometry, Transform
circle = Circle(Plane=move_3.Geometry, Radius=Slider(10, range=0..10))
evaluate_curve = EvaluateCurve(Curve=reparameterize(circle), Parameter=animation_2)  # -> Point, Tangent, Angle
line = Line(StartPoint=volume.Centroid, EndPoint=evaluate_curve.Point)
rotate_3d = Rotate3D(Geometry=move_2.Geometry, Angle=expr("x/5", graph_mapper_5), Center=Point(0, 0, 0), Axis=line)  # -> Geometry, Transform
rotate = Rotate(Geometry=rotate_3d.Geometry, Angle=graph_mapper_5, Plane=volume.Centroid)  # -> Geometry, Transform

random_2 = Random(Range=construct_domain_2, Number=piece_amounts, Seed=2)
random_3 = Random(Range=construct_domain, Number=piece_amounts, Seed=5)
random_4 = Random(Range=construct_domain, Number=piece_amounts, Seed=2)
sort_list = SortList(Keys=random, ValuesValuesA=random)  # -> Keys, ValuesValuesA

a_piece_of_the_orange_pie = Panel("0.2,0.2,0.2")
image_sampler = ImageSampler(
    a_piece_of_the_orange_pie,
    FilePath="C:\Users\Michael\Desktop\Bitcoin_logo-1024x1024.png",
    Filter="Colour",
    Interpolate=False,
    Umax=1,
    Umin=0,
    Vmax=1,
    Vmin=0,
    Wrap=1)
opposite_colour = ColourSwatch(SwatchColor=RGB(8, 108, 229))
bitcoin_colour = ColourSwatch(SwatchColor=RGB(247, 148, 27))
v_ray_material_simple = VRayMaterialSimple(
    Diffuse=opposite_colour,
    Reflection={AColor2=[1, 1, 1, 1], FileName="", Float=0, State=2},
    Glossiness={AColor2=[0, 0, 0, 0], FileName="", Float=0.9499999881, State=4},
    IOR=1.3,
    Opacity={AColor2=[0, 0, 0, 0], FileName="", Float=1, State=4},
    Emission={AColor2=[0, 0, 0, 1], FileName="", Float=0, State=2})
v_ray_material_preset = VRayMaterialPreset(Preset=4, MaterialBaseColorOrTexture=image_sampler)
split_argb = SplitARGB(Colour=image_sampler)  # -> Alpha, Red, Green, Blue
v_ray_infinite_plane = VRayInfinitePlane(Geo=move.Geometry, Mtl=v_ray_material_simple, ShadowCatcherOn=False, ZOffset=0, PositionFromGeometry=True)
colour_rgb_f = ColourRGBF(Alpha=1, Red=expr("1-x", split_argb.Red), Green=expr("1-x", split_argb.Green), Blue=expr("1-x", split_argb.Blue))

range_2 = Data(range)
xy_plane = XYPlane(Origin=Point(0, 0, 0))
expression = Expression(x=random_3, y=graph_mapper_4, z=random_4, Expression="x*(1-Abs(y))+y*z")
cull_index = CullIndex(List=range_2, Indices="-1", Wrap=True)
rotate_2 = Rotate(Geometry=xy_plane, Angle=expr("x*360", degrees(graph_mapper_3)), Plane=PlaneXY(0, 0, 0))  # -> Geometry, Transform
cull_index_2 = CullIndex(List=sort_list.ValuesValuesA, Indices="-1", Wrap=True)
expression_2 = Expression(x=cull_index_2, y=distance_between_pieces, z=cull_index, Expression="x*(1-Abs(y))+y*z")
circle_2 = Circle(Plane=rotate_2.Geometry, Radius=random_2)
circle_3 = Circle(Plane=rotate_2.Geometry, Radius=expression)
remove_end = BooleanToggle(True)
shift_list = ShiftList(List=expression_2, Shift=1, Wrap=remove_end)
shift_list_2 = ShiftList(List=expression_2, Shift=1, Wrap=remove_end)
evaluate_curve_2 = EvaluateCurve(Curve=reparameterize(graft(circle_3)), Parameter=graft(expression_2))  # -> Point, Tangent, Angle
evaluate_curve_3 = EvaluateCurve(Curve=reparameterize(graft(circle_2)), Parameter=graft(expression_2))  # -> Point, Tangent, Angle
evaluate_curve_4 = EvaluateCurve(Curve=reparameterize(graft(circle_3)), Parameter=graft(shift_list_2))  # -> Point, Tangent, Angle
evaluate_curve_5 = EvaluateCurve(Curve=reparameterize(graft(circle_2)), Parameter=graft(shift_list))  # -> Point, Tangent, Angle
line_2 = Line(StartPoint=evaluate_curve_2.Point, EndPoint=evaluate_curve_3.Point)
line_3 = Line(StartPoint=evaluate_curve_2.Point, EndPoint=evaluate_curve_4.Point)
line_4 = Line(StartPoint=evaluate_curve_3.Point, EndPoint=evaluate_curve_5.Point)
line_5 = Line(StartPoint=evaluate_curve_4.Point, EndPoint=evaluate_curve_5.Point)
merge = Merge(Data1=simplify(line_2), Data2=simplify(line_3), Data3=simplify(line_4), Data4=simplify(line_5))
join_curves = JoinCurves(Curves=merge, Preserve=False)
boundary_surfaces = BoundarySurfaces(Edges=join_curves)
area = Area(Geometry=boundary_surfaces)  # -> Area, Centroid
one_over_x = OneOverX(Value=area.Area)
multiplication_3 = Multiplication(A=one_over_x, B=sizeextrusion)
unit_z_4 = UnitZ(Factor=expr("x*0.75", multiplication_3))
extrude = Extrude(Base=boundary_surfaces, Direction=unit_z_4)  # -> flatten(Extrusion)
area_2 = Area(Geometry=extrude)  # -> Area, Centroid
cameraposition = Position(Point(4.307162679, -9.553027388, 20.69493306))
target_position = Point()
brep_edges = BrepEdges(Brep=extrude)  # -> Naked, Interior, NonManifold
originaltarget = Target(Point(0.08512871801, 0.01941809365, -0.5869785994))
bounds = Bounds(Numbers=area_2.Area)
number_slider_5 = Slider(0.053, range=0..1)
number_slider_6 = Slider(0.0984, range=0..0.1)
cluster = Cluster(point=originaltarget, point_2=target_position)
number_slider_7 = Slider(0.0499, range=0..0.1)
cluster_2 = Cluster_2(origin=cameraposition)
v_ray_material_preset_2 = VRayMaterialPreset(Preset=1, MaterialBaseColorOrTexture=ColourSwatch(SwatchColor=RGB(255, 255, 255)))
deconstruct_domain = DeconstructDomain(Domain=bounds)  # -> Start, End
pipe = Pipe(Curve=brep_edges.Interior, Radius=Slider(0.0015, range=0..0.1), Caps=1)
v_ray_material_preset_3 = VRayMaterialPreset(Preset=0, MaterialBaseColorOrTexture=ColourSwatch(SwatchColor=RGB(0, 0, 0)))
circle_4 = Circle(Plane=cluster_2, Radius=number_slider_5)
circle_5 = Circle(Plane=originaltarget, Radius=number_slider_5)
settings_custom = SettingsCustom(
    StitchSeams=True,
    SimplePlanes=False,
    Refine=True,
    MinCount=16,
    MaxCount=400,
    AspectRatio=20,
    MaxDistance=0,
    MaxAngle=20,
    MinEdge=number_slider_6,
    MaxEdge=number_slider_6)
simple_mesh = SimpleMesh(Brep=pipe)
gradient = Gradient(
    LowerLimit=deconstruct_domain.Start,
    UpperLimit=deconstruct_domain.End,
    Parameter=area_2.Area,
    stops=[0.1: RGB(247, 148, 27), 0.255: RGB(7, 107, 230), 0.426: RGB(247, 148, 27), 0.645: RGB(7, 107, 230), 0.824: RGB(247, 148, 27), 1: RGB(7, 107, 230)])
settings_speed = SettingsSpeed()
animation_3 = Data(Slider(1, range=0..1))
graph_mapper_6 = GraphMapper(animation_3, x0=0, x1=1, y0=0, y1=1, container_name="Gaussian", factor=0.4101447463, mean=0.5, sdev=0.1855079532)
custom_preview = CustomPreview(Geometry=extrude, Material=gradient)
mesh_brep = MeshBrep(Brep=pipe, Settings=settings_custom)
number = Number(expr("x*10", graph_mapper_6))
unit_z_5 = UnitZ(Factor=Slider(-0.01, range=-1..0))
evaluate_curve_6 = EvaluateCurve(Curve=reparameterize(circle_4), Parameter=expr("1-x", animation_3))  # -> Point, Tangent, Angle
number_2 = Number(expr("x*5", graph_mapper_6))
evaluate_curve_7 = EvaluateCurve(Curve=reparameterize(circle_5), Parameter=animation_3)  # -> Point, Tangent, Angle
scale = Scale(Geometry=rotate.Geometry, Center=Point(0, 0, 0), Factor=Slider(0.2, range=0..1))  # -> Geometry, Transform
mesh_join = MeshJoin(Meshes=flatten(mesh_brep))
v_ray_material_preset_4 = VRayMaterialPreset(Preset=2, MaterialBaseColorOrTexture=gradient)
v_ray_geometry = VRayGeometry(Geo=mesh_join, Material=v_ray_material_preset_3, quality=0)
sine = Sine(Value=number)
sine_2 = Sine(Value=number_2)
v_ray_material_simple_2 = VRayMaterialSimple(
    Diffuse={AColor2=[0.5372549295, 0.5372549295, 0.5372549295, 1], FileName="", Float=0, State=2},
    Reflection={AColor2=[0.5372549295, 0.5372549295, 0.5372549295, 1], FileName="", Float=0, State=2},
    Glossiness={AColor2=[0, 0, 0, 0], FileName="", Float=0.8500000238, State=4},
    IOR=1.3,
    Opacity={AColor2=[0, 0, 0, 0], FileName="", Float=1, State=4},
    Emission={AColor2=[0, 0, 0, 1], FileName="", Float=0, State=2})
modify_viewport = ModifyViewport(
    ViewportName="Perspective",
    CameraLocation=evaluate_curve_6.Point,
    CameraTarget=evaluate_curve_7.Point,
    AnimateRestore=False,
    RestoreFrames=10)
distance = Distance(PointA=originaltarget, PointB=evaluate_curve_6.Point)
move_4 = Move(Geometry=scale.Geometry, Motion=unit_z_5)  # -> Geometry, Transform
v_ray_infinite_plane_2 = VRayInfinitePlane(
    Geo=move_4.Geometry,
    Mtl=v_ray_material_preset_2,
    ShadowCatcherOn=False,
    ZOffset=Slider(2, range=-2..2),
    PositionFromGeometry=True)
addition = Addition(A=sine_2, B="26")
v_ray_material_preset_5 = VRayMaterialPreset(Preset=3, MaterialBaseColorOrTexture=bitcoin_colour)
custom_preview_2 = CustomPreview(Geometry=move_4.Geometry, Material=bitcoin_colour)
v_ray_camera = VRayCamera(
    Position=evaluate_curve_6.Point,
    Target=evaluate_curve_7.Point,
    FOV=addition,
    Tilt=expr("x*2", sine),
    OrthographicZoomFactor=0,
    PhysicalExposureOn=False,
    WhiteBalance=RGB(255, 255, 255),
    FNumber=Slider(16, range=0..16),
    ShutterSpeed1S=100,
    FilmSensitivity=625,
    AutoExposure=False,
    AutoWhiteBalance=False,
    DepthOfFieldFocus=distance)  # -> Camera, Angle, ExposureValue
v_ray_geometry_2 = VRayGeometry(Geo=move_4.Geometry, Material=v_ray_material_preset_5, quality=0)
v_ray_geometry_3 = VRayGeometry(Geo=extrude, Material=v_ray_material_preset_4, quality=0)
v_ray_element_denoiser = VRayElementDenoiser(Engine=1, Preset=0)
output_image = OutputImage(
    "C:\Users\Michael\Desktop\220924_TestingGrasshoperAndVray\animation_12\animation_12HighRes.png",
    File_Picker=1,
    File_Types="Portable Network Graphics (*.png)|*.png|Windows bitmap (*.bmp)|*.bmp|Targa Image (*.tga)|*.tga|Radiance High-Dynamyc Range (*.hdr)|*.hdr|Silicon Graphics (*.sgi; *.rgb; *.rgba)|*.sgi;*.rgb;*.rgba|JPEG image (*.jpg; *.jpeg)|*.jpg;*.jpeg|OpenEXR image (*.exr)|*.exr|SoftImage PICT (*.pic)|*.pic|Tagged image (*.tif; *.tiff)|*.tif;*.tiff|Tiled mipmapped image file (*.tx)|*.tx|V-Ray Raw Image (*.vrimg)|*.vrimg",
    Multiple_Files=False)
v_ray_light_rig_simple = VRayLightRigSimple(
    GradientOn=True,
    ReflectEnvironmentOn=True,
    GIOn=True,
    GIEnvironmentColor=RGB(204, 229, 255),
    LightOn=True,
    LightColor=RGB(255, 255, 255),
    LightAngle=Slider(416, range=0..1000),
    LightIntensity=1)
merge_2 = Merge(Data1=v_ray_geometry_3, Data2=v_ray_geometry_2, Data3=v_ray_infinite_plane_2, Data4=v_ray_geometry)
v_ray_render = VRayRender(
    Engine=1,
    Mode=1,
    Sampler=1,
    Quality=4,
    OutputImage=output_image,
    OutputResolution=[4000, 4000],
    Camera=v_ray_camera.Camera,
    LightRig=v_ray_light_rig_simple,
    VGeometry=flatten(merge_2),
    Timeline=v_ray_timeline.Timeline,
    RenderElements=v_ray_element_denoiser,
    UpdateEffectsFrequency=100)

# ==== cluster Cluster
point = ClusterInput()
point_2 = ClusterInput()
deconstruct = Deconstruct(Point=point)  # -> XComponent, YComponent, ZComponent
deconstruct_2 = Deconstruct(Point=point_2)  # -> XComponent, YComponent, ZComponent
merge = Merge(Data1=deconstruct.XComponent, Data2=deconstruct_2.XComponent)
merge_2 = Merge(Data1=deconstruct.YComponent, Data2=deconstruct_2.YComponent)
merge_3 = Merge(Data1=deconstruct.ZComponent, Data2=deconstruct_2.ZComponent)
average = Average(Input=merge)
average_2 = Average(Input=merge_2)
average_3 = Average(Input=merge_3)
construct_point = ConstructPoint(XCoordinate=average, YCoordinate=average_2, ZCoordinate=average_3)
point_3 = ClusterOutput(construct_point)

# ==== cluster Cluster_2
origin = ClusterInput()
xy_plane = XYPlane(Origin=origin)
flip_plane = FlipPlane(Plane=xy_plane, ReverseX=False, ReverseY=False, SwapAxes=True)
plane = ClusterOutput(flip_plane)
