# Grasshopper definition 230308_TwoSidedView.gh (Grasshopper 1.0.7)
# plug-ins: V-Ray For Grasshopper 7, Human

number_slider = Slider(-100, range=-100..100)
geometry = Geometry([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])
geometry_2 = Geometry([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])
number_slider_2 = Slider(5, range=0..10)
merge = Merge(Data1=geometry, Data2=geometry_2)
boundary_surfaces = BoundarySurfaces(Edges=geometry_2)
boundary_surfaces_2 = BoundarySurfaces(Edges=geometry)
bounding_box = BoundingBox(Content=merge, Plane=PlaneXY(0, 0, 0), UnionBox=True)  # -> Box, Box_2
unit_x = UnitX(Factor=number_slider)
unit_y = UnitY(Factor=expr("-x", number_slider))
populate_3d = Populate3D(Region=bounding_box.Box, Count=Slider(21000, range=0..21000), Seed=1)
extrude = Extrude(Base=boundary_surfaces, Direction=unit_x)
extrude_2 = Extrude(Base=boundary_surfaces_2, Direction=unit_y)
unit_z = UnitZ(Factor=-0.05)
move = Move(Motion=unit_z)  # -> Geometry, Transform

a_piece_of_the_orange_pie = Panel("0.2,0.2,0.2")
image_sampler = ImageSampler(
    a_piece_of_the_orange_pie,
    FilePath="C:\Users\Michael\Desktop\Bitcoin_logo-1024x1024.png",
    Filter="Colour",
    Interpolate=False,
    Umax=1,
    Umin=0,
    Vmax=1,
    Vmin=0,
    Wrap=1)
opposite_colour = ColourSwatch(SwatchColor=RGB(8, 108, 229))
bitcoin_colour = ColourSwatch(SwatchColor=RGB(247, 148, 27))
v_ray_material_simple = VRayMaterialSimple(
    Diffuse=opposite_colour,
    Reflection={AColor2=[1, 1, 1, 1], FileName="", Float=0, State=2},
    Glossiness={AColor2=[0, 0, 0, 0], FileName="", Float=0.9499999881, State=4},
    IOR=1.3,
    Opacity={AColor2=[0, 0, 0, 0], FileName="", Float=1, State=4},
    Emission={AColor2=[0, 0, 0, 1], FileName="", Float=0, State=2})
v_ray_material_preset = VRayMaterialPreset(Preset=4, MaterialBaseColorOrTexture=image_sampler)
split_argb = SplitARGB(Colour=image_sampler)  # -> Alpha, Red, Green, Blue
v_ray_infinite_plane = VRayInfinitePlane(Geo=move.Geometry, Mtl=v_ray_material_simple, ShadowCatcherOn=False, ZOffset=0, PositionFromGeometry=True)
colour_rgb_f = ColourRGBF(Alpha=1, Red=expr("1-x", split_argb.Red), Green=expr("1-x", split_argb.Green), Blue=expr("1-x", split_argb.Blue))

point_in_brep = PointInBrep(Brep=extrude_2, Point=populate_3d, Strict=False)
point_in_brep_2 = PointInBrep(Brep=extrude, Point=populate_3d, Strict=False)
gate_and = GateAnd(A=point_in_brep, B=point_in_brep_2)
number_slider_3 = Slider(0.41, range=0..1)
dispatch = Dispatch(List=populate_3d, DispatchPattern=gate_and)  # -> ListA, ListB
point = Point(dispatch.ListA)
construct_domain = ConstructDomain(DomainStart=number_slider_3, DomainEnd=expr("-x", number_slider_3))
unit_z_2 = UnitZ(Factor=Slider(1.15, range=0..10))
bounding_box_2 = BoundingBox(Content=point, Plane=PlaneXY(0, 0, 0), UnionBox=True)  # -> Box, Box_2
volume = Volume(Geometry=bounding_box_2.Box)  # -> Volume, Centroid
number = Number(expr("x*2", number_slider_3))
construct_point = ConstructPoint(XCoordinate=0, YCoordinate=0, ZCoordinate=0)
rectangle = Rectangle(Plane=point, XSize=construct_domain, YSize=construct_domain, Radius=0)  # -> Rectangle, Length
unit_x_2 = UnitX(Factor=Slider(84, range=0..100))
box_rectangle = BoxRectangle(Rectangle=rectangle.Rectangle, Height=number)
number_slider_4 = Slider(0, range=0..10)
move_2 = Move(Geometry=volume.Centroid, Motion=unit_x_2)  # -> Geometry, Transform
deconstruct_brep = DeconstructBrep(Brep=bounding_box_2.Box)  # -> Faces, Edges, Vertices
deconstruct_brep_2 = DeconstructBrep(Brep=box_rectangle)  # -> Faces, Edges, Vertices
list_item = ListItem(List=deconstruct_brep.Faces, Index=Slider(4, range=0..10), Wrap=True)
area = Area(Geometry=list_item)  # -> Area, Centroid
scale = Scale(Center=Point(0, 0, 0), Factor=0.5)  # -> Geometry, Transform
unit_z_3 = UnitZ(Factor=Slider(-1, range=-4..0))
scale_nu = ScaleNU(Geometry=list_item, Plane=area.Centroid, ScaleX=Slider(5, range=0..100), ScaleY=Slider(7, range=0..100), ScaleZ=1)  # -> Geometry, Transform
panel = Panel("147")
number_slider_5 = Slider(53, range=0..100)
v_ray_timeline = VRayTimeline(FramesCount="500")  # -> Timeline, CurrentFrame, CurrentFraction
xz_plane = XZPlane(Origin=Point(0, 0, 0))
move_3 = Move(Geometry=scale_nu.Geometry, Motion=unit_z_3)  # -> Geometry, Transform
explode = Explode(Curve=move_3.Geometry, Recursive=True)  # -> Segments, Vertices
list_item_2 = ListItem(List=explode.Segments, Index=0, Wrap=True)
construct_domain_2 = ConstructDomain(DomainStart=number_slider_5, DomainEnd=expr("-x", number_slider_5))
curve_middle = CurveMiddle(Curve=list_item_2)
end_points = EndPoints(Curve=list_item_2)  # -> Start, End
number_slider_6 = Slider(100, range=0..100)
number_slider_7 = Slider(0.5, range=0..1)
yz_plane = YZPlane(Origin=curve_middle)
rectangle_2 = Rectangle(Plane=yz_plane, XSize=construct_domain_2, YSize=Slider(59, range=0..100), Radius=0)  # -> Rectangle, Length
range = Range(Domain=Slider(31, range=0..100), Steps=expr("x-1", number_slider_6))
populate_2d = Populate2D(Region=rectangle_2.Rectangle, Count=number_slider_6, Seed=1)
animation = Data(v_ray_timeline.CurrentFraction)
rectangle_2pt = Rectangle2Pt(Plane=yz_plane, PointA=end_points.Start, PointB=end_points.End, Radius=0)  # -> Rectangle, Length
voronoi_3d = Voronoi3D(Points=populate_2d)  # -> Cells, Boundary
deconstruct_brep_3 = DeconstructBrep(Brep=voronoi_3d.Cells)  # -> Faces, Edges, Vertices
series = Series(Start=0, Step=1, Count=10)
unit_y_2 = UnitY(Factor=1)
unit_x_3 = UnitX(Factor=range)
list_item_3 = ListItem(List=deconstruct_brep_3.Faces, Index=0, Wrap=True)
cameraposition = Position(move_2.Geometry)
voronoi = Voronoi(Points=populate_2d, BruteForceOverride=False)
target_position = Point()
originaltarget = Target(volume.Centroid)
v_ray_graph = VRayGraph(
    port=animation,
    Curve=[0, 0, 0.2878805307, 0.004661192699, 0.08106603378, 0.9900098688, 0.4549247546, 1.010669773, 0.5658048937, 1.010464325, 0.5410865169, 1.001252388, 0.6580251113, 1.007653536, 0.775120469, 1.016708052, 0.7701005202, 0.02237388609, 0.976073045, 0.0008582707863])
offset_surface = OffsetSurface(Surface=voronoi_3d.Cells, Distance=0, Retrim=True)
number_slider_8 = Slider(1, range=0..10)
cluster = Cluster(point=originaltarget, point_2=target_position)
trim_with_region = TrimWithRegion(Curve=voronoi, Region=rectangle_2.Rectangle, Plane=yz_plane)  # -> Inside, Outside
cluster_2 = Cluster_2(origin=cameraposition)
geometry_3 = Geometry(trim_with_region.Inside)
closed = Closed()  # -> Closed, Periodic
circle = Circle(Plane=cluster_2, Radius=number_slider_8)
circle_2 = Circle(Plane=originaltarget, Radius=number_slider_8)
explode_2 = Explode(Curve=trim_with_region.Inside, Recursive=True)  # -> Segments, Vertices
graph_mapper = GraphMapper(animation, x0=0, x1=1, y0=0, y1=1, container_name="Gaussian", factor=0.3049999475, mean=0.5, sdev=0.1285966635)
polyline = PolyLine(Vertices=explode_2.Vertices, Closed=True)  # -> flatten(Polyline)
boundary_surfaces_3 = BoundarySurfaces(Edges=polyline)
dispatch_2 = Dispatch(List=deconstruct_brep_2.Faces, DispatchPattern=[True, False])  # -> ListA, ListB
opposite_colour_2 = ColourSwatch(SwatchColor=RGB(91, 130, 94))
number_2 = Number(expr("x*12", graph_mapper))
evaluate_curve = EvaluateCurve(Curve=reparameterize(circle), Parameter=expr("1-x", animation))  # -> Point, Tangent, Angle
multiplication = Multiplication(A=v_ray_graph, B=Slider(90, range=0..100))
evaluate_curve_2 = EvaluateCurve(Curve=reparameterize(circle_2), Parameter=animation)  # -> Point, Tangent, Angle
extrude_3 = Extrude(Base=boundary_surfaces_3, Direction=unit_x_3)
move_4 = Move(Motion=Vector(0, 0, 10))  # -> Geometry, Transform
geometry_4 = Geometry(dispatch_2.ListA)
geometry_5 = Geometry(dispatch_2.ListB)
sine = Sine(Value=number_2)
panel_2 = Panel(sine)
rotate = Rotate(Geometry=geometry_4, Angle=degrees(multiplication), Plane=volume.Centroid)  # -> Geometry, Transform
colour_swatch = ColourSwatch(SwatchColor=RGB(255, 255, 255))
rotate_2 = Rotate(Geometry=geometry_5, Angle=degrees(multiplication), Plane=volume.Centroid)  # -> Geometry, Transform
modify_viewport = ModifyViewport(
    ViewportName="Perspective",
    CameraLocation=evaluate_curve.Point,
    CameraTarget=evaluate_curve_2.Point,
    AnimateRestore=False,
    RestoreFrames=10)
distance = Distance(PointA=originaltarget, PointB=evaluate_curve.Point)
custom_preview = CustomPreview(Geometry=rotate.Geometry, Material=bitcoin_colour)
custom_preview_2 = CustomPreview(Geometry=rotate_2.Geometry, Material=opposite_colour_2)
v_ray_camera = VRayCamera(
    Position=evaluate_curve.Point,
    Target=evaluate_curve_2.Point,
    FOV=26.99146652,
    Tilt=sine,
    OrthographicZoomFactor=0,
    PhysicalExposureOn=False,
    WhiteBalance=RGB(255, 255, 255),
    FNumber=Slider(16, range=0..20),
    ShutterSpeed1S=100,
    FilmSensitivity=625,
    AutoExposure=False,
    AutoWhiteBalance=False,
    DepthOfFieldFocus=distance)  # -> Camera, Angle, ExposureValue
v_ray_material_preset_2 = VRayMaterialPreset(Preset=1, MaterialBaseColorOrTexture=bitcoin_colour)
custom_preview_3 = CustomPreview(Geometry=extrude_3, Material=colour_swatch)
v_ray_material_preset_3 = VRayMaterialPreset(Preset=3, MaterialBaseColorOrTexture=opposite_colour_2)
v_ray_material_preset_4 = VRayMaterialPreset(Preset=0, MaterialBaseColorOrTexture=colour_swatch)
graph_mapper_2 = GraphMapper(animation, x0=0, x1=1, y0=0, y1=1, container_name="Gaussian", factor=0.2257714868, mean=0.5021901727, sdev=0.1604463756)
multiplication_2 = Multiplication(A=graph_mapper_2, B=Slider(100, range=0..100))
addition = Addition(A=graph_mapper_2, B=multiplication_2)
v_ray_element_denoiser = VRayElementDenoiser(Engine=1)
addition_2 = Addition(A=addition, B=Slider(625, range=0..1000))
v_ray_geometry = VRayGeometry(Geo=rotate.Geometry, Material=v_ray_material_preset_2, quality=0)
v_ray_geometry_2 = VRayGeometry(Geo=rotate_2.Geometry, Material=v_ray_material_preset_3, quality=0)
v_ray_geometry_3 = VRayGeometry(Geo=[extrude_3, move_3.Geometry], Material=v_ray_material_preset_4, quality=0)
v_ray_light_rig_simple = VRayLightRigSimple(
    GradientOn=True,
    ReflectEnvironmentOn=True,
    GIOn=True,
    GIEnvironmentColor=RGB(204, 229, 255),
    LightOn=True,
    LightColor=RGB(255, 255, 255),
    LightAngle=addition_2,
    LightIntensity=1)
merge_2 = Merge(Data1=v_ray_geometry, Data2=v_ray_geometry_2, Data3=v_ray_geometry_3)
v_ray_render = VRayRender(
    Engine=1,
    Mode=1,
    Sampler=1,
    Quality=0,
    OutputImage="C:\Users\Michael\Desktop\220924_TestingGrasshoperAndVray\animation_13\animation_13.png",
    OutputResolution=[2000, 2000],
    Camera=v_ray_camera.Camera,
    LightRig=v_ray_light_rig_simple,
    VGeometry=flatten(merge_2),
    Timeline=v_ray_timeline.Timeline,
    RenderElements=v_ray_element_denoiser,
    UpdateEffectsFrequency=0)

# ==== cluster Cluster
point = ClusterInput()
point_2 = ClusterInput()
deconstruct = Deconstruct(Point=point)  # -> XComponent, YComponent, ZComponent
deconstruct_2 = Deconstruct(Point=point_2)  # -> XComponent, YComponent, ZComponent
merge = Merge(Data1=deconstruct.XComponent, Data2=deconstruct_2.XComponent)
merge_2 = Merge(Data1=deconstruct.YComponent, Data2=deconstruct_2.YComponent)
merge_3 = Merge(Data1=deconstruct.ZComponent, Data2=deconstruct_2.ZComponent)
average = Average(Input=merge)
average_2 = Average(Input=merge_2)
average_3 = Average(Input=merge_3)
construct_point = ConstructPoint(XCoordinate=average, YCoordinate=average_2, ZCoordinate=average_3)
point_3 = ClusterOutput(construct_point)

# ==== cluster Cluster_2
origin = ClusterInput()
xy_plane = XYPlane(Origin=origin)
flip_plane = FlipPlane(Plane=xy_plane, ReverseX=False, ReverseY=False, SwapAxes=True)
plane = ClusterOutput(flip_plane)
