# Grasshopper definition 250413_MandalaSeriesPart2Start.gh (Grasshopper 1.0.7)

# The Mandala Series
curve_length_division = Slider(0.498, range=0..1)
geometry = Geometry(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)
geometry_2 = Geometry(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)
curve_count_division = Slider(31, range=0..100)
divide_length = DivideLength(Curve=geometry_2, Length=curve_length_division)  # -> Points, Tangents, Parameters
divide_curve = DivideCurve(Curve=geometry_2, Count=curve_count_division, Kinks=False)  # -> Points, Tangents, Parameters
unit_z = UnitZ(Factor=1)
cross_product = CrossProduct(VectorA=divide_length.Tangents, VectorB=unit_z, Unitize=False)  # -> Vector, Length

line_extension = Slider(-3.582, range=-11..11)
line_divider = Slider(0.1, range=0..1)
selection_of_divided_line = Slider(1, range=0..1)

line_sdl = LineSDL(Start=divide_length.Points, Direction=cross_product.Vector, Length=line_extension)
shatter = Shatter(Curve=reparameterize(line_sdl), Parameters=line_divider)
list_item = ListItem(List=shatter, Index=selection_of_divided_line, Wrap=True)
panel = Panel(shatter)
