# Grasshopper definition 250423_MandalaSeriesPart2End.gh (Grasshopper 1.0.7)

# The Mandala Series
curve_length_division = Slider(0.885, range=0..1)
geometry = Geometry(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)
geometry_2 = Geometry(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)
curve_count_division = Slider(37, range=0..100)
divide_length = DivideLength(Curve=geometry_2, Length=curve_length_division)  # -> Points, Tangents, Parameters
divide_curve = DivideCurve(Curve=geometry_2, Count=curve_count_division, Kinks=False)  # -> Points, Tangents, Parameters
unit_z = UnitZ(Factor=1)
cross_product = CrossProduct(VectorA=divide_length.Tangents, VectorB=unit_z, Unitize=False)  # -> Vector, Length

line_extension = Slider(-3.582, range=-11..11)
line_divider = Slider(0.1, range=0..1)
selection_of_divided_line = Slider(1, range=0..1)

line_sdl = LineSDL(Start=divide_length.Points, Direction=cross_product.Vector, Length=line_extension)
shatter = Shatter(Curve=reparameterize(line_sdl), Parameters=line_divider)
list_item = ListItem(List=shatter, Index=selection_of_divided_line, Wrap=True)
panel = Panel(shatter)
end_points = EndPoints(Curve=list_item)  # -> Start, End
point = Point(end_points.End)
flatten_tree = FlattenTree(Tree=point, Path="{0}")
panel_2 = Panel("-1")  # disabled
panel_3 = Panel("1")  # disabled
shift_list = ShiftList(List=flatten_tree, Shift=panel_3, Wrap=True)  # disabled
shift_list_2 = ShiftList(List=flatten_tree, Shift=panel_2, Wrap=True)  # disabled
closest_points = ClosestPoints(Point=point, Cloud=flatten_tree, Count=3)  # -> ClosestPoint, CPIndex, Distance
distance = Distance(PointA=flatten_tree, PointB=shift_list)  # disabled
distance_2 = Distance(PointA=flatten_tree, PointB=shift_list_2)  # disabled
smaller_than = SmallerThan(FirstNumber=distance, SecondNumber=distance_2)  # -> SmallerThan, OrEqualTo; disabled
list_item_2 = ListItem(List=closest_points.Distance, Index="1", Wrap=True)
weave = Weave(Pattern=smaller_than.OrEqualTo, Stream0=distance_2, Stream1=distance, NullGaps=False)  # disabled
number_slider = Slider(1, range=0..1)
length = Length(Curve=list_item)
graft_tree = GraftTree(Tree=weave, IncludeEmptyLists=True, IncludeNullItems=True)  # disabled
division = Division(A=list_item_2, B="2")
subtraction = Subtraction(A=length, B=division)
evaluate_length = EvaluateLength(Curve=list_item, Length=subtraction, Normalized=False)  # -> Point, Tangent, Parameter
circle = Circle(Plane=point, Radius=division)
panel_4 = Panel(graft_tree)  # disabled
line = Line(StartPoint=end_points.Start, EndPoint=evaluate_length.Point)
panel_5 = Panel(length)
line_2 = Line(line)
