# Grasshopper definition 250701_MandalaSeriesPart3Start.gh (Grasshopper 1.0.7)

curve_length_division = Slider(0.987, range=0..1)
geometry = Geometry(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)
# The Mandala Series
geometry_2 = Geometry(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)
divide_length = DivideLength(Curve=geometry_2, Length=curve_length_division)  # -> Points, Tangents, Parameters
unit_z = UnitZ(Factor=1)
cross_product = CrossProduct(VectorA=divide_length.Tangents, VectorB=unit_z, Unitize=False)  # -> Vector, Length

line_extension = Slider(-4.006, range=-11..11)
line_divider = Slider(0.37, range=0..1)
selection_of_divided_line = Slider(1, range=0..1)

line_sdl = LineSDL(Start=divide_length.Points, Direction=cross_product.Vector, Length=line_extension)
shatter = Shatter(Curve=reparameterize(line_sdl), Parameters=line_divider)
list_item = ListItem(List=shatter, Index=selection_of_divided_line, Wrap=True)
panel = Panel(shatter)
end_points = EndPoints(Curve=list_item)  # -> Start, End
point = Point(end_points.End)
flatten_tree = FlattenTree(Tree=point, Path="{0}")
closest_points = ClosestPoints(Point=point, Cloud=flatten_tree, Count=3)  # -> ClosestPoint, CPIndex, Distance
list_item_2 = ListItem(List=closest_points.Distance, Index="1", Wrap=True)
number_slider = Slider(1, range=0..1)
length = Length(Curve=list_item)
division = Division(A=list_item_2, B="2")
subtraction = Subtraction(A=length, B=division)
evaluate_length = EvaluateLength(Curve=list_item, Length=subtraction, Normalized=False)  # -> Point, Tangent, Parameter
circle = Circle(Plane=point, Radius=division)
line = Line(StartPoint=end_points.Start, EndPoint=evaluate_length.Point)
panel_2 = Panel(length)
line_2 = Line(line)
