# Grasshopper definition 250714_MandalaSeriesPart4Start.gh (Grasshopper 1.0.7)

curve_length_division = Slider(0.987, range=0..1)
geometry = Geometry(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)
# The Mandala Series
geometry_2 = Geometry(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)
divide_length = DivideLength(Curve=geometry_2, Length=curve_length_division)  # -> Points, Tangents, Parameters
unit_z = UnitZ(Factor=1)
cross_product = CrossProduct(VectorA=divide_length.Tangents, VectorB=unit_z, Unitize=False)  # -> Vector, Length

line_extension = Slider(-4.575, range=-11..11)
line_divider = Slider(0.08, range=0..1)
selection_of_divided_line = Slider(1, range=0..1)

multiplier = Slider(3.96, range=0..10)

list_length = ListLength(List=divide_length.Points)
random = Random(Range=line_extension, Number=list_length, Seed=2)
series = Series(Start=0, Step=Slider(0.27, range=0..2), Count=list_length)
sine = Sine(Value=series)
absolute = Absolute(Value=sine)
false_random_true_sinus = BooleanToggle(True)
negative = Negative(Value=absolute)
multiplication = Multiplication(A=negative, B=multiplier)
stream_filter = StreamFilter(Gate=false_random_true_sinus, Stream0=random, Stream1=multiplication)

line_sdl = LineSDL(Start=divide_length.Points, Direction=cross_product.Vector, Length=stream_filter)
shatter = Shatter(Curve=reparameterize(line_sdl), Parameters=line_divider)
list_item = ListItem(List=shatter, Index=selection_of_divided_line, Wrap=True)
panel = Panel(shatter)
end_points = EndPoints(Curve=list_item)  # -> Start, End
point = Point(end_points.End)
flatten_tree = FlattenTree(Tree=point, Path="{0}")
closest_points = ClosestPoints(Point=point, Cloud=flatten_tree, Count=3)  # -> ClosestPoint, CPIndex, Distance
list_item_2 = ListItem(List=closest_points.Distance, Index="1", Wrap=True)
number_slider = Slider(1, range=0..1)
length = Length(Curve=list_item)
division = Division(A=list_item_2, B="2")
subtraction = Subtraction(A=length, B=division)
evaluate_length = EvaluateLength(Curve=list_item, Length=subtraction, Normalized=False)  # -> Point, Tangent, Parameter
circle = Circle(Plane=point, Radius=division)
line = Line(StartPoint=end_points.Start, EndPoint=evaluate_length.Point)
panel_2 = Panel(length)
line_2 = Line(line)
divide_curve = DivideCurve(Curve=circle, Count=Slider(22, range=0..100), Kinks=False)  # -> Points, Tangents, Parameters
xy_plane = XYPlane(Origin=Point(0, 0, 0))
delaunay_mesh = DelaunayMesh(Points=flatten(divide_curve.Points), Plane=xy_plane)
mesh_edges = MeshEdges(Mesh=delaunay_mesh)  # -> NakedEdges, InteriorEdges, NonManifoldEdges
geometry_3 = Geometry(mesh_edges.NakedEdges)
join_curves = JoinCurves(Curves=geometry_3, Preserve=False)
offset_curve = OffsetCurve(Curve=join_curves, Distance=Slider(-0.72, range=-1..1), Plane=xy_plane, Corners=2)
