# Grasshopper definition 250730_MandalaSeriesPart5Start.gh (Grasshopper 1.0.7)

curve_length_division = Slider(0.987, range=0..1)
geometry = Geometry(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)
# The Mandala Series
geometry_2 = Geometry(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)
divide_length = DivideLength(Curve=geometry_2, Length=curve_length_division)  # -> Points, Tangents, Parameters
unit_z = UnitZ(Factor=1)
cross_product = CrossProduct(VectorA=divide_length.Tangents, VectorB=unit_z, Unitize=False)  # -> Vector, Length

line_extension = Slider(-5.541, range=-11..11)
line_divider = Slider(0.13, range=0..1)
selection_of_divided_line = Slider(1, range=0..1)

multiplier = Slider(3.96, range=0..10)

list_length = ListLength(List=divide_length.Points)
random = Random(Range=line_extension, Number=list_length, Seed=2)
series = Series(Start=0, Step=Slider(0.27, range=0..2), Count=list_length)
sine = Sine(Value=series)
absolute = Absolute(Value=sine)
false_random_true_sinus = BooleanToggle(True)
negative = Negative(Value=absolute)
multiplication = Multiplication(A=negative, B=multiplier)
stream_filter = StreamFilter(Gate=false_random_true_sinus, Stream0=random, Stream1=multiplication)

line_sdl = LineSDL(Start=divide_length.Points, Direction=cross_product.Vector, Length=stream_filter)
shatter = Shatter(Curve=reparameterize(line_sdl), Parameters=line_divider)
list_item = ListItem(List=shatter, Index=selection_of_divided_line, Wrap=True)
panel = Panel(shatter)
end_points = EndPoints(Curve=list_item)  # -> Start, End
point = Point(end_points.End)
flatten_tree = FlattenTree(Tree=point, Path="{0}")
closest_points = ClosestPoints(Point=point, Cloud=flatten_tree, Count=3)  # -> ClosestPoint, CPIndex, Distance
list_item_2 = ListItem(List=closest_points.Distance, Index="1", Wrap=True)
number_slider = Slider(1, range=0..1)
length = Length(Curve=list_item)
division = Division(A=list_item_2, B="2")
subtraction = Subtraction(A=length, B=division)
evaluate_length = EvaluateLength(Curve=list_item, Length=subtraction, Normalized=False)  # -> Point, Tangent, Parameter
circle = Circle(Plane=point, Radius=division)
line = Line(StartPoint=end_points.Start, EndPoint=evaluate_length.Point)
panel_2 = Panel(length)
line_2 = Line(line)
divide_curve = DivideCurve(Curve=circle, Count=Slider(22, range=0..100), Kinks=False)  # -> Points, Tangents, Parameters
xy_plane = XYPlane(Origin=Point(0, 0, 0))
delaunay_mesh = DelaunayMesh(Points=flatten(divide_curve.Points), Plane=xy_plane)
mesh_edges = MeshEdges(Mesh=delaunay_mesh)  # -> NakedEdges, InteriorEdges, NonManifoldEdges
geometry_3 = Geometry(mesh_edges.NakedEdges)
join_curves = JoinCurves(Curves=geometry_3, Preserve=False)
offset_curve = OffsetCurve(Curve=join_curves, Distance=Slider(-0.41, range=-1..1), Plane=xy_plane, Corners=2)
number_slider_2 = Slider(1.17, range=0..2)
bounding_box = BoundingBox(Content=offset_curve, Plane=PlaneXY(0, 0, 0))  # -> Box, Box_2
area = Area(Geometry=bounding_box.Box)  # -> Area, Centroid
number_slider_3 = Slider(-0.58, range=-5..1)  # disabled
number_slider_4 = Slider(1.64, range=-1..3)  # disabled
scale_nu = ScaleNU(Geometry=bounding_box.Box, Plane=area.Centroid, ScaleX=number_slider_2, ScaleY=number_slider_2, ScaleZ=1)  # -> Geometry, Transform
deconstruct_brep = DeconstructBrep(Brep=scale_nu.Geometry)  # -> Faces, Edges, Vertices
bounding_box_2 = BoundingBox(Content=offset_curve, Plane=PlaneXY(0, 0, 0))  # -> Box, Box_2; disabled
join_curves_2 = JoinCurves(Curves=deconstruct_brep.Edges, Preserve=False)
number_slider_5 = Slider(10, range=0..10)
curve = Curve()
brep_edges = BrepEdges(Brep=bounding_box_2.Box)  # -> Naked, Interior, NonManifold; disabled
curve_closest_point = CurveClosestPoint(Point=deconstruct_brep.Vertices, Curve=offset_curve)  # -> Point, Parameter, Distance
join_curves_3 = JoinCurves(Curves=brep_edges.Naked, Preserve=False)  # disabled
explode = Explode(Curve=join_curves_3, Recursive=True)  # -> Segments, Vertices; disabled
sort_list = SortList(Keys=curve_closest_point.Distance, ValuesValuesA=curve_closest_point.Distance)  # -> Keys, ValuesValuesA
curve_closest_point_2 = CurveClosestPoint(Point=explode.Vertices, Curve=offset_curve)  # -> Point, Parameter, Distance; disabled
list_item_3 = ListItem(List=sort_list.ValuesValuesA, Index="0", Wrap=True)
sort_list_2 = SortList(Keys=curve_closest_point_2.Distance, ValuesValuesA=curve_closest_point_2.Distance)  # -> Keys, ValuesValuesA; disabled
multiplier_fillet = Slider(2.81, range=0.1..3)
panel_3 = Panel("-1")  # disabled
populate_geometry = PopulateGeometry(Geometry=offset_curve, Count=100, Seed=1)
list_item_4 = ListItem(List=sort_list_2.ValuesValuesA, Index=panel_3, Wrap=True)  # disabled
populate_geometry_2 = PopulateGeometry(Geometry=offset_curve, Count=100, Seed=1)  # disabled
multiplication_2 = Multiplication(A=list_item_3, B=multiplier_fillet)
fillet = Fillet(Curve=join_curves_2, Radius=multiplication_2)
fillet_distance = FilletDistance(Curve=join_curves_3, Distance=list_item_4)  # disabled
curve_closest_point_3 = CurveClosestPoint(Point=populate_geometry, Curve=fillet)  # -> Point, Parameter, Distance
curve_2 = Curve()
line_mininum_length = Slider(4.47, range=-2..12)
line_maximum_length = Slider(-7.64, range=-14..2)
sort_list_3 = SortList(Keys=curve_closest_point_3.Parameter, ValuesA=populate_geometry)  # -> Keys, ValuesA
curve_closest_point_4 = CurveClosestPoint(Point=sort_list_3.ValuesA, Curve=fillet)  # -> Point, Parameter, Distance
curve_closest_point_5 = CurveClosestPoint(Point=populate_geometry_2, Curve=fillet_distance)  # -> Point, Parameter, Distance; disabled
construct_domain = ConstructDomain(DomainStart=line_mininum_length, DomainEnd=line_maximum_length)
bounds = Bounds(Numbers=curve_closest_point_4.Distance)
line_3 = Line()  # disabled
bounds_2 = Bounds(Numbers=curve_closest_point_5.Distance)  # disabled
construct_domain_2 = ConstructDomain(DomainStart=number_slider_4, DomainEnd=number_slider_3)  # disabled
line_4 = Line(StartPoint=populate_geometry_2, EndPoint=curve_closest_point_5.Point)  # disabled
line_5 = Line(StartPoint=curve_closest_point_4.Point, EndPoint=sort_list_3.ValuesA)
one_over_x = OneOverX(Value=curve_closest_point_5.Distance)  # disabled
remap_numbers = RemapNumbers(Value=curve_closest_point_4.Distance, Source=bounds, Target=construct_domain)  # -> Mapped, Clipped
remap_numbers_2 = RemapNumbers(Value=curve_closest_point_5.Distance, Source=bounds_2, Target=construct_domain_2)  # -> Mapped, Clipped; disabled
panel_4 = Panel("0")  # disabled
extend_curve = ExtendCurve(Curve=line_5, Type=0, Start=remap_numbers.Mapped, End="0")
extend_curve_2 = ExtendCurve(Curve=line_4, Type=0, Start=panel_4, End=remap_numbers_2.Mapped)  # disabled
clean_tree = CleanTree(RemoveNulls=True, RemoveInvalid=True, RemoveEmpty=False, Tree=extend_curve)
data = Data(clean_tree)
